# Grasshopper definition Chapter2_IntroductionToDataStructures.gh (Grasshopper 1.0.7)

# Input
# Intermediate
# Input and Processes
# Chapter Two: Introduction to Data Structures
panel = Panel("Overview")  # disabled
num = Number(1)  # disabled
panel_2 = Panel("Single Item")  # disabled
# Display the data structure
num_2 = Number(5.5)  # disabled
num_3 = Number([1, 2, 3, 4])  # disabled
num_4 = Number(Tree({0;0}: [1], {0;1}: [5], {0;2}: [9]))  # disabled

# ---- group: Output data strucutre
viewer = ParamViewer(num)  # disabled
viewer_2 = ParamViewer(num)  # disabled

# ---- group: Single item
ma = MassAddition(Input=num)  # -> Result, PartialResults; disabled

# ---- group: Single output value
panel_3 = Panel(num)  # disabled

# ----
panel_4 = Panel(ma.Result)  # disabled
# Item: single branch with single item
viewer_3 = ParamViewer(num_2)  # disabled
# List: single branch with multiple items
viewer_4 = ParamViewer(num_3)  # disabled
# Tree: multiple branches
viewer_5 = ParamViewer(num_4)  # disabled
# Processes
panel_5 = Panel("DATA STRUCTURES")  # disabled
num_5 = Number([1, 2, 3, 4])  # disabled
panel_6 = Panel("List")  # disabled

# ---- group: Output data strucutre
viewer_6 = ParamViewer(num_5)  # disabled
viewer_7 = ParamViewer(num_5)  # disabled

# ---- group: List input
ma_2 = MassAddition(Input=num_5)  # -> Result, PartialResults; disabled

# ---- group: List of output values
panel_7 = Panel(num_5)  # disabled

# ----
panel_8 = Panel(ma_2.Result)  # disabled
panel_9 = Panel("Tree")  # disabled
num_6 = Number(Tree({0;0}: [1, 2, 3, 4], {0;1}: [5, 6, 7], {0;2}: [8, 9]))  # disabled

# ---- group: Tree input
ma_3 = MassAddition(Input=num_6)  # -> Result, PartialResults; disabled

# ---- group: Tree of output values
panel_10 = Panel(num_6)  # disabled

# ---- group: Output data strucutre
viewer_8 = ParamViewer(num_6)  # disabled
viewer_9 = ParamViewer(num_6)  # disabled

# ----
panel_11 = Panel(ma_3.Result)  # disabled
# Output
panel_12 = Panel("Generating lists")  # disabled

series = Series(Start=0, Step=1, Count=10)  # disabled
panel_13 = Panel("15.5")  # disabled

# ---- group: List input
panel_14 = Panel("1 to 5")  # disabled
panel_15 = Panel("4")  # disabled
range = Range(Domain=panel_14, Steps=panel_15)  # disabled

# ---- group: Number of spans
# Tutorial
# Explore 4 different ways to create circles. Use different data sources and data structures
number_slider = Slider(4, range=2..8)  # disabled

# ----
panel_16 = Panel("1 to 5")  # disabled
panel_17 = Panel("6")  # disabled
random = Random(Range=panel_16, Number=panel_17, Seed=2)  # disabled

# ---- group: Number of steps
panel_18 = Panel("7")  # disabled

# ---- group: Number of elements
panel_19 = Panel("7")  # disabled

# ---- group: Domain
panel_20 = Panel("1.1 To 12.5")  # disabled

# ----
viewer_10 = ParamViewer(series)  # disabled
pt = ConstructPoint(XCoordinate=panel_13, YCoordinate=panel_13, ZCoordinate=series)  # disabled

# ---- group: Number of elements
panel_21 = Panel("5")  # disabled

# ----
panel_22 = Panel("10,0,0")  # disabled
panel_23 = Panel("4,4,4")  # disabled

# ---- group: Domain of values
panel_24 = Panel("3 To 7")  # disabled

# ---- group: Start number
panel_25 = Panel("4")  # disabled

# ---- group: Step size
panel_26 = Panel("6")  # disabled

# ---- group: Input line
line = Line(Line((-1, 0, 0), (-3, 3, 0)))  # disabled

# ----
viewer_11 = ParamViewer(range)  # disabled
viewer_12 = ParamViewer(pt)  # disabled
range_2 = Range(Domain=panel_20, Steps=panel_18)  # disabled
series_2 = Series(Start=panel_25, Step=panel_26, Count=panel_19)  # disabled
random_2 = Random(Range=panel_24, Number=panel_21, Seed=2)  # disabled

# ---- group: divide curve
divide = DivideCurve(Curve=line, Count=number_slider, Kinks=False)  # -> Points, Tangents, Parameters; disabled

# ----
viewer_13 = ParamViewer(random)  # disabled

# ---- group: Plane:internal, Radius:Supplied range
cir = Circle(Plane=PlaneXY(0, 0, 0), Radius=range)  # disabled

# ---- group: Center:Supplied, Radius:Supplied random list
circle = CircleCNR(Center=panel_22, Normal=Vector(0, 0, 1), Radius=random)  # disabled

# ---- group: A:Internal, B:Supplied, C:Supplied list
circle_2 = Circle3Pt(PointA=Point(17.14231408, 8.156876478, 0), PointB=panel_23, PointC=pt)  # -> Circle, Plane, Radius; disabled

# ---- group: Directly set
circle_3 = Circle({Plane=Plane(origin=(4.696767341, 11.56302611, 0), x=(0.6204030727, -0.7842831296, 0), y=(0.7842831296, 0.6204030727, 0)), Radius=5.595801609})  # disabled

# ----
panel_27 = Panel(divide.Points)  # disabled
viewer_14 = ParamViewer(divide.Points)  # disabled

panel_28 = Panel(range_2)  # disabled
viewer_15 = ParamViewer(range_2)  # disabled

panel_29 = Panel(series_2)  # disabled
viewer_16 = ParamViewer(series_2)  # disabled

viewer_17 = ParamViewer(random_2)  # disabled
panel_30 = Panel(random_2)  # disabled

viewer_18 = ParamViewer(cir)  # disabled
viewer_19 = ParamViewer(circle)  # disabled
viewer_20 = ParamViewer(circle_2.Circle)  # disabled
viewer_21 = ParamViewer(circle_3)  # disabled
panel_31 = Panel("List operations")  # disabled
# Tutorial
# Using the given 2 lists of points, recreate the following images
image = ImageSampler(
    FilePath="C:\Users\Rajaa Issa\Desktop\EssentialAlgorithmsAndDataStructures\Images\02_03_1_A.png",
    Filter="Colour",
    Interpolate=False,
    Umax=1,
    Umin=0,
    Vmax=1,
    Vmin=0,
    Wrap=1)  # disabled
image_2 = ImageSampler(
    FilePath="C:\Users\Rajaa Issa\Desktop\EssentialAlgorithmsAndDataStructures\Images\02_03_1_B.png",
    Filter="Colour",
    Interpolate=False,
    Umax=1,
    Umin=0,
    Vmax=1,
    Vmin=0,
    Wrap=1)  # disabled
image_3 = ImageSampler(
    FilePath="C:\Users\Rajaa Issa\Desktop\EssentialAlgorithmsAndDataStructures\Images\02_03_1_C.png",
    Filter="Colour",
    Interpolate=False,
    Umax=1,
    Umin=0,
    Vmax=1,
    Vmin=0,
    Wrap=1)  # disabled
image_4 = ImageSampler(
    FilePath="C:\Users\Rajaa Issa\Desktop\EssentialAlgorithmsAndDataStructures\Images\02_03_1_D.png",
    Filter="Colour",
    Interpolate=False,
    Umax=1,
    Umin=0,
    Vmax=1,
    Vmin=0,
    Wrap=1)  # disabled
image_5 = ImageSampler(
    FilePath="C:\Users\Rajaa Issa\Desktop\EssentialAlgorithmsAndDataStructures\Images\02_03_1_E.png",
    Filter="Colour",
    Interpolate=False,
    Umax=1,
    Umin=0,
    Vmax=1,
    Vmin=0,
    Wrap=1)  # disabled
image_6 = ImageSampler(
    FilePath="C:\Users\Rajaa Issa\Desktop\EssentialAlgorithmsAndDataStructures\Images\02_03_1_F.png",
    Filter="Colour",
    Interpolate=False,
    Umax=1,
    Umin=0,
    Vmax=1,
    Vmin=0,
    Wrap=1)  # disabled
image_7 = ImageSampler(
    FilePath="C:\Users\Rajaa Issa\Desktop\EssentialAlgorithmsAndDataStructures\Images\02_03_1_G.png",
    Filter="Colour",
    Interpolate=False,
    Umax=1,
    Umin=0,
    Vmax=1,
    Vmin=0,
    Wrap=1)  # disabled
image_8 = ImageSampler(
    FilePath="C:\Users\Rajaa Issa\Desktop\EssentialAlgorithmsAndDataStructures\Images\02_03_1_H.png",
    Filter="Colour",
    Interpolate=False,
    Umax=1,
    Umin=0,
    Vmax=1,
    Vmin=0,
    Wrap=1)  # disabled

# ---- group: list
num_7 = Number(random_2)  # disabled

# ----
panel_32 = Panel(num_7)  # disabled
number_slider_2 = Slider(10, range=0..10)  # disabled

# ---- group: Cull pattern
panel_33 = Panel("""False
True""")  # disabled

# ----
panel_34 = Panel("""True
False""")  # disabled
panel_35 = Panel("""True
False""")  # disabled
panel_36 = Panel("""True
False""")  # disabled

# ---- group: Input lists A and B
pt_2 = Point([Point(9.681051778, 2.404935026, 0), Point(11.66138135, 2.718588409, 0), Point(13.44786257, 3.628846048, 0), Point(14.86562205, 5.046605541, 0), Point(15.77587973, 6.833086911, 0), Point(16.08953305, 8.813416302, 0), Point(15.77587967, 10.79374587, 0), Point(14.86562203, 12.58022709, 0), Point(13.44786254, 13.99798658, 0), Point(11.66138117, 14.90824425, 0), Point(9.681051778, 15.22189758, 0), Point(7.700722206, 14.90824419, 0), Point(5.914240986, 13.99798655, 0), Point(4.496481502, 12.58022706, 0), Point(3.586223827, 10.79374569, 0), Point(3.272570503, 8.813416302, 0), Point(3.586223886, 6.833086729, 0), Point(4.496481525, 5.046605509, 0), Point(5.914241018, 3.628846025, 0), Point(7.700722388, 2.71858835, 0)])  # disabled
pt_3 = Point([Point(9.681051778, 6.048259916, 0), Point(10.53553207, 6.183596296, 0), Point(11.30636993, 6.576357796, 0), Point(11.91811029, 7.188098168, 0), Point(12.31087181, 7.958936086, 0), Point(12.44620816, 8.813416302, 0), Point(12.31087178, 9.667896595, 0), Point(11.91811028, 10.43873445, 0), Point(11.30636991, 11.05047482, 0), Point(10.53553199, 11.44323633, 0), Point(9.681051778, 11.57857269, 0), Point(8.826571485, 11.44323631, 0), Point(8.055733631, 11.05047481, 0), Point(7.443993263, 10.43873444, 0), Point(7.051231747, 9.667896517, 0), Point(6.915895393, 8.813416302, 0), Point(7.051231772, 7.958936008, 0), Point(7.443993273, 7.188098154, 0), Point(8.055733645, 6.576357786, 0), Point(8.826571563, 6.18359627, 0)])  # disabled

# ----
panel_37 = Panel("-1")  # disabled

# ---- group: List length
lng = ListLength(List=num_7)  # disabled
panel_38 = Panel(lng)  # disabled

# ---- group: Select items
item = ListItem(List=num_7, Index=number_slider_2, Wrap=True)  # disabled
panel_39 = Panel(item)  # disabled

# ---- group: Reverse list
rev = ReverseList(List=num_7)  # disabled
panel_40 = Panel(rev)  # disabled

# ---- group: Sort list assending
sort = SortList(Keys=num_7)  # -> Keys, ValuesA; disabled
panel_41 = Panel(sort.Keys)  # disabled

# ---- group: Cull every other element
cull = CullPattern(List=num_7, CullPattern=panel_33)  # disabled
panel_42 = Panel(cull)  # disabled

# ---- group: dispatch every other element
dispatch = Dispatch(List=num_7, DispatchPattern=panel_33)  # -> ListA, ListB; disabled
panel_43 = Panel(dispatch.ListA)  # disabled
panel_44 = Panel(dispatch.ListB)  # disabled

# ---- group: Sift then cull points A
shift = ShiftList(List=pt_2, Shift=1, Wrap=True)  # disabled
cull_2 = CullPattern(List=shift, CullPattern=panel_36)  # disabled

# ---- group: Shift forward
shift_2 = ShiftList(List=pt_2, Shift=1, Wrap=True)  # disabled

# ---- group: Shift backward
shift_3 = ShiftList(List=pt_2, Shift=panel_37, Wrap=True)  # disabled

# ---- group: randomize list
jitter = Jitter(List=pt_2, Jitter=1, Seed=2)  # -> Values, Indices; disabled

# ---- group: Cull every other point
cull_3 = CullPattern(List=pt_2, CullPattern=panel_35)  # disabled
cull_4 = CullPattern(List=pt_3, CullPattern=panel_35)  # disabled

# ---- group: Reverse list
rev_2 = ReverseList(List=pt_3)  # disabled

# ---- group: Cull every other point
cull_5 = CullPattern(List=pt_2, CullPattern=panel_36)  # disabled
cull_6 = CullPattern(List=pt_3, CullPattern=panel_36)  # disabled

# ---- group: Connect input lists
ln = Line(StartPoint=pt_2, EndPoint=pt_3)  # disabled

# ---- group: Connect lists
ln_2 = Line(StartPoint=shift_2, EndPoint=pt_3)  # disabled

ln_3 = Line(StartPoint=shift_3, EndPoint=pt_3)  # disabled

# ---- group: Select every other line
cull_7 = CullPattern(List=ln_2, CullPattern=panel_34)  # disabled
cull_8 = CullPattern(List=ln_3, CullPattern=panel_34)  # disabled

# ---- group: Connect
ln_4 = Line(StartPoint=jitter.Values, EndPoint=pt_3)  # disabled

ln_5 = Line(StartPoint=cull_3, EndPoint=cull_4)  # disabled

ln_6 = Line(StartPoint=pt_2, EndPoint=rev_2)  # disabled

# ---- group: Peripheral lines
ln_7 = Line(StartPoint=cull_2, EndPoint=cull_5)  # disabled

# ---- group: Radial lines
ln_8 = Line(StartPoint=cull_5, EndPoint=cull_6)  # disabled

# ---- group: Output
crv = Curve(ln)  # disabled

crv_2 = Curve(ln_2)  # disabled

crv_3 = Curve(ln_3)  # disabled

crv_4 = Curve([cull_7, cull_8])  # disabled

crv_5 = Curve(ln_4)  # disabled

crv_6 = Curve(ln_5)  # disabled

crv_7 = Curve(ln_6)  # disabled

crv_8 = Curve(ln_7)  # disabled

crv_9 = Curve(ln_8)  # disabled

# ----
panel_45 = Panel("""1
2""")  # disabled
panel_46 = Panel("""1
2
3
4
5""")  # disabled

panel_47 = Panel("""1
2
3
4
5""")  # disabled
panel_48 = Panel("""1
2""")  # disabled

panel_49 = Panel("List Matching")  # disabled

# ---- group: X
panel_50 = Panel("""1
2""")  # disabled

# ---- group: Y
panel_51 = Panel("1")  # disabled

# ---- group: Z
panel_52 = Panel("""1
2
3""")  # disabled

# ---- group: Single value to all input
# Matching identical input structure
panel_53 = Panel("1")  # disabled
panel_54 = Panel("3.5")  # disabled

# ---- group: Equal length lists
panel_55 = Panel("""1
2""")  # disabled
panel_56 = Panel("""10
20""")  # disabled

# ----
panel_57 = Panel("""1
2
3
4
5""")  # disabled
panel_58 = Panel("""1
2
2
2
2""")  # disabled

# ----
# Default matching
panel_59 = Panel("""1
2""")  # disabled
panel_60 = Panel("""1
2
3
4
5""")  # disabled

# ----
# Tutorial
# Given 3 lists of coordinats, X has 2 elements, Y has 1 element and Z has 3 elements, what is the number of points generated in each of the following matching:
# 1- Long
# 2- Short
# 3- Cross reference
# Show in an example.
panel_61 = Panel("""1
2
3
4
5""")  # disabled

# ----
# Data matching methods
panel_62 = Panel("""1
2""")  # disabled
panel_63 = Panel("""1
2
3
4
5""")  # disabled

panel_64 = Panel("""1
2""")  # disabled
panel_65 = Panel("""1
2
3
4
5""")  # disabled

panel_66 = Panel("""1
2""")  # disabled
panel_67 = Panel("""1
2
3
4
5""")  # disabled

# ----
# Custom matching
panel_68 = Panel("""1
2""")  # disabled
# Tutorial
# Given the following list of numbers, create the grid in the image using Construct Point" component
image_9 = ImageSampler(
    FilePath="C:\Users\Rajaa Issa\Desktop\EssentialAlgorithmsAndDataStructures\Images\02_06_BoxPoints.png",
    Filter="Colour",
    Interpolate=False,
    Umax=1,
    Umin=0,
    Vmax=1,
    Vmin=0,
    Wrap=1)  # disabled

# ---- group: Input numbers
# Check the input
num_8 = Number([0, 1, 2, 3, 4, 5])  # disabled

num_9 = Number([0, 1, 2, 3, 4, 5])  # disabled

# Generate all permutations
# Construct the points
num_10 = Number([0, 1, 2, 3, 4, 5])  # disabled

# ---- group: Order of input matters
crossref = CrossReference(ListA=panel_47, ListB=panel_48, CrossMode=1)  # -> ListA, ListB; disabled

# ---- group: First list matched with each item from second list
crossref_2 = CrossReference(ListA=panel_45, ListB=panel_46, CrossMode=1)  # -> ListA, ListB; disabled

# ---- group: Repeat to match longer list
lng_2 = ListLength(List=panel_61)  # disabled
repeat = RepeatData(Data=panel_68, Length=lng_2)  # disabled

# ---- group: match to longer list
long = LongestList(ListA=panel_64, ListB=panel_65, PaddingMode=2)  # -> ListA, ListB; disabled

# ---- group: Match to shorter list
short = ShortestList(ListA=panel_66, ListB=panel_67, TrimMode=2)  # -> ListA, ListB; disabled

# ----
addition = Addition(A=panel_53, B=panel_54)  # disabled
addition_2 = Addition(A=panel_55, B=panel_56)  # disabled

# ---- group: Cross reference the lists
crossref_3 = CrossReference(ListA=num_10, ListB=num_10, ListC=num_10, CrossMode=1)  # -> ListA, ListB, ListC; disabled

crossref_4 = CrossReference(ListA=num_9, ListB=num_9, ListC=num_9, CrossMode=1)  # -> ListA, ListB, ListC; disabled

# ----
panel_69 = Panel(short.ListA)  # disabled
panel_70 = Panel(long.ListA)  # disabled
panel_71 = Panel(long.ListB)  # disabled
panel_72 = Panel(short.ListB)  # disabled

panel_73 = Panel(num_8)  # disabled
viewer_22 = ParamViewer(num_8)  # disabled

panel_74 = Panel(crossref.ListA)  # disabled
panel_75 = Panel(crossref_2.ListA)  # disabled
long_2 = LongestList(ListA=panel_50, ListB=panel_51, ListC=panel_52, PaddingMode=2)  # -> ListA, ListB, ListC; disabled
short_2 = ShortestList(ListA=panel_50, ListB=panel_51, ListC=panel_52, TrimMode=2)  # -> ListA, ListB, ListC; disabled
crossref_5 = CrossReference(ListA=panel_50, ListB=panel_51, ListC=panel_52, CrossMode=1)  # -> ListA, ListB, ListC; disabled
panel_76 = Panel(addition)  # disabled
viewer_23 = ParamViewer(addition)  # disabled
panel_77 = Panel(addition_2)  # disabled
viewer_24 = ParamViewer(addition_2)  # disabled

# ---- group: Last item of short list is repeated
addition_3 = Addition(A=panel_59, B=panel_60)  # disabled

# ----
addition_4 = Addition(A=panel_58, B=panel_57)  # disabled
addition_5 = Addition(A=panel_62, B=panel_63)  # disabled
addition_6 = Addition(A=long.ListA, B=long.ListB)  # disabled
addition_7 = Addition(A=short.ListA, B=short.ListB)  # disabled
addition_8 = Addition(A=crossref.ListA, B=crossref.ListB)  # disabled
addition_9 = Addition(A=crossref_2.ListA, B=crossref_2.ListB)  # disabled
addition_10 = Addition(A=repeat, B=panel_61)  # disabled
panel_78 = Panel(repeat)  # disabled
panel_79 = Panel(crossref.ListB)  # disabled
panel_80 = Panel(crossref_2.ListB)  # disabled
panel_81 = Panel(crossref_3.ListA)  # disabled
pt_4 = ConstructPoint(XCoordinate=long_2.ListA, YCoordinate=long_2.ListB, ZCoordinate=long_2.ListC)  # disabled
pt_5 = ConstructPoint(XCoordinate=short_2.ListA, YCoordinate=short_2.ListB, ZCoordinate=short_2.ListC)  # disabled
pt_6 = ConstructPoint(XCoordinate=crossref_5.ListA, YCoordinate=crossref_5.ListB, ZCoordinate=crossref_5.ListC)  # disabled
panel_82 = Panel(addition_3)  # disabled
panel_83 = Panel(addition_7)  # disabled
panel_84 = Panel(addition_4)  # disabled
panel_85 = Panel(addition_5)  # disabled
# GH defaults to Long List matching
panel_86 = Panel(addition_6)  # disabled

# ---- group: Construct points
pt_7 = ConstructPoint(XCoordinate=crossref_4.ListA, YCoordinate=crossref_4.ListB, ZCoordinate=crossref_4.ListC)  # disabled

# ----
panel_87 = Panel(addition_10)  # disabled
panel_88 = Panel(addition_9)  # disabled
panel_89 = Panel(addition_8)  # disabled
panel_90 = Panel(crossref_3.ListB)  # disabled
panel_91 = Panel(pt_4)  # disabled
panel_92 = Panel(pt_5)  # disabled
panel_93 = Panel(pt_6)  # disabled

# ---- group: Cube points
pt_8 = Point(pt_7)  # disabled

# ----
panel_94 = Panel(crossref_3.ListC)  # disabled

# ---- group: Output points structure
viewer_25 = ParamViewer(pt_8)  # disabled

# ---- group: Input line
# Introduction to Data Structures Assignment
# Q1
# Create a surface similar to the one in the image with thickness that changes in 10 locations random along the curve. Thickness variations are random between 1 and 3.
line_2 = Line(Line((2, 3, 0), (8.2, 11.2, 10.2)))  # disabled

# ---- group: Number of intervals
panel_95 = Panel("10")  # disabled

# ---- group: Thickness range
# Solution
panel_96 = Panel("1 to 3")  # disabled

# ---- group: Input line
line_3 = Line(Line((2, 3, 0), (8.2, 11.2, 10.2)))  # disabled

# ---- group: Number of intervals
panel_97 = Panel("10")  # disabled

# ---- group: Thickness range
# Q2
# Elaborate on the default list matching in the following example. Compare the result with the "Shortest List" matching, then try to create custom matching that repeats the same pattern of the elements on the shorter lists
panel_98 = Panel("1 to 3")  # disabled

# ---- group: Lists of numbers
num_11 = Number([1, 2])  # disabled
num_12 = Number([10, 20, 30])  # disabled
# Solution
num_13 = Number([0.2, 0.4, 0.6, 0.8, 1])  # disabled

# ---- group: Different list sizes
num_14 = Number([1, 2])  # disabled
num_15 = Number([10, 20, 30])  # disabled
num_16 = Number([0.2, 0.4, 0.6, 0.8, 1])  # disabled

num_17 = Number([1, 2])  # disabled
num_18 = Number([10, 20, 30])  # disabled
num_19 = Number([0.2, 0.4, 0.6, 0.8, 1])  # disabled

num_20 = Number([1, 2])  # disabled
num_21 = Number([10, 20, 30])  # disabled
num_22 = Number([0.2, 0.4, 0.6, 0.8, 1])  # disabled

# ---- group: Input line
# Q3
# Create simple truss as in the image. Use given baseline and other input
line_4 = Line(Line((14.3, 2.1, 0), (78.2, 2.1, 0)))  # disabled

# ---- group: Height
panel_100 = Panel("7")  # disabled

# ---- group: Joint radius
# Solution
panel_101 = Panel("0.5")  # disabled

# ---- group: Input line
line_5 = Line(Line((14.3, 2.1, 0), (78.2, 2.1, 0)))  # disabled

# ---- group: Number of runs
panel_102 = Panel("10")  # disabled

# ---- group: Height
panel_103 = Panel("7")  # disabled

# ---- group: Joint radius
# Q2
# Create a necklace with one big pearl in the middle, and gradually smaller size pearls towards the ends as in the image. Make number of pearls parametric odd number between 15-25
panel_104 = Panel("0.5")  # disabled

# ---- group: Number of pearls
number_slider_3 = Slider(15, range=15..25)  # disabled

# ---- group: Input curve
# Solution
crv_10 = Curve(reparameterize(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))  # disabled

# ---- group: Find length of longest list
lng_3 = ListLength(List=num_20)  # disabled
lng_4 = ListLength(List=num_21)  # disabled
lng_5 = ListLength(List=num_22)  # disabled
bnd = Bounds(Numbers=[lng_3, lng_4, lng_5])  # disabled
dedomain = DeconstructDomain(Domain=bnd)  # -> Start, End; disabled

# ----
panel_105 = Panel(num_11)  # disabled
panel_106 = Panel(num_12)  # disabled
panel_107 = Panel(num_14)  # disabled
panel_108 = Panel(num_15)  # disabled
panel_109 = Panel(num_16)  # disabled
panel_110 = Panel(num_17)  # disabled
panel_111 = Panel(num_18)  # disabled
panel_112 = Panel(num_19)  # disabled
panel_113 = Panel(num_13)  # disabled

# ---- group: Random intervals
random_3 = Random(Range=Domain(0, 1), Number=panel_97, Seed=2)  # disabled
sort_2 = SortList(Keys=random_3)  # -> flatten(Keys), ValuesA; disabled

# ---- group: Random thicknesses
random_4 = Random(Range=panel_98, Number=panel_97, Seed=2)  # disabled

# ----
image_10 = ImageSampler(
    FilePath="C:\Users\Rajaa Issa\Desktop\EssentialAlgorithmsAndDataStructures\Images\02_10_Q1_image.png",
    Filter="Colour",
    Interpolate=False,
    Umax=1,
    Umin=0,
    Vmax=1,
    Vmin=0,
    Wrap=1)  # disabled
image_11 = ImageSampler(
    FilePath="C:\Users\Rajaa Issa\Desktop\EssentialAlgorithmsAndDataStructures\Images\02_11_Q3_image.png",
    Filter="Colour",
    Interpolate=False,
    Umax=1,
    Umin=0,
    Vmax=1,
    Vmin=0,
    Wrap=1)  # disabled
image_12 = ImageSampler(
    FilePath="C:\Users\Rajaa Issa\Desktop\EssentialAlgorithmsAndDataStructures\Images\02_09_Necklace.png",
    Filter="Colour",
    Interpolate=False,
    Umax=1,
    Umin=0,
    Vmax=1,
    Vmin=0,
    Wrap=1)  # disabled

# ---- group: Divide line to double number of runs
panel_114 = Panel("2")  # disabled
multiplication = Multiplication(A=panel_102, B=panel_114)  # disabled
divide_2 = DivideCurve(Curve=line_5, Count=multiplication, Kinks=False)  # -> Points, Tangents, Parameters; disabled

# ---- group: Create ordered list of normalized distances
range_3 = Range(Domain=Domain(0, 1), Steps=number_slider_3)  # disabled
graph = GraphMapper(range_3, x0=0, x1=1, y0=0, y1=1, container_name="Bezier", cpx=[0, 0.4057970941, 0.6021741629, 1], cpy=[0, 0, 1, 1])  # disabled

# ----
pt_9 = ConstructPoint(XCoordinate=num_11, YCoordinate=num_12, ZCoordinate=num_13)  # disabled
pt_10 = ConstructPoint(XCoordinate=num_14, YCoordinate=num_15, ZCoordinate=num_16)  # disabled
short_3 = ShortestList(ListA=num_17, ListB=num_18, ListC=num_19, TrimMode=2)  # -> ListA, ListB, ListC; disabled
panel_115 = Panel(pt_10)  # disabled
viewer_26 = ParamViewer(pt_10)  # disabled
panel_116 = Panel(dedomain.End)  # disabled
panel_117 = Panel(short_3.ListB)  # disabled
panel_118 = Panel(short_3.ListA)  # disabled
panel_119 = Panel(short_3.ListC)  # disabled

# ---- group: Center points
eval = EvaluateCurve(Curve=line_3, Parameter=sort_2.Keys)  # -> Point, Tangent, Angle; disabled

# ----
panel_120 = Panel(pt_9)  # disabled
viewer_27 = ParamViewer(pt_9)  # disabled

# ---- group: Repeat pattern to match longest
repeat_2 = RepeatData(Data=num_20, Length=dedomain.End)  # disabled
repeat_3 = RepeatData(Data=num_21, Length=dedomain.End)  # disabled
repeat_4 = RepeatData(Data=num_22, Length=dedomain.End)  # disabled

# ----
pt_11 = ConstructPoint(XCoordinate=short_3.ListA, YCoordinate=short_3.ListB, ZCoordinate=short_3.ListC)  # disabled

# ---- group: Top points
panel_121 = Panel("""False
True""")  # disabled
Z = UnitZ(Factor=panel_103)  # disabled
cull_9 = CullPattern(List=divide_2.Points, CullPattern=panel_121)  # disabled
move = Move(Geometry=cull_9, Motion=Z)  # -> Geometry, Transform; disabled

# ---- group: Bottom points
panel_122 = Panel("""False
True""")  # disabled
cull_10 = CullPattern(List=divide_2.Points, CullPattern=invert(panel_122))  # disabled

# ---- group: Pipe curves
circle_4 = CircleCNR(Center=eval.Point, Normal=eval.Tangent, Radius=random_4)  # disabled

# ---- group: Distances
panel_123 = Panel(graph)  # disabled

# ----
panel_124 = Panel(pt_11)  # disabled
viewer_28 = ParamViewer(pt_11)  # disabled
panel_125 = Panel(repeat_3)  # disabled
panel_126 = Panel(repeat_4)  # disabled
panel_127 = Panel(repeat_2)  # disabled

# ---- group: Pipe surface
loft = Loft(Curves=circle_4, Options={Adjust=False, Closed=False, LoftEnds=0, LoftSimp=0, LoftType=0, Rebuild=10, Refit=0.01})  # disabled

# ---- group: Divide curve with variable distances
eval_2 = EvaluateLength(Curve=crv_10, Length=graph, Normalized=True)  # -> Point, Tangent, Parameter; disabled

# ---- group: Last element in short lists is repeated to match longest list
panel_128 = Panel("""1
2
2
2
2""")  # disabled
panel_129 = Panel("""10
20
30
30
30""")  # disabled
panel_130 = Panel("""0.2
0.4
0.6
0.8
1.0""")  # disabled

# ---- group: Create points
pt_12 = ConstructPoint(XCoordinate=repeat_2, YCoordinate=repeat_3, ZCoordinate=repeat_4)  # disabled

# ----
pt_13 = ConstructPoint(XCoordinate=panel_128, YCoordinate=panel_129, ZCoordinate=panel_130)  # disabled

# ---- group: Output
srf = Surface(loft)  # disabled

# ----
panel_131 = Panel("0")  # disabled
panel_132 = Panel("1")  # disabled
viewer_29 = ParamViewer(pt_12)  # disabled
panel_133 = Panel(pt_12)  # disabled

# ---- group: Extract segments as lines
pline = PolyLine(Vertices=eval_2.Point, Closed=False)  # disabled
explode = Explode(Curve=pline, Recursive=True)  # -> Segments, Vertices; disabled

# ---- group: Weave into one list
weave = Weave(Pattern=[0, 1], Stream0=move.Geometry, Stream1=cull_10, NullGaps=False)  # disabled

# ----
merge = Merge(Data1=panel_131, Data2=sort_2.Keys, Data3=panel_132)  # disabled
panel_134 = Panel(pt_13)  # disabled
viewer_30 = ParamViewer(pt_13)  # disabled

# ---- group: Top
pline_2 = PolyLine(Vertices=move.Geometry, Closed=False)  # disabled

# ---- group: Middle
pline_3 = PolyLine(Vertices=weave, Closed=False)  # disabled

# ---- group: Bottom
pline_4 = PolyLine(Vertices=cull_10, Closed=False)  # disabled

# ---- group: Join spheres
sph = Sphere(Base=weave, Radius=panel_104)  # disabled

# ----
panel_135 = Panel(merge)  # disabled

# ---- group: Find mid point of each line
panel_136 = Panel("0.5")  # disabled
eval_3 = EvaluateLength(Curve=reparameterize(explode.Segments), Length=panel_136, Normalized=True)  # -> Point, Tangent, Parameter; disabled

# ---- group: Find radius (len/2)
len = Length(Curve=explode.Segments)  # disabled
panel_137 = Panel("2")  # disabled
division = Division(A=len, B=panel_137)  # disabled

# ---- group: Beams
crv_11 = Curve([pline_2, pline_3, pline_4])  # disabled

# ---- group: Joints
srf_2 = Surface(sph)  # disabled

# ---- group: Generate pearls
sph_2 = Sphere(Base=eval_3.Point, Radius=division)  # disabled

# ---- group: Pearls
srf_3 = Surface(sph_2)  # disabled

# ---- group: OT: Use data tree structure to control matching
panel_138 = Panel("""1
2""")  # disabled
panel_139 = Panel("""1
2
3
4
5""")  # disabled

# ---- group: OT: Use data tree structure to control matching / Each item becomes a list
graft = GraftTree(Tree=panel_138, IncludeEmptyLists=True, IncludeNullItems=True)  # disabled

# ---- group: OT: Use data tree structure to control matching (continued)
panel_140 = Panel(graft)  # disabled
addition_11 = Addition(A=graft, B=panel_139)  # disabled
# Different!
panel_141 = Panel(addition_11)  # disabled
# Same!
flatten = FlattenTree(Tree=addition_11, Path="{0}")  # disabled
panel_142 = Panel(flatten)  # disabled
