# Grasshopper definition Chapter3_AdvancedDataStructures.gh (Grasshopper 1.0.7)

num = Number(Tree({0}: [35], {1}: [61.2], {2}: [21.3], {3}: [2], {4}: [67.3]))  # disabled

# ---- group: Single item
# Input
# Chapter Three: Advanced Data Structures
# The Grasshopper data strucutre
# Grasshopper data is stored in trees (including single items and lists)
panel = Panel("2.2")  # disabled

# ----
# Data tree Notation
image = ImageSampler(
    FilePath="C:\Users\Rajaa Issa\Desktop\EssentialAlgorithmsAndDataStructures\Images\03_01_notation.png",
    Filter="Colour",
    Interpolate=False,
    Umax=1,
    Umin=0,
    Vmax=1,
    Vmin=0,
    Wrap=1)  # disabled

# ---- group: Numbers in 3 branches
num_2 = Number(Tree({0}: [10], {1}: [20], {2}: [30]))  # disabled

# ---- group: Param Viewer to view structure
# Processes
# Intermediate
# Input and Processes
viewer = ParamViewer(panel)  # disabled
viewer_2 = ParamViewer(panel)  # disabled

# ---- group: Numbers in one branch
# Why care about data structure?
# GH components pay attention to the data structure, and give different results based on it (data matching).
panel_2 = Panel("""10
20
30""")  # disabled

# ---- group: Panel to view values
panel_3 = Panel(num)  # disabled

panel_4 = Panel(panel)  # disabled

# ---- group: Param Viewer to view structure
viewer_3 = ParamViewer(num)  # disabled
viewer_4 = ParamViewer(num)  # disabled

# ----
panel_5 = Panel(num_2)  # disabled

# ---- group: Solution
# Solution
num_3 = Number(Tree({0;1;0}: [5], {0;1;1}: [10], {0;1;2}: [11, 22], {0;2}: [100, 200], {0;3;0}: [1.1, 1.2, 1.3], {0;3;1}: [6, 7]))  # disabled

# ---- group: Use "Set Multiple Numbers" to construct the tree
# Data tree tutorial
# Construct a tree of numbers that look similar to the image when viewed in the Param Viewer and contains the items indicated. Then type in a panel the full address to the element "1.2"
# Note that order of branches and leaves is always from left to right going clockwise
num_4 = Number()  # disabled

# ----
addition = Addition(A=panel_2, B=panel_2)  # disabled
addition_2 = Addition(A=panel_2, B=num_2)  # disabled
addition_3 = Addition(A=num_2, B=num_2)  # disabled

# ---- group: List of items
panel_6 = Panel("""35
61.2
21.3""")  # disabled

# ----
image_2 = ImageSampler(
    FilePath="C:\Users\Rajaa Issa\Desktop\EssentialAlgorithmsAndDataStructures\Images\03_02_TreeImage.jpg",
    Filter="Colour",
    Interpolate=False,
    Umax=1,
    Umin=0,
    Vmax=1,
    Vmin=0,
    Wrap=1)  # disabled

# ---- group: Param Viewer to view structure
viewer_5 = ParamViewer(num_3)  # disabled
viewer_6 = ParamViewer(num_3)  # disabled

# ----
num_5 = Number(Tree({0;0}: [35], {0;1}: [61.2], {0;2}: [21.3], {0;3}: [2], {0;4}: [67.3]))  # disabled

panel_7 = Panel(addition)  # disabled
panel_8 = Panel(addition_2)  # disabled
# Different result
panel_9 = Panel(addition_3)  # disabled

# ---- group: Param Viewer to view structure
# Output
viewer_7 = ParamViewer(panel_6)  # disabled
viewer_8 = ParamViewer(panel_6)  # disabled

# ---- group: Panel to view values
panel_10 = Panel(panel_6)  # disabled

panel_11 = Panel(num_5)  # disabled

# ---- group: Param Viewer to view structure
viewer_9 = ParamViewer(num_5)  # disabled
viewer_10 = ParamViewer(num_5)  # disabled

# ---- group: Panel to view values
# {0;3;0}[1]
panel_12 = Panel(num_3)  # disabled

# ---- group: Tree of items
num_6 = Number(Tree({0}: [35], {1}: [61.2], {2}: [21.3]))  # disabled

# ----
num_7 = Number(Tree({0;0;0}: [35], {0;0;1}: [61.2], {0;0;2}: [21.3], {0;1}: [2], {1;0}: [67.3, 41]))  # disabled

# ---- group: Param Viewer to view structure
viewer_11 = ParamViewer(num_6)  # disabled
viewer_12 = ParamViewer(num_6)  # disabled

# ---- group: Panel to view values
panel_13 = Panel(num_6)  # disabled

panel_14 = Panel(num_7)  # disabled

# ---- group: Param Viewer to view structure
viewer_13 = ParamViewer(num_7)  # disabled
viewer_14 = ParamViewer(num_7)  # disabled

# ----
panel_15 = Panel("Generating trees")  # disabled

# ---- group: #steps
panel_16 = Panel("4")  # disabled

# ---- group: Input 1 surface
srf = Surface(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)  # disabled

# ----
sqgrid = Square(Plane=PlaneXY(0, 0, 0), Size=1, ExtentX=5, ExtentY=5)  # -> Cells, Points; disabled

# ---- group: Input list of points
# Tutorial
# Given the following list of points, construct a tree with 3 branches, one for each coordinate.
pt = Point([Point(5, 5, 0), Point(10, 10, 0), Point(10, 5, 0), Point(15, 10, 0), Point(15, 5, 0)])  # disabled

# Solution
pt_2 = Point([Point(5, 5, 0), Point(10, 10, 0), Point(10, 5, 0), Point(15, 10, 0), Point(15, 5, 0)])  # disabled

# ----
crv = Curve([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])  # disabled

# ---- group: #steps
panel_17 = Panel("4")  # disabled

# ---- group: List of domains
panel_18 = Panel("0 To 1")  # disabled
panel_19 = Panel("10 To 20")  # disabled
panel_20 = Panel("20 To 30")  # disabled

# ---- group: #steps
panel_21 = Panel("4")  # disabled

# ---- group: Use multiline Panel to input a list
panel_22 = Panel("""0 To 1
10 To 20
20 To 30""")  # disabled

# ---- group: #steps
panel_23 = Panel("4")  # disabled

# ---- group: Domain
panel_24 = Panel("0 To 1")  # disabled

# ---- group: List of #steps
panel_25 = Panel("""4
3
2""")  # disabled

# ----
# Direct input through parameters
bool = Boolean(Tree({0}: [True, True, True], {1}: [False, False, False, False, False]))  # disabled
# Components that combine lists into a tree
panel_26 = Panel("0 To 1")  # disabled
panel_27 = Panel("10 To 20")  # disabled
panel_28 = Panel("20 To 30")  # disabled
panel_29 = Panel(pt_2)  # disabled
viewer_15 = ParamViewer(pt_2)  # disabled
# Components that produce trees
sdivide = DivideSurface(Surface=srf, UCount=10, VCount=10)  # -> Points, Normals, Parameters; disabled
# Input list of data to components that generate lists of data
viewer_16 = ParamViewer(crv)  # disabled

# ---- group: 5 rectangles per branch
viewer_17 = ParamViewer(sqgrid.Cells)  # disabled
panel_30 = Panel(sqgrid.Cells)  # disabled

# ---- group: Data
panel_31 = Panel(pt)  # disabled
viewer_18 = ParamViewer(pt)  # disabled

# ---- group: 6 points per row
viewer_19 = ParamViewer(sqgrid.Points)  # disabled
panel_32 = Panel(sqgrid.Points)  # disabled

# ----
range = Range(Domain=panel_26, Steps=panel_16)  # disabled
range_2 = Range(Domain=panel_27, Steps=panel_16)  # disabled
range_3 = Range(Domain=panel_28, Steps=panel_16)  # disabled
divide = DivideCurve(Curve=crv, Count=panel_17, Kinks=False)  # -> Points, Tangents, Parameters; disabled
range_4 = Range(Domain=[panel_18, panel_19, panel_20], Steps=panel_21)  # disabled
range_5 = Range(Domain=panel_22, Steps=panel_23)  # disabled
range_6 = Range(Domain=panel_24, Steps=panel_25)  # disabled

panel_33 = Panel(bool)  # disabled
viewer_20 = ParamViewer(bool)  # disabled

# ---- group: Tree of points
pt_3 = Point(sdivide.Points)  # disabled

# ---- group: Decompose coordinates
pdecon = Deconstruct(Point=pt_2)  # -> XComponent, YComponent, ZComponent; disabled

# ----
panel_34 = Panel(range)  # disabled
panel_35 = Panel(range_2)  # disabled
panel_36 = Panel(range_3)  # disabled

viewer_21 = ParamViewer(pt_3)  # disabled
viewer_22 = ParamViewer(pt_3)  # disabled

# ---- group: X
panel_37 = Panel(pdecon.XComponent)  # disabled

# ----
viewer_23 = ParamViewer(divide.Points)  # disabled
viewer_24 = ParamViewer(divide.Points)  # disabled

viewer_25 = ParamViewer(range_4)  # disabled
panel_38 = Panel(range_4)  # disabled

viewer_26 = ParamViewer(range_5)  # disabled
panel_39 = Panel(range_5)  # disabled

viewer_27 = ParamViewer(range_6)  # disabled
panel_40 = Panel(range_6)  # disabled

# ---- group: Combine branches
entwine = Entwine(Branch00=range, Branch01=range_2, Branch02=range_3, FlattenInputs=True)  # disabled

# ---- group: Y
panel_41 = Panel(pdecon.YComponent)  # disabled

# ---- group: Output tree of combined branches
viewer_28 = ParamViewer(entwine)  # disabled
viewer_29 = ParamViewer(entwine)  # disabled
panel_42 = Panel(entwine)  # disabled

# ---- group: Combine lists into a tree
entwine_2 = Entwine(Branch00=pdecon.XComponent, Branch01=pdecon.YComponent, Branch02=pdecon.ZComponent, FlattenInputs=True)  # disabled

# ---- group: Z
panel_43 = Panel(pdecon.ZComponent)  # disabled

# ----
viewer_30 = ParamViewer(entwine_2)  # disabled
viewer_31 = ParamViewer(entwine_2)  # disabled

panel_44 = Panel("Tree matching")  # disabled
num_8 = Number([10, 20])  # disabled
num_9 = Number([50, 60, 70])  # disabled
num_10 = Number([10, 20])  # disabled
num_11 = Number([50, 60, 70])  # disabled
num_12 = Number([10, 20])  # disabled
num_13 = Number([50, 60, 70])  # disabled
num_14 = Number(1)  # disabled
num_15 = Number([5, 6, 7])  # disabled
num_16 = Number([10, 20])  # disabled
num_17 = Number([50, 60, 70])  # disabled
num_18 = Number([10, 20])  # disabled
num_19 = Number([5, 6])  # disabled
num_20 = Number([50, 60, 70])  # disabled
# Tutorial:
# Inspect the following 2 number structures, then manually predict the structure and result of adding them (with default Grasshopper matching).
# Verify your answer using Addition components
num_21 = Number(2.2)  # disabled
num_22 = Number(1)  # disabled

# ---- group: First tree
# Solution
num_23 = Number(Tree({0;0}: [22, 23, 24], {0;1}: [10, 11]))  # disabled

# ---- group: Second tree
# 10
# 11
# Repeat last branch
num_24 = Number(Tree({0;0}: [0.1, 0.2, 0.3, 0.4, 0.5], {0;1}: [10], {0;2}: [100]))  # disabled

# ---- group: First tree
num_25 = Number(Tree({0;0}: [22, 23, 24], {0;1}: [10, 11]))  # disabled

# ---- group: Second tree
num_26 = Number(Tree({0;0}: [0.1, 0.2, 0.3, 0.4, 0.5], {0;1}: [10], {0;2}: [100]))  # disabled

# ----
panel_45 = Panel(num_10)  # disabled
panel_46 = Panel(num_11)  # disabled
panel_47 = Panel(num_12)  # disabled
panel_48 = Panel(num_13)  # disabled
panel_49 = Panel(num_8)  # disabled
panel_50 = Panel(num_9)  # disabled
panel_51 = Panel(num_14)  # disabled
panel_52 = Panel(num_15)  # disabled
panel_53 = Panel(num_16)  # disabled
panel_54 = Panel(num_17)  # disabled
panel_55 = Panel(num_18)  # disabled
panel_56 = Panel(num_20)  # disabled
panel_57 = Panel(num_22)  # disabled
panel_58 = Panel(num_19)  # disabled
panel_59 = Panel(num_21)  # disabled
viewer_32 = ParamViewer(num_25)  # disabled
viewer_33 = ParamViewer(num_26)  # disabled
panel_60 = Panel(num_23)  # disabled

# ---- group: Tree of numbers
entwine_3 = Entwine(Branch00=num_8, Branch01=num_9, FlattenInputs=True)  # disabled

entwine_4 = Entwine(Branch00=num_10, Branch01=num_11, FlattenInputs=True)  # disabled

entwine_5 = Entwine(Branch00=num_12, Branch01=num_13, FlattenInputs=True)  # disabled

# ---- group: Tree input
entwine_6 = Entwine(Branch00=num_14, Branch01=num_15, FlattenInputs=True)  # disabled

# ---- group: Matching tree
entwine_7 = Entwine(Branch00=num_16, Branch01=num_17, FlattenInputs=True)  # disabled

# ---- group: Tree input
entwine_8 = Entwine(Branch00=num_22, Branch01=num_19, FlattenInputs=True)  # disabled

# ---- group: Non-matching tree
entwine_9 = Entwine(Branch00=num_18, Branch01=num_20, Branch02=num_21, FlattenInputs=True)  # disabled

# ----
panel_61 = Panel(num_24)  # disabled
panel_62 = Panel(entwine_6)  # disabled
panel_63 = Panel(entwine_7)  # disabled
# Corresponding branches matched like lists
# Last branch is repeated to match tree with more branches
panel_64 = Panel(entwine_8)  # disabled
panel_65 = Panel(entwine_9)  # disabled

# ---- group: Tree
num_27 = Number(entwine_5)  # disabled

# ---- group: Single item
panel_66 = Panel("1")  # disabled

# ---- group: Tree
num_28 = Number(entwine_3)  # disabled

# ---- group: Shorter list of numbers
panel_67 = Panel("""1
2""")  # disabled

# ---- group: Tree
num_29 = Number(entwine_4)  # disabled

# ---- group: Matched first tree
num_30 = Number(Tree({0;0}: [22, 23, 24, 24, 24], {0;1}: [10, 11], {0;2}: [10, 11]))  # disabled

# ---- group: Matched second tree
num_31 = Number(Tree({0;0}: [0.1, 0.2, 0.3, 0.4, 0.5], {0;1}: [10, 10], {0;2}: [100, 100]))  # disabled

# ---- group: Longer list of numbers
panel_68 = Panel("""1
2
3
4""")  # disabled

# ----
panel_69 = Panel(num_27)  # disabled
# Corresponding branches processed like lists
addition_4 = Addition(A=entwine_6, B=entwine_7)  # disabled

# ---- group: Long matching by default
addition_5 = Addition(A=entwine_8, B=entwine_9)  # disabled

# ----
panel_70 = Panel(num_28)  # disabled
panel_71 = Panel(num_29)  # disabled

# ---- group: Matched first tree
panel_72 = Panel(num_30)  # disabled

# ----
num_32 = Number(Tree({0;0}: [1, 1], {0;1}: [1, 1, 1]))  # disabled
# This is how it is matched inside
# Addition component
num_33 = Number(Tree({0;0}: [1, 2], {0;1}: [1, 2, 2]))  # disabled
num_34 = Number(Tree({0;0}: [1, 2, 3, 4], {0;1}: [1, 2, 3, 4]))  # disabled
num_35 = Number(Tree({0;0}: [10, 20, 20, 20], {0;1}: [50, 60, 70, 70]))  # disabled
panel_73 = Panel(addition_4)  # disabled
panel_74 = Panel(addition_5)  # disabled
addition_6 = Addition(A=panel_67, B=num_29)  # disabled
addition_7 = Addition(A=panel_66, B=num_28)  # disabled
# This is how it is matched inside
# Addition component
matched = Panel(num_32)  # disabled
matched_2 = Panel(num_33)  # disabled
# This is how it is matched inside
# Addition component
matched_3 = Panel(num_35)  # disabled

# ---- group: Matched second tree
# Addition result
panel_75 = Panel(num_31)  # disabled

# ----
addition_8 = Addition(A=panel_68, B=num_27)  # disabled
# This is how it is matched inside
# Addition component
matched_4 = Panel(num_34)  # disabled
panel_76 = Panel(addition_6)  # disabled
panel_77 = Panel(addition_7)  # disabled
panel_78 = Panel(addition_8)  # disabled

# ---- group: {0;0}
panel_79 = Panel("""22.1
23.2
24.3
24.4
24.5""")  # disabled

# ---- group: {0;2}
panel_80 = Panel("""110
111""")  # disabled

# ---- group: {0;1}
panel_81 = Panel("""20
21""")  # disabled

# ---- group: Tree
num_36 = Number(entwine_7)  # disabled

num_37 = Number(entwine_6)  # disabled

num_38 = Number(entwine_8)  # disabled

num_39 = Number(entwine_9)  # disabled

# ---- group: Verify answer / Add 2 lists (matched internally)
addition_9 = Addition(A=num_23, B=num_24)  # disabled

# ----
panel_82 = Panel(num_37)  # disabled
panel_83 = Panel(num_36)  # disabled
panel_84 = Panel(num_38)  # disabled
panel_85 = Panel(num_39)  # disabled
num_40 = Number(Tree({0;0}: [1, 1], {0;1}: [5, 6, 7]))  # disabled

# ---- group: Verify answer
panel_86 = Panel(addition_9)  # disabled

# ----
num_41 = Number(Tree({0;0}: [1, 1], {0;1}: [5, 6, 6], {0;2}: [5, 6]))  # disabled
num_42 = Number(Tree({0;0}: [10, 20], {0;1}: [50, 60, 70], {0;2}: [2.2, 2.2]))  # disabled
addition_10 = Addition(A=num_37, B=num_36)  # disabled
# This is how it is matched inside
# Addition component
matched_5 = Panel(num_40)  # disabled
addition_11 = Addition(A=num_38, B=num_39)  # disabled
# This is how it is matched inside
# Addition component
matched_6 = Panel(num_41)  # disabled
matched_7 = Panel(num_42)  # disabled
panel_87 = Panel(addition_10)  # disabled
panel_88 = Panel(addition_11)  # disabled
# Static extraction of branches and items through address in the tree using "Branch" and "Item" components
panel_89 = Panel("Traversing trees")  # disabled

# ---- group: Input numbers
num_43 = Number(Tree({0;0;0}: [35], {0;0;1}: [61.2], {0;0;2}: [21.3], {0;1}: [2], {1;0}: [67.3, 41]))  # disabled

num_44 = Number(Tree({0;0;0}: [35], {0;0;1}: [61.2], {0;0;2}: [21.3], {0;1}: [2], {1;0}: [67.3, 41]))  # disabled

num_45 = Number(Tree({0;0;0}: [35], {0;0;1}: [61.2], {0;0;2}: [21.3], {0;1}: [2], {1;0}: [67.3, 41]))  # disabled

# ---- group: Input tree
# Tutorial:
# The following tree has 3 branches for for each one of the coordinates (x, y, z) of some list of points. Use that tree to construct a list of these points.
num_46 = Number(Tree({0;0}: [-5.32390844, -10.75079954, -8.455529515, -6.325946907, -2.994928986, -4.891467804, -14.18455603, -12.46756895, -11.82605937, -10.05612447, -15.0933739, -10.6748903, -6.221999277, -2.503822441, -2.443999595, 6.448481725, 5.677602002, 1.185554705, -1.429141916], {0;1}: [11.83124217, 15.22122145, 21.18468636, 16.45649864, 18.85105555, 30.28950583, 29.44856982, 22.20912763, 26.38406183, 18.68533488, 18.60500469, 8.269491288, 6.870062392, 7.807177147, 13.83022831, 14.21465155, 23.54076227, 21.25347234, 27.62954192], {0;2}: [0, 0, 0, 0, 0, 0, 0, 0, 0, 0, 0, 0, 0, 0, 0, 0, 0, 0, 0]))  # disabled

# Solution
num_47 = Number(Tree({0;0}: [-5.32390844, -10.75079954, -8.455529515, -6.325946907, -2.994928986, -4.891467804, -14.18455603, -12.46756895, -11.82605937, -10.05612447, -15.0933739, -10.6748903, -6.221999277, -2.503822441, -2.443999595, 6.448481725, 5.677602002, 1.185554705, -1.429141916], {0;1}: [11.83124217, 15.22122145, 21.18468636, 16.45649864, 18.85105555, 30.28950583, 29.44856982, 22.20912763, 26.38406183, 18.68533488, 18.60500469, 8.269491288, 6.870062392, 7.807177147, 13.83022831, 14.21465155, 23.54076227, 21.25347234, 27.62954192], {0;2}: [0, 0, 0, 0, 0, 0, 0, 0, 0, 0, 0, 0, 0, 0, 0, 0, 0, 0, 0]))  # disabled

# ----
viewer_34 = ParamViewer(num_47)  # disabled

# ---- group: Panel to view values
panel_90 = Panel(num_43)  # disabled

panel_91 = Panel(num_44)  # disabled

# ---- group: Values
panel_92 = Panel(num_45)  # disabled

# ---- group: Extract list of branches
# Dynamic extraction of branches using "Param Viewer" and "List Item" components
viewer_35 = ParamViewer(num_45)  # disabled

# ----
viewer_36 = ParamViewer(num_46)  # disabled

# ---- group: Extract paths for branches
tstat = TreeStatistics(Tree=num_47)  # -> Paths, Length, Count; disabled

# ---- group: Branch path as text
panel_93 = Panel("{0;0;0}")  # disabled

panel_94 = Panel("{1;0}")  # disabled

# ---- group: Branch path
panel_95 = Panel("{0;0;0}")  # disabled

panel_96 = Panel("{1;0}")  # disabled

# ---- group: Path of first branch
panel_97 = Panel("0")  # disabled
item = ListItem(List=viewer_35, Index=panel_97, Wrap=True)  # disabled
panel_98 = Panel(item)  # disabled

# ---- group: Path of last branch
panel_99 = Panel("-1")  # disabled
item_2 = ListItem(List=viewer_35, Index=panel_99, Wrap=True)  # disabled
panel_100 = Panel(item_2)  # disabled

# ----
panel_101 = Panel(tstat.Paths)  # disabled

# ---- group: Item index
panel_102 = Panel("0")  # disabled

panel_103 = Panel("1")  # disabled

# ---- group: Extract branches
branch = TreeBranch(Tree=num_43, Path=panel_93, MaintainPaths=True)  # disabled
branch_2 = TreeBranch(Tree=num_43, Path=panel_94, MaintainPaths=True)  # disabled

# ---- group: Extract items
item_3 = TreeItem(Tree=num_44, Path=panel_95, Index=panel_102, Wrap=True)  # disabled
item_4 = TreeItem(Tree=num_44, Path=panel_96, Index=panel_103, Wrap=True)  # disabled

# ---- group: First branch (X)
panel_104 = Panel("0")  # disabled
item_5 = ListItem(List=tstat.Paths, Index=panel_104, Wrap=True)  # disabled
branch_3 = TreeBranch(Tree=num_47, Path=item_5, MaintainPaths=True)  # disabled

# ---- group: Second branch (Y)
panel_105 = Panel("1")  # disabled
item_6 = ListItem(List=tstat.Paths, Index=panel_105, Wrap=True)  # disabled
branch_4 = TreeBranch(Tree=num_47, Path=item_6, MaintainPaths=True)  # disabled

# ---- group: Third branch (Z)
panel_106 = Panel("2")  # disabled
item_7 = ListItem(List=tstat.Paths, Index=panel_106, Wrap=True)  # disabled
branch_5 = TreeBranch(Tree=num_47, Path=item_7, MaintainPaths=True)  # disabled

# ----
panel_107 = Panel(branch)  # disabled
panel_108 = Panel(branch_2)  # disabled
panel_109 = Panel(item_3)  # disabled
panel_110 = Panel(item_4)  # disabled

# ---- group: Add items
addition_12 = Addition(A=item_3, B=item_4)  # disabled

# ---- group: Add branches
addition_13 = Addition(A=branch, B=branch_2)  # disabled

# ---- group: Extract branches
branch_6 = TreeBranch(Tree=num_45, Path=item, MaintainPaths=True)  # disabled
branch_7 = TreeBranch(Tree=num_45, Path=item_2, MaintainPaths=True)  # disabled

# ----
panel_111 = Panel(addition_12)  # disabled
panel_112 = Panel(addition_13)  # disabled
panel_113 = Panel(branch_6)  # disabled
panel_114 = Panel(branch_7)  # disabled

# ---- group: Construct points
pt_4 = ConstructPoint(XCoordinate=branch_3, YCoordinate=branch_4, ZCoordinate=branch_5)  # disabled

# ---- group: Add branches
addition_14 = Addition(A=branch_6, B=branch_7)  # disabled

# ----
pt_5 = Point(pt_4)  # disabled
panel_115 = Panel(addition_14)  # disabled

# ---- group: Variable depth tree
num_48 = Number(Tree({0;0;0}: [1, 1.5], {0;0;1}: [2, 2.5], {1;0}: [3, 3.5], {1;1}: [4, 4.5]))  # disabled

# ---- group: Shutter rotation control
number_slider = Slider(0, range=0..90)  # disabled

# ----
# Tutorial 2
# Given four corner points on a plane and a radius for the hinge, create a shutter that can open and shut as in the image using a rotation parameter.
# BONUS:Make the shutters move at variable speed, but they fully closed at angle=0 and fully open at angle=90
image_3 = ImageSampler(
    FilePath="C:\Users\Rajaa Issa\Desktop\AdvancedParametricDesignClass_Issa2019\03_AdvancedDataStructuresWithSolutions\Shutters.png",
    Filter="Colour",
    Interpolate=False,
    Umax=1,
    Umin=0,
    Vmax=1,
    Vmin=0,
    Wrap=1)  # disabled

# ---- group: Hinge radius
number_slider_2 = Slider(1.665, range=0.5..2)  # disabled

# ----
viewer_37 = ParamViewer(num_48)  # disabled
viewer_38 = ParamViewer(num_48)  # disabled

# ---- group: Input tree of numbers
num_49 = Number(Tree({0;0}: [15, 25, 35], {0;1}: [11, 22, 33], {0;2}: [1, 2, 3]))  # disabled

# ----
panel_116 = Panel("""0
1""")  # disabled

# ---- group: Input tree of numbers
num_50 = Number(Tree({0;0}: [15, 25, 35], {0;1}: [11, 22, 33], {0;2}: [1, 2, 3]))  # disabled

num_51 = Number(Tree({0;0}: [15, 25, 35], {0;1}: [11, 22, 33], {0;2}: [1, 2, 3]))  # disabled

num_52 = Number(Tree({0;0}: [15, 25, 35], {0;1}: [11, 22, 33], {0;2}: [1, 2, 3]))  # disabled

# ---- group: Cull pattern
panel_117 = Panel("""False
True""")  # disabled

# ---- group: Input tree
# Basic data tree operations
# Viewing the tree structure
num_53 = Number(Tree({0;0}: [35], {0;1}: [61.2], {0;2}: [21.3], {0;3}: [2], {0;4}: [67.3]))  # disabled

num_54 = Number(Tree({0;0;0}: [1, 1.5], {0;0;1}: [2, 2.5], {1;0}: [3, 3.5], {1;1}: [4, 4.5]))  # disabled

# ---- group: Input tree of numbers
num_55 = Number(Tree({0;0}: [15, 25, 35], {0;1}: [11, 22, 33], {0;2}: [1, 2, 3]))  # disabled

# ---- group: Input list
# Grafting from lists to a trees
num_56 = Number([35, 61.2, 21.3, 2, 67.3])  # disabled

# ----
num_57 = Number(Tree({0;0}: [1, 2, 3, 4], {0;1}: [1.5, 2.5]))  # disabled
image_4 = ImageSampler(
    FilePath="C:\Users\Rajaa Issa\Desktop\AdvancedParametricDesignClass_Issa2019\03_AdvancedDataStructuresWithSolutions\Louvers.png",
    Filter="Colour",
    Interpolate=False,
    Umax=1,
    Umin=0,
    Vmax=1,
    Vmin=0,
    Wrap=1)  # disabled

# ---- group: Can't flip trees with branches located at variable depths
num_58 = Number(Tree({0;0;0}: [1, 1.5], {0;0;1}: [2, 2.5], {1;0}: [3, 3.5], {1;1}: [4, 4.5]))  # disabled

# ---- group: Variable depth tree
num_59 = Number(Tree({0;0;0}: [1, 1.5], {0;0;1}: [2, 2.5], {1;0}: [3, 3.5], {1;1}: [4, 4.5]))  # disabled

# ----
number_slider_3 = Slider(5, range=5..20)  # disabled
number_slider_4 = Slider(2, range=0..10)  # disabled
number_slider_5 = Slider(10, range=5..20)  # disabled
number_slider_6 = Slider(9, range=0..10)  # disabled
# Tutorial 1
# Given one curve on XY-Plane, create horizontal and vertical louvers as in the image
crv_2 = Curve(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)  # disabled

# ---- group: Split index
panel_118 = Panel("1")  # disabled

# ----
viewer_39 = ParamViewer(num_57)  # disabled

# ---- group: Second list
panel_119 = Panel("""1.5
2.5
3.5
4.5""")  # disabled

# ---- group: First list
# Combining data streams
panel_120 = Panel("""1
2
3
4""")  # disabled

# ----
panel_121 = Panel(num_48)  # disabled
viewer_40 = ParamViewer(num_56)  # disabled
panel_122 = Panel(num_56)  # disabled

# ---- group: View with Param Viewer (diagram)
viewer_41 = ParamViewer(num_53)  # disabled

# ----
viewer_42 = ParamViewer(num_58)  # disabled

# ---- group: View with Param Viewer (list view)
viewer_43 = ParamViewer(num_53)  # disabled

# ---- group: Tree strucutre and elements
# List operation on trees: process each branch separatly
viewer_44 = ParamViewer(num_55)  # disabled
panel_123 = Panel(num_55)  # disabled

# ----
viewer_45 = ParamViewer(num_50)  # disabled
shift = ShiftList(List=num_51, Shift=1, Wrap=True)  # disabled
cull = CullPattern(List=num_52, CullPattern=panel_117)  # disabled

# ---- group: Center
pt_6 = Point(Point(-17.5, 3.5, 0))  # disabled

# ---- group: A
pt_7 = Point(Point(-6, 14, 0))  # disabled

# ---- group: B
pt_8 = Point(Point(-29, 14, 0))  # disabled

# ---- group: C
pt_9 = Point(Point(-29, -9, 0))  # disabled

# ---- group: D
pt_10 = Point(Point(-6, -9, 0))  # disabled

# ---- group: Select multiple items
item_8 = ListItem(List=num_49, Index=panel_116, Wrap=True)  # disabled

# ---- group: Speed factor
panel_124 = Panel("1 to 2")  # disabled
panel_125 = Panel("3")  # disabled
# Bonus
range_7 = Range(Domain=panel_124, Steps=panel_125)  # disabled

# ---- group: Tree statistics
tstat_2 = TreeStatistics(Tree=num_54)  # -> Paths, Length, Count; disabled

# ----
split = SplitList(List=num_50, Index=panel_118)  # -> ListA, ListB; disabled
Z = UnitZ(Factor=1)  # disabled
X = UnitX(Factor=1)  # disabled
viewer_46 = ParamViewer(num_59)  # disabled
viewer_47 = ParamViewer(num_59)  # disabled
panel_126 = Panel(num_57)  # disabled

# ---- group: Entwine organize lists in brances
entwine_10 = Entwine(Branch00=panel_120, Branch01=panel_119, FlattenInputs=True)  # disabled

# ----
# Flipping the data structure
num_60 = Number(entwine_10)  # disabled
viewer_48 = ParamViewer(num_60)  # disabled
panel_127 = Panel(num_60)  # disabled
panel_128 = Panel(shift)  # disabled
panel_129 = Panel(cull)  # disabled

# ---- group: Merge concatinate the lists
merge = Merge(Data1=panel_120, Data2=panel_119)  # disabled

# ----
panel_130 = Panel(item_8)  # disabled

# ---- group: Graft adds one extra branch for each element
graft = GraftTree(Tree=num_48, IncludeEmptyLists=True, IncludeNullItems=True)  # disabled

# ----
viewer_49 = ParamViewer(num_58)  # disabled

# ---- group: list to tree
graft_2 = GraftTree(Tree=num_56, IncludeEmptyLists=True, IncludeNullItems=True)  # disabled

# ---- group: Input tree
# Flattening from trees to lists
num_61 = Number(graft_2)  # disabled

# Simplifying the data structure
num_62 = Number(graft_2)  # disabled

# ----
viewer_50 = ParamViewer(num_62)  # disabled
viewer_51 = ParamViewer(num_61)  # disabled
panel_131 = Panel(num_61)  # disabled

# ---- group: Paths (addresses of branches)
panel_132 = Panel(tstat_2.Paths)  # disabled

# ----
crv_3 = Curve(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)  # disabled
divide_2 = DivideCurve(Curve=crv_3, Count=number_slider_5, Kinks=False)  # -> Points, Tangents, Parameters; disabled
line = LineSDL(Start=divide_2.Points, Direction=Z, Length=number_slider_6)  # disabled
divide_3 = DivideCurve(Curve=line, Count=number_slider_3, Kinks=False)  # -> Points, Tangents, Parameters; disabled
line_2 = LineSDL(Start=divide_3.Points, Direction=X, Length=number_slider_4)  # disabled

# ---- group: Flip tree
flip = FlipMatrix(Data=line_2)  # disabled

# ---- group: Vertical louvers
loft = Loft(Curves=line_2, Options={Adjust=False, Closed=False, LoftEnds=0, LoftSimp=0, LoftType=0, Rebuild=10, Refit=0.01})  # disabled

# ---- group: Horizontal louvers
loft_2 = Loft(Curves=flip, Options={Adjust=False, Closed=False, LoftEnds=0, LoftSimp=0, LoftType=0, Rebuild=10, Refit=0.01})  # disabled

# ----
flatten = FlattenTree(Tree=loft_2, Path="{0}")  # disabled

# ---- group: Simplify the tree
simplify = SimplifyTree(Tree=num_62, Front=False)  # disabled

# ----
panel_133 = Panel(num_59)  # disabled
panel_134 = Panel(split.ListA)  # disabled

# ---- group: Select elements at each branch at index 0
panel_135 = Panel("0")  # disabled
item_9 = ListItem(List=num_55, Index=panel_135, Wrap=True)  # disabled

# ---- group: Select elements at each branch at index 1
panel_136 = Panel("1")  # disabled
item_10 = ListItem(List=num_55, Index=panel_136, Wrap=True)  # disabled

# ---- group: tree to list
flatten_2 = FlattenTree(Tree=num_61, Path="{0}")  # disabled

# ---- group: Input tree
num_63 = Number(Tree({0;0}: [35], {0;1}: [61.2], {0;2}: [21.3], {0;3}: [2], {0;4}: [67.3]))  # disabled

# ---- group: Angle scaled by factor
multiplication = Multiplication(A=number_slider, B=range_7)  # disabled

# ---- group: Create rectangles
rec_2pt = Rectangle2Pt(Plane=PlaneXY(0, 0, 0), PointA=pt_6, PointB=[pt_7, pt_8, pt_9, pt_10], Radius=0)  # -> Rectangle, Length; disabled

# ----
ma = MassAddition(Input=item_8)  # -> Result, PartialResults; disabled
srf_2 = Surface(flatten)  # disabled
pln = Plane([pt_7, pt_8, pt_9, pt_10])  # disabled

viewer_52 = ParamViewer(graft)  # disabled
viewer_53 = ParamViewer(graft)  # disabled
panel_137 = Panel(graft)  # disabled

# ---- group: Flip tree when all branches at the same depth
flip_2 = FlipMatrix(Data=num_60)  # disabled

flip_3 = FlipMatrix(Data=num_57)  # disabled

# ----
viewer_54 = ParamViewer(entwine_10)  # disabled
panel_138 = Panel(merge)  # disabled
flip_4 = FlipMatrix(Data=num_58)  # disabled

viewer_55 = ParamViewer(flip_2)  # disabled
panel_139 = Panel(flip_2)  # disabled

viewer_56 = ParamViewer(simplify)  # disabled
panel_140 = Panel(multiplication)  # disabled

viewer_57 = ParamViewer(flip_3)  # disabled
panel_141 = Panel(flip_3)  # disabled

viewer_58 = ParamViewer(divide_2.Points)  # disabled
viewer_59 = ParamViewer(line)  # disabled
viewer_60 = ParamViewer(crv_3)  # disabled
viewer_61 = ParamViewer(divide_3.Points)  # disabled
viewer_62 = ParamViewer(flip)  # disabled
panel_142 = Panel(split.ListB)  # disabled
viewer_63 = ParamViewer(loft)  # disabled
viewer_64 = ParamViewer(srf_2)  # disabled

viewer_65 = ParamViewer(graft_2)  # disabled
panel_143 = Panel(graft_2)  # disabled

viewer_66 = ParamViewer(line_2)  # disabled

# ---- group: Number of elements in each branch
panel_144 = Panel(tstat_2.Length)  # disabled

# ---- group: Flatten can handle variable depth trees
flatten_3 = FlattenTree(Tree=num_59, Path="{0}")  # disabled

# ---- group: View structure and data using a panel
panel_145 = Panel(num_63)  # disabled

# ----
panel_146 = Panel(ma.Result)  # disabled

panel_147 = Panel(flatten_2)  # disabled
viewer_67 = ParamViewer(flatten_2)  # disabled

# ---- group: Rotation of shutters
rotate = Rotate(Geometry=rec_2pt.Rectangle, Angle=degrees(number_slider), Plane=pln)  # -> Geometry, Transform; disabled

# ----
panel_148 = Panel(item_9)  # disabled
panel_149 = Panel(item_10)  # disabled

# ---- group: Max angle = 90
panel_150 = Panel("90")  # disabled
panel_151 = Panel("90")  # disabled
panel_152 = Panel("4")  # disabled
smaller = SmallerThan(FirstNumber=multiplication, SecondNumber=panel_150)  # -> SmallerThan, OrEqualTo; disabled
dup = DuplicateData(Data=panel_151, Number=panel_152, Order=True)  # disabled

# ---- group: Hinges
cir = Circle(Plane=[pt_7, pt_8, pt_9, pt_10], Radius=number_slider_2)  # disabled

# ----
panel_153 = Panel(flatten_3)  # disabled
viewer_68 = ParamViewer(flatten_3)  # disabled

# ---- group: Number of branches
panel_154 = Panel(tstat_2.Count)  # disabled

# ----
addition_15 = Addition(A=panel_148, B=panel_149)  # disabled

# ---- group: Change data strucuture
graft_3 = GraftTree(Tree=rotate.Geometry, IncludeEmptyLists=True, IncludeNullItems=True)  # disabled
graft_4 = GraftTree(Tree=cir, IncludeEmptyLists=True, IncludeNullItems=True)  # disabled

# ----
panel_155 = Panel(smaller.SmallerThan)  # disabled

# ---- group: Pick correct angle based on condition
p_n_c = PickNChoose(Pattern=smaller.SmallerThan, Stream0=dup, Stream1=multiplication)  # disabled

# ----
panel_156 = Panel(addition_15)  # disabled

# ---- group: Union shutter with henges
runion = RegionUnion(Curves=[graft_3, graft_4])  # disabled

# ----
panel_157 = Panel(p_n_c)  # disabled

# ---- group: Surface from boundary
boundary = BoundarySurfaces(Edges=runion)  # disabled

# ---- group: Shutters
srf_3 = Surface(boundary)  # disabled

# ---- group: Rectangles
crv_4 = Curve(rec_2pt.Rectangle)  # disabled

# ---- group: Branch spans
panel_158 = Panel("6")  # disabled

# ---- group: Element spans
panel_159 = Panel("10")  # disabled

# ----
# Tutorial 1:
# Create a square grid with 7 branches and 11 elements in each branch, then create the connections shown in the images.
# 
# BONUS: use "Relative Items" component to generate same connections between 2 input grids that are separatied by 1 unit in the z direction.
image_5 = ImageSampler(
    FilePath="C:\Users\Rajaa Issa\Desktop\EssentialAlgorithmsAndDataStructures\Images\03_06_RelativeTreeTutotrial.png",
    Filter="Colour",
    Interpolate=False,
    Umax=1,
    Umin=0,
    Vmax=1,
    Vmin=0,
    Wrap=1)  # disabled
# Tutorial 2:
# Use relative items between the 2 bounding grids provided to generate the connections shown in the image
image_6 = ImageSampler(
    FilePath="C:\Users\Rajaa Issa\Desktop\EssentialAlgorithmsAndDataStructures\Images\03_07_TrussBasic.jpg",
    Filter="Colour",
    Interpolate=False,
    Umax=1,
    Umin=0,
    Vmax=1,
    Vmin=0,
    Wrap=1)  # disabled

# ---- group: Bottom grid
pt_11 = Point(Tree({0}: [Point(0, 0, 0), Point(0, 1, 0), Point(0, 2, 0), Point(0, 3, 0), Point(0, 4, 0), Point(0, 5, 0), Point(0, 6, 0), Point(0, 7, 0), Point(0, 8, 0)], {1}: [Point(1, 0, 0), Point(1, 1, 0), Point(1, 2, 0), Point(1, 3, 0), Point(1, 4, 0), Point(1, 5, 0), Point(1, 6, 0), Point(1, 7, 0), Point(1, 8, 0)], {2}: [Point(2, 0, 0), Point(2, 1, 0), Point(2, 2, 0), Point(2, 3, 0), Point(2, 4, 0), Point(2, 5, 0), Point(2, 6, 0), Point(2, 7, 0), Point(2, 8, 0)], {3}: [Point(3, 0, 0), Point(3, 1, 0), Point(3, 2, 0), Point(3, 3, 0), Point(3, 4, 0), Point(3, 5, 0), Point(3, 6, 0), Point(3, 7, 0), Point(3, 8, 0)], {4}: [Point(4, 0, 0), Point(4, 1, 0), Point(4, 2, 0), Point(4, 3, 0), Point(4, 4, 0), Point(4, 5, 0), Point(4, 6, 0), Point(4, 7, 0), Point(4, 8, 0)], {5}: [Point(5, 0, 0), Point(5, 1, 0), Point(5, 2, 0), Point(5, 3, 0), Point(5, 4, 0), Point(5, 5, 0), Point(5, 6, 0), Point(5, 7, 0), Point(5, 8, 0)], {6}: [Point(6, 0, 0), Point(6, 1, 0), Point(6, 2, 0), Point(6, 3, 0), Point(6, 4, 0), Point(6, 5, 0), Point(6, 6, 0), Point(6, 7, 0), Point(6, 8, 0)]))  # disabled

# ---- group: Top grid
pt_12 = Point(Tree({0}: [Point(0, 0, 1), Point(0, 1, 1), Point(0, 2, 1), Point(0, 3, 1), Point(0, 4, 1), Point(0, 5, 1), Point(0, 6, 1), Point(0, 7, 1), Point(0, 8, 1)], {1}: [Point(1, 0, 1), Point(1, 1, 1), Point(1, 2, 1), Point(1, 3, 1), Point(1, 4, 1), Point(1, 5, 1), Point(1, 6, 1), Point(1, 7, 1), Point(1, 8, 1)], {2}: [Point(2, 0, 1), Point(2, 1, 1), Point(2, 2, 1), Point(2, 3, 1), Point(2, 4, 1), Point(2, 5, 1), Point(2, 6, 1), Point(2, 7, 1), Point(2, 8, 1)], {3}: [Point(3, 0, 1), Point(3, 1, 1), Point(3, 2, 1), Point(3, 3, 1), Point(3, 4, 1), Point(3, 5, 1), Point(3, 6, 1), Point(3, 7, 1), Point(3, 8, 1)], {4}: [Point(4, 0, 1), Point(4, 1, 1), Point(4, 2, 1), Point(4, 3, 1), Point(4, 4, 1), Point(4, 5, 1), Point(4, 6, 1), Point(4, 7, 1), Point(4, 8, 1)], {5}: [Point(5, 0, 1), Point(5, 1, 1), Point(5, 2, 1), Point(5, 3, 1), Point(5, 4, 1), Point(5, 5, 1), Point(5, 6, 1), Point(5, 7, 1), Point(5, 8, 1)], {6}: [Point(6, 0, 1), Point(6, 1, 1), Point(6, 2, 1), Point(6, 3, 1), Point(6, 4, 1), Point(6, 5, 1), Point(6, 6, 1), Point(6, 7, 1), Point(6, 8, 1)]))  # disabled

# ----
# Relative item
# Use Relative-Item to reorganize the tree to achieve following correspondence between elements
image_7 = ImageSampler(
    FilePath="C:\Users\Rajaa Issa\Desktop\EssentialAlgorithmsAndDataStructures\Images\03_05_RelativeItem.png",
    Filter="Colour",
    Interpolate=False,
    Umax=1,
    Umin=0,
    Vmax=1,
    Vmin=0,
    Wrap=1)  # disabled

# ---- group: Branch spans
panel_160 = Panel("3")  # disabled

# ---- group: Element spans
panel_161 = Panel("2")  # disabled

# ---- group: Create the grid
sqgrid_2 = Square(Plane=PlaneXY(0, 0, 0), Size=1, ExtentX=panel_158, ExtentY=panel_159)  # -> Cells, simplify(Points); disabled

# ----
points = PointList(Points=pt_11, Size=0.2)  # disabled
points_2 = PointList(Points=pt_12, Size=0.2)  # disabled

# ---- group: Branch spans
# Use Relative-Items: define connections between 2 trees
panel_162 = Panel("3")  # disabled

# ---- group: Element spans
panel_163 = Panel("2")  # disabled

# ---- group: Create the grid
sqgrid_3 = Square(Plane=PlaneXY(0, 0, 0), Size=1, ExtentX=panel_160, ExtentY=panel_161)  # -> Cells, simplify(Points); disabled

# ----
panel_164 = Panel("""False
True""")  # disabled
panel_165 = Panel("""True
False""")  # disabled
# Bonus
Z_2 = UnitZ(Factor=1)  # disabled

# ---- group: First grid
sqgrid_4 = Square(Plane=PlaneXY(0, 0, 0), Size=1, ExtentX=panel_162, ExtentY=panel_163)  # -> Cells, simplify(Points); disabled

# ----
cull_2 = CullPattern(List=pt_12, CullPattern=panel_164)  # disabled

# ---- group: Culled top grid
pt_13 = Point(cull_2)  # disabled

pt_14 = Point(cull_2)  # disabled

# ----
cull_3 = CullPattern(List=pt_11, CullPattern=panel_165)  # disabled

# ---- group: Culled bottom grid
pt_15 = Point(cull_3)  # disabled

pt_16 = Point(cull_3)  # disabled

# ---- group: Offset mask that align with the next index in the next branch
panel_166 = Panel("{+1}[+1]")  # disabled

# ---- group: Original tree
viewer_69 = ParamViewer(sqgrid_2.Points)  # disabled
points_3 = PointList(Points=sqgrid_2.Points, Size=0.3)  # disabled

# ----
Z_3 = UnitZ(Factor=1)  # disabled
pt_17 = Point(sqgrid_3.Points)  # disabled
# Advanced data tree operations: Relative Item(s)
# { branch offset} [ index offset ]
relitem = RelativeItem(WrapPaths=False, WrapItems=False)  # -> ItemA, ItemB; disabled
points_4 = PointList(Points=pt_15, Size=0.2)  # disabled
points_5 = PointList(Points=pt_13, Size=0.2)  # disabled
points_6 = PointList(Points=pt_16, Size=0.2)  # disabled
points_7 = PointList(Points=pt_14, Size=0.2)  # disabled

# ---- group: New tree
move = Move(Geometry=sqgrid_2.Points, Motion=Z_2)  # -> Geometry, Transform; disabled

# ----
points_8 = PointList(Points=cull_3, Size=0.2)  # disabled
points_9 = PointList(Points=cull_2, Size=0.2)  # disabled

# ---- group: Original tree
viewer_70 = ParamViewer(pt_17)  # disabled

# ----
pt_18 = Point(sqgrid_4.Points)  # disabled

# ---- group: second grid
move_2 = Move(Geometry=pt_18, Motion=Z_3)  # -> Geometry, Transform; disabled

# ---- group: Offset mask for the base
panel_167 = Panel("{+1}[0]")  # disabled

panel_168 = Panel("{0}[+1]")  # disabled

panel_169 = Panel("{+1}[0]")  # disabled

panel_170 = Panel("{0}[+1]")  # disabled

# ---- group: Offset mask diagonal
panel_171 = Panel("{0}[0]")  # disabled

panel_172 = Panel("{0}[-1]")  # disabled

# ---- group: Move does not change data strucuture
viewer_71 = ParamViewer(move.Geometry)  # disabled

# ---- group: Original tree
viewer_72 = ParamViewer(pt_18)  # disabled
points_10 = PointList(Points=pt_18, Size=0.2)  # disabled

# ---- group: Offset mask that align with the next index in the next branch
panel_173 = Panel("{-1}[+1]")  # disabled

# ----
relitem_2 = RelativeItem(Tree=cull_3, Offset=panel_168, WrapPaths=False, WrapItems=False)  # -> ItemA, ItemB; disabled
relitem_3 = RelativeItem(Tree=cull_3, Offset=panel_169, WrapPaths=False, WrapItems=False)  # -> ItemA, ItemB; disabled
relitem_4 = RelativeItem(Tree=cull_2, Offset=panel_170, WrapPaths=False, WrapItems=False)  # -> ItemA, ItemB; disabled
relitem_5 = RelativeItem(Tree=cull_2, Offset=panel_167, WrapPaths=False, WrapItems=False)  # -> ItemA, ItemB; disabled
relitem2 = RelativeItems(TreeA=pt_15, TreeB=pt_13, Offset=panel_171, WrapPaths=False, WrapItems=False)  # -> ItemA, ItemB; disabled
relitem2_2 = RelativeItems(TreeA=pt_16, TreeB=pt_14, Offset=panel_172, WrapPaths=False, WrapItems=False)  # -> ItemA, ItemB; disabled

# ---- group: Split in 2 trees using offset mask
relitem_6 = RelativeItem(Tree=sqgrid_3.Points, Offset=panel_166, WrapPaths=False, WrapItems=False)  # -> ItemA, ItemB; disabled

# ----
# { branch offset} [ index offset ]
relitem2_3 = RelativeItems(TreeA=pt_18, TreeB=move_2.Geometry, WrapPaths=False, WrapItems=False)  # -> ItemA, ItemB; disabled
ln = Line(StartPoint=relitem_2.ItemA, EndPoint=relitem_2.ItemB)  # disabled
ln_2 = Line(StartPoint=relitem_3.ItemA, EndPoint=relitem_3.ItemB)  # disabled
ln_3 = Line(StartPoint=relitem_4.ItemA, EndPoint=relitem_4.ItemB)  # disabled
ln_4 = Line(StartPoint=relitem_5.ItemA, EndPoint=relitem_5.ItemB)  # disabled
ln_5 = Line(StartPoint=relitem2.ItemA, EndPoint=relitem2.ItemB)  # disabled
ln_6 = Line(StartPoint=relitem2_2.ItemA, EndPoint=relitem2_2.ItemB)  # disabled

# ---- group: Connect parallel trees
relitem2_4 = RelativeItems(TreeA=sqgrid_2.Points, TreeB=move.Geometry, Offset=panel_173, WrapPaths=False, WrapItems=False)  # -> ItemA, ItemB; disabled

# ---- group: Original tree (smaller)
viewer_73 = ParamViewer(relitem_6.ItemA)  # disabled
points_11 = PointList(Points=relitem_6.ItemA, Size=0.2)  # disabled

# ---- group: Line connecting the 2 trees
ln_7 = Line(StartPoint=relitem_6.ItemA, EndPoint=relitem_6.ItemB)  # disabled

# ---- group: Split in 2 trees using offset mask
relitem_7 = RelativeItem(Tree=sqgrid_2.Points, Offset=panel_173, WrapPaths=False, WrapItems=False)  # -> ItemA, ItemB; disabled

# ---- group: Offset mask
panel_174 = Panel("{-1}[0]")  # disabled

# ---- group: Line connecting the 2 trees
ln_8 = Line(StartPoint=relitem2_4.ItemA, EndPoint=relitem2_4.ItemB)  # disabled

# ---- group: Output
crv_5 = Curve(ln_7)  # disabled

# ---- group: Offset tree
viewer_74 = ParamViewer(relitem_6.ItemB)  # disabled
points_12 = PointList(Points=relitem_6.ItemB, Size=0.2)  # disabled

viewer_75 = ParamViewer(relitem_7.ItemB)  # disabled
points_13 = PointList(Points=relitem_7.ItemB, Size=0.2)  # disabled

# ---- group: Original tree (smaller)
viewer_76 = ParamViewer(relitem_7.ItemA)  # disabled
points_14 = PointList(Points=relitem_7.ItemA, Size=0.2)  # disabled

# ---- group: Output
crv_6 = Curve(ln_8)  # disabled

# ----
relitem2_5 = RelativeItems(TreeA=pt_18, TreeB=move_2.Geometry, Offset=panel_174, WrapPaths=False, WrapItems=False)  # -> ItemA, ItemB; disabled

# ---- group: Line connecting the 2 trees
ln_9 = Line(StartPoint=relitem_7.ItemA, EndPoint=relitem_7.ItemB)  # disabled

# ---- group: Output
crv_7 = Curve(ln_9)  # disabled

# ---- group: Offset tree
viewer_77 = ParamViewer(relitem2_5.ItemB)  # disabled
points_15 = PointList(Points=relitem2_5.ItemB, Size=0.2)  # disabled

# ---- group: Original tree (smaller)
viewer_78 = ParamViewer(relitem2_5.ItemA)  # disabled
points_16 = PointList(Points=relitem2_5.ItemA, Size=0.2)  # disabled

# ---- group: Offset mask that align with the next index in the next branch
panel_175 = Panel("{+2}[+3]")  # disabled

# ---- group: Line connecting the 2 trees
ln_10 = Line(StartPoint=relitem2_5.ItemA, EndPoint=relitem2_5.ItemB)  # disabled

# ---- group: Split in 2 trees using offset mask
relitem_8 = RelativeItem(Tree=sqgrid_2.Points, Offset=panel_175, WrapPaths=False, WrapItems=False)  # -> ItemA, ItemB; disabled

# ---- group: Output
crv_8 = Curve(ln_10)  # disabled

# ---- group: Offset tree
viewer_79 = ParamViewer(relitem_8.ItemB)  # disabled
points_17 = PointList(Points=relitem_8.ItemB, Size=0.2)  # disabled

# ---- group: Original tree (smaller)
viewer_80 = ParamViewer(relitem_8.ItemA)  # disabled
points_18 = PointList(Points=relitem_8.ItemA, Size=0.2)  # disabled

# ---- group: Line connecting the 2 trees
ln_11 = Line(StartPoint=relitem_8.ItemA, EndPoint=relitem_8.ItemB)  # disabled

# ---- group: Output
crv_9 = Curve(ln_11)  # disabled

# ----
# Tutorial 1:
# Given a 6x9 grid, use the split tree to generate the following form
image_8 = ImageSampler(
    FilePath="C:\Users\Rajaa Issa\Desktop\EssentialAlgorithmsAndDataStructures\Images\03_09_SplitTreeTutorial.png",
    Filter="Colour",
    Interpolate=False,
    Umax=1,
    Umin=0,
    Vmax=1,
    Vmin=0,
    Wrap=1)  # disabled
# Tutorial 2:
# Given a grid, create the following truss system using split tree functionality.
image_9 = ImageSampler(
    FilePath="C:\Users\Rajaa Issa\Desktop\EssentialAlgorithmsAndDataStructures\Images\03_07_TrussBasic.jpg",
    Filter="Colour",
    Interpolate=False,
    Umax=1,
    Umin=0,
    Vmax=1,
    Vmin=0,
    Wrap=1)  # disabled

# ---- group: Branch spans
panel_176 = Panel("5")  # disabled

# ---- group: Element spans
panel_177 = Panel("8")  # disabled

# ----
# Advanced data tree operations: Split
# Split tree using mask
# { branch path} [ index ]
# Use SplitTree to select a subset of the data and transform to create the following image
image_10 = ImageSampler(
    FilePath="C:\Users\Rajaa Issa\Desktop\EssentialAlgorithmsAndDataStructures\Images\03_08_SplitTree.png",
    Filter="Colour",
    Interpolate=False,
    Umax=1,
    Umin=0,
    Vmax=1,
    Vmin=0,
    Wrap=1)  # disabled

# ---- group: Branch spans
panel_178 = Panel("6")  # disabled

# ---- group: Elements spans
# {*;0}[1,3,...] : Select and split every other element in the first branch
# 
# {*;0,2,...}[1,3,...] : Select and split every other branch and every other element in these branches
# 
# {*;2}[*] : Select and split the third branch
# 
# Full split mask rules are found here:
# https://www.grasshopper3d.com/forum/topics/datatree-selection-rules?page=6&commentId=2985220%3AComment%3A1888369&x=1#2985220Comment1888369
panel_179 = Panel("10")  # disabled

# ---- group: Branch spans
panel_180 = Panel("5")  # disabled

# ---- group: Elements spans
panel_181 = Panel("8")  # disabled

# ---- group: Create the grid
sqgrid_5 = Square(Plane=PlaneXY(0, 0, 0), Size=1, ExtentX=panel_176, ExtentY=panel_177)  # -> Cells, Points; disabled

# ----
sqgrid_6 = Square(Plane=PlaneXY(0, 0, 0), Size=1, ExtentX=panel_178, ExtentY=panel_179)  # -> Cells, Points; disabled

# ---- group: Generate the grid
sqgrid_7 = Square(Plane=PlaneXY(0, 0, 0), Size=1, ExtentX=panel_180, ExtentY=panel_181)  # -> Cells, Points; disabled

# ----
pt_19 = Point(sqgrid_6.Points)  # disabled

# ---- group: Split mask
panel_182 = Panel("{*}[(2 to 6)]")  # disabled

# ----
panel_183 = Panel("{*}[1,3,...]")  # disabled

# ---- group: Split mask
panel_184 = Panel("{*}[(1,2,3)or(7,8,9)]")  # disabled

# ----
viewer_81 = ParamViewer(sqgrid_5.Points)  # disabled
pt_20 = Point(simplify(sqgrid_5.Points))  # disabled
split_2 = SplitTree()  # -> Positive, Negative; disabled

# ---- group: Split at every other element
split_3 = SplitTree(Data=pt_20, Masks=flatten(panel_183))  # -> Positive, Negative; disabled

# ---- group: Original tree
viewer_82 = ParamViewer(sqgrid_6.Points)  # disabled
points_19 = PointList(Points=sqgrid_6.Points, Size=0.3)  # disabled

# ---- group: Split original tree
split_4 = SplitTree(Data=sqgrid_7.Points, Masks=flatten(panel_182))  # -> Positive, Negative; disabled

# ----
split_5 = SplitTree(Data=sqgrid_6.Points, Masks=flatten(panel_184))  # -> Positive, Negative; disabled
Z_4 = UnitZ(Factor=1)  # disabled

# ---- group: Split mask
panel_185 = Panel("{*;(0,1,2)}[*]")  # disabled

# ---- group: Positive tree
viewer_83 = ParamViewer(sqgrid_6.Points)  # disabled
points_20 = PointList(Points=split_5.Positive, Size=0.3)  # disabled

# ---- group: Move top grid
move_3 = Move(Geometry=split_3.Positive, Motion=Z_4)  # -> Geometry, Transform; disabled

# ---- group: Split middle tree
split_6 = SplitTree(Data=split_4.Positive, Masks=flatten(panel_185))  # -> Positive, Negative; disabled

# ---- group: Negative tree
# Strucuture preserved
# Split elements replaced with NULL
viewer_84 = ParamViewer(sqgrid_6.Points)  # disabled
points_21 = PointList(Points=split_5.Negative, Size=0.3)  # disabled

# ---- group: Shift
X_2 = UnitX(Factor=1)  # disabled

# ---- group: Change direction
flip_5 = FlipMatrix(Data=split_3.Negative)  # disabled

flip_6 = FlipMatrix(Data=move_3.Geometry)  # disabled

# ---- group: New tree
move_4 = Move(Geometry=split_6.Positive, Motion=expr("-x", X_2))  # -> Geometry, Transform; disabled

move_5 = Move(Geometry=split_6.Negative, Motion=X_2)  # -> Geometry, Transform; disabled

# ----
X_3 = UnitX(Factor=1)  # disabled
Z_5 = UnitZ(Factor=1)  # disabled

# ---- group: Remove nulls
clean = CleanTree(RemoveNulls=True, RemoveInvalid=True, RemoveEmpty=True, Tree=flip_5)  # disabled

clean_2 = CleanTree(RemoveNulls=True, RemoveInvalid=True, RemoveEmpty=True, Tree=flip_6)  # disabled

# ---- group: Combine after transform
combine = CombineData(Input0=move_3.Geometry, Input1=split_3.Negative)  # -> Result, Index; disabled

# ---- group: New tree
move_6 = Move(Geometry=split_5.Positive, Motion=X_3)  # -> Geometry, Transform; disabled

# ----
pline = PolyLine(Vertices=combine.Result, Closed=False)  # disabled
pline_2 = PolyLine(Vertices=split_3.Negative, Closed=False)  # disabled
pline_3 = PolyLine(Vertices=clean, Closed=False)  # disabled
pline_4 = PolyLine(Vertices=move_3.Geometry, Closed=False)  # disabled
pline_5 = PolyLine(Vertices=clean_2, Closed=False)  # disabled

# ---- group: Combine middle part
combine_2 = CombineData(Input0=move_4.Geometry, Input1=move_5.Geometry)  # -> Result, Index; disabled

# ---- group: Negative tree
viewer_85 = ParamViewer(sqgrid_6.Points)  # disabled
points_22 = PointList(Points=move_6.Geometry, Size=0.3)  # disabled

# ----
viewer_86 = ParamViewer(move_6.Geometry)  # disabled

# ---- group: Output
crv_10 = Curve([pline, pline_2, pline_3, pline_4, pline_5])  # disabled

# ---- group: Combine trees
combine_3 = CombineData(Input0=combine_2.Result, Input1=split_4.Negative)  # -> Result, Index; disabled

# ----
combine_4 = CombineData(Input0=move_6.Geometry, Input1=split_5.Negative)  # -> Result, Index; disabled
viewer_87 = ParamViewer(combine_4.Result)  # disabled
pline_6 = PolyLine(Vertices=combine_3.Result, Closed=False)  # disabled
pline_7 = PolyLine(Vertices=combine_4.Result, Closed=False)  # disabled

# ---- group: Output
crv_11 = Curve(pline_6)  # disabled

# ----
panel_186 = Panel(combine_4.Result)  # disabled

# ---- group: Output
crv_12 = Curve(pline_7)  # disabled

# ---- group: Branch spans
# Advanced data tree operations: Path Mapper
# Use the Path mapper to reorganize data within a tree
panel_187 = Panel("6")  # disabled

# ---- group: Elements spans
# Source
# { branch path} [ index ]
# Built-in mapping
panel_188 = Panel("10")  # disabled

# ----
# Tutorial:
# Given input points, create the connecting lines as in the image using "Polyline" and "Path Mappers" components only.
image_11 = ImageSampler(
    FilePath="C:\Users\Rajaa Issa\Desktop\EssentialAlgorithmsAndDataStructures\Images\03_13_PathMapping.png",
    Filter="Colour",
    Interpolate=False,
    Umax=1,
    Umin=0,
    Vmax=1,
    Vmin=0,
    Wrap=1)  # disabled

# ---- group: Input points
pt_21 = Point(Tree({0;0;0}: [Point(2.059310464, 1.751219295, 0), Point(1.618582738, 3.702054775, 0), Point(1.177855012, 5.652890256, 0), Point(0.737127286, 7.603725736, 0), Point(0.2963995599, 9.554561217, 0), Point(-0.1443281663, 11.5053967, 0), Point(-0.5850558924, 13.45623218, 0), Point(-1.025783619, 15.40706766, 0), Point(-1.466511345, 17.35790314, 0), Point(-1.907239071, 19.30873862, 0), Point(-2.347966797, 21.2595741, 0)], {0;0;1}: [Point(4.010145945, 2.191947021, 0), Point(3.569418219, 4.142782502, 0), Point(3.128690493, 6.093617982, 0), Point(2.687962766, 8.044453462, 0), Point(2.24723504, 9.995288943, 0), Point(1.806507314, 11.94612442, 0), Point(1.365779588, 13.8969599, 0), Point(0.9250518618, 15.84779538, 0), Point(0.4843241356, 17.79863086, 0), Point(0.04359640949, 19.74946634, 0), Point(-0.3971313167, 21.70030182, 0)], {0;0;2}: [Point(5.960981425, 2.632674747, 0), Point(5.520253699, 4.583510228, 0), Point(5.079525973, 6.534345708, 0), Point(4.638798247, 8.485181188, 0), Point(4.198070521, 10.43601667, 0), Point(3.757342794, 12.38685215, 0), Point(3.316615068, 14.33768763, 0), Point(2.875887342, 16.28852311, 0), Point(2.435159616, 18.23935859, 0), Point(1.99443189, 20.19019407, 0), Point(1.553704164, 22.14102955, 0)], {0;0;3}: [Point(7.911816906, 3.073402474, 0), Point(7.471089179, 5.024237954, 0), Point(7.030361453, 6.975073434, 0), Point(6.589633727, 8.925908915, 0), Point(6.148906001, 10.87674439, 0), Point(5.708178275, 12.82757988, 0), Point(5.267450549, 14.77841536, 0), Point(4.826722822, 16.72925084, 0), Point(4.385995096, 18.68008632, 0), Point(3.94526737, 20.6309218, 0), Point(3.504539644, 22.58175728, 0)], {0;0;4}: [Point(9.862652386, 3.5141302, 0), Point(9.42192466, 5.46496568, 0), Point(8.981196934, 7.41580116, 0), Point(8.540469207, 9.366636641, 0), Point(8.099741481, 11.31747212, 0), Point(7.659013755, 13.2683076, 0), Point(7.218286029, 15.21914308, 0), Point(6.777558303, 17.16997856, 0), Point(6.336830577, 19.12081404, 0), Point(5.896102851, 21.07164952, 0), Point(5.455375124, 23.022485, 0)], {0;1;0}: [Point(0.1582148939, 0, 4.469570754), Point(0.1608220639, 1.999864028, 4.44639591), Point(0.1634292338, 3.999728055, 4.423221066), Point(0.1660364038, 5.999592083, 4.400046222), Point(0.1686435737, 7.999456111, 4.376871378), Point(0.1712507437, 9.999320138, 4.353696534), Point(0.1738579136, 11.99918417, 4.33052169), Point(0.1764650835, 13.99904819, 4.307346846), Point(0.1790722535, 15.99891222, 4.284172002), Point(0.1816794234, 17.99877625, 4.260997158), Point(0.1842865934, 19.99864028, 4.237822314)], {0;1;1}: [Point(2.145677526, 0, 4.6931603), Point(2.148284696, 1.999864028, 4.669985456), Point(2.150891866, 3.999728055, 4.646810612), Point(2.153499036, 5.999592083, 4.623635768), Point(2.156106206, 7.999456111, 4.600460924), Point(2.158713376, 9.999320138, 4.57728608), Point(2.161320546, 11.99918417, 4.554111236), Point(2.163927716, 13.99904819, 4.530936392), Point(2.166534886, 15.99891222, 4.507761548), Point(2.169142056, 17.99877625, 4.484586704), Point(2.171749226, 19.99864028, 4.46141186)], {0;1;2}: [Point(4.133140159, 0, 4.916749846), Point(4.135747329, 1.999864028, 4.893575002), Point(4.138354498, 3.999728055, 4.870400158), Point(4.140961668, 5.999592083, 4.847225314), Point(4.143568838, 7.999456111, 4.82405047), Point(4.146176008, 9.999320138, 4.800875626), Point(4.148783178, 11.99918417, 4.777700782), Point(4.151390348, 13.99904819, 4.754525938), Point(4.153997518, 15.99891222, 4.731351094), Point(4.156604688, 17.99877625, 4.70817625), Point(4.159211858, 19.99864028, 4.685001407)], {0;1;3}: [Point(6.120602791, 0, 5.140339392), Point(6.123209961, 1.999864028, 5.117164548), Point(6.125817131, 3.999728055, 5.093989704), Point(6.128424301, 5.999592083, 5.07081486), Point(6.131031471, 7.999456111, 5.047640016), Point(6.133638641, 9.999320138, 5.024465172), Point(6.136245811, 11.99918417, 5.001290328), Point(6.13885298, 13.99904819, 4.978115484), Point(6.14146015, 15.99891222, 4.954940641), Point(6.14406732, 17.99877625, 4.931765797), Point(6.14667449, 19.99864028, 4.908590953)], {0;1;4}: [Point(8.108065423, 0, 5.363928938), Point(8.110672593, 1.999864028, 5.340754094), Point(8.113279763, 3.999728055, 5.31757925), Point(8.115886933, 5.999592083, 5.294404406), Point(8.118494103, 7.999456111, 5.271229562), Point(8.121101273, 9.999320138, 5.248054718), Point(8.123708443, 11.99918417, 5.224879875), Point(8.126315613, 13.99904819, 5.201705031), Point(8.128922783, 15.99891222, 5.178530187), Point(8.131529953, 17.99877625, 5.155355343), Point(8.134137123, 19.99864028, 5.132180499)]))  # disabled

# ---- group: Input grids
pt_22 = Point(Tree({0;0;0}: [Point(0, 0, 0), Point(0, 1, 0), Point(0, 2, 0), Point(0, 3, 0), Point(0, 4, 0), Point(0, 5, 0), Point(0, 6, 0)], {0;0;1}: [Point(1, 0, 0), Point(1, 1, 0), Point(1, 2, 0), Point(1, 3, 0), Point(1, 4, 0), Point(1, 5, 0), Point(1, 6, 0)], {0;0;2}: [Point(2, 0, 0), Point(2, 1, 0), Point(2, 2, 0), Point(2, 3, 0), Point(2, 4, 0), Point(2, 5, 0), Point(2, 6, 0)], {0;0;3}: [Point(3, 0, 0), Point(3, 1, 0), Point(3, 2, 0), Point(3, 3, 0), Point(3, 4, 0), Point(3, 5, 0), Point(3, 6, 0)], {0;0;4}: [Point(4, 0, 0), Point(4, 1, 0), Point(4, 2, 0), Point(4, 3, 0), Point(4, 4, 0), Point(4, 5, 0), Point(4, 6, 0)], {0;0;5}: [Point(5, 0, 0), Point(5, 1, 0), Point(5, 2, 0), Point(5, 3, 0), Point(5, 4, 0), Point(5, 5, 0), Point(5, 6, 0)]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))  # disabled

pt_23 = Point(Tree({0;0;0}: [Point(0, 0, 0), Point(0, 1, 0), Point(0, 2, 0), Point(0, 3, 0), Point(0, 4, 0), Point(0, 5, 0), Point(0, 6, 0)], {0;0;1}: [Point(1, 0, 0), Point(1, 1, 0), Point(1, 2, 0), Point(1, 3, 0), Point(1, 4, 0), Point(1, 5, 0), Point(1, 6, 0)], {0;0;2}: [Point(2, 0, 0), Point(2, 1, 0), Point(2, 2, 0), Point(2, 3, 0), Point(2, 4, 0), Point(2, 5, 0), Point(2, 6, 0)], {0;0;3}: [Point(3, 0, 0), Point(3, 1, 0), Point(3, 2, 0), Point(3, 3, 0), Point(3, 4, 0), Point(3, 5, 0), Point(3, 6, 0)], {0;0;4}: [Point(4, 0, 0), Point(4, 1, 0), Point(4, 2, 0), Point(4, 3, 0), Point(4, 4, 0), Point(4, 5, 0), Point(4, 6, 0)], {0;0;5}: [Point(5, 0, 0), Point(5, 1, 0), Point(5, 2, 0), Point(5, 3, 0), Point(5, 4, 0), Point(5, 5, 0), Point(5, 6, 0)]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))  # disabled

# ---- group: Input 2 trees of points
pt_24 = Point(Tree({0;0;0}: [Point(2.059310464, 1.751219295, 0), Point(1.618582738, 3.702054775, 0), Point(1.177855012, 5.652890256, 0), Point(0.737127286, 7.603725736, 0), Point(0.2963995599, 9.554561217, 0), Point(-0.1443281663, 11.5053967, 0), Point(-0.5850558924, 13.45623218, 0), Point(-1.025783619, 15.40706766, 0), Point(-1.466511345, 17.35790314, 0), Point(-1.907239071, 19.30873862, 0), Point(-2.347966797, 21.2595741, 0)], {0;0;1}: [Point(4.010145945, 2.191947021, 0), Point(3.569418219, 4.142782502, 0), Point(3.128690493, 6.093617982, 0), Point(2.687962766, 8.044453462, 0), Point(2.24723504, 9.995288943, 0), Point(1.806507314, 11.94612442, 0), Point(1.365779588, 13.8969599, 0), Point(0.9250518618, 15.84779538, 0), Point(0.4843241356, 17.79863086, 0), Point(0.04359640949, 19.74946634, 0), Point(-0.3971313167, 21.70030182, 0)], {0;0;2}: [Point(5.960981425, 2.632674747, 0), Point(5.520253699, 4.583510228, 0), Point(5.079525973, 6.534345708, 0), Point(4.638798247, 8.485181188, 0), Point(4.198070521, 10.43601667, 0), Point(3.757342794, 12.38685215, 0), Point(3.316615068, 14.33768763, 0), Point(2.875887342, 16.28852311, 0), Point(2.435159616, 18.23935859, 0), Point(1.99443189, 20.19019407, 0), Point(1.553704164, 22.14102955, 0)], {0;0;3}: [Point(7.911816906, 3.073402474, 0), Point(7.471089179, 5.024237954, 0), Point(7.030361453, 6.975073434, 0), Point(6.589633727, 8.925908915, 0), Point(6.148906001, 10.87674439, 0), Point(5.708178275, 12.82757988, 0), Point(5.267450549, 14.77841536, 0), Point(4.826722822, 16.72925084, 0), Point(4.385995096, 18.68008632, 0), Point(3.94526737, 20.6309218, 0), Point(3.504539644, 22.58175728, 0)], {0;0;4}: [Point(9.862652386, 3.5141302, 0), Point(9.42192466, 5.46496568, 0), Point(8.981196934, 7.41580116, 0), Point(8.540469207, 9.366636641, 0), Point(8.099741481, 11.31747212, 0), Point(7.659013755, 13.2683076, 0), Point(7.218286029, 15.21914308, 0), Point(6.777558303, 17.16997856, 0), Point(6.336830577, 19.12081404, 0), Point(5.896102851, 21.07164952, 0), Point(5.455375124, 23.022485, 0)], {0;1;0}: [Point(0.1582148939, 0, 4.469570754), Point(0.1608220639, 1.999864028, 4.44639591), Point(0.1634292338, 3.999728055, 4.423221066), Point(0.1660364038, 5.999592083, 4.400046222), Point(0.1686435737, 7.999456111, 4.376871378), Point(0.1712507437, 9.999320138, 4.353696534), Point(0.1738579136, 11.99918417, 4.33052169), Point(0.1764650835, 13.99904819, 4.307346846), Point(0.1790722535, 15.99891222, 4.284172002), Point(0.1816794234, 17.99877625, 4.260997158), Point(0.1842865934, 19.99864028, 4.237822314)], {0;1;1}: [Point(2.145677526, 0, 4.6931603), Point(2.148284696, 1.999864028, 4.669985456), Point(2.150891866, 3.999728055, 4.646810612), Point(2.153499036, 5.999592083, 4.623635768), Point(2.156106206, 7.999456111, 4.600460924), Point(2.158713376, 9.999320138, 4.57728608), Point(2.161320546, 11.99918417, 4.554111236), Point(2.163927716, 13.99904819, 4.530936392), Point(2.166534886, 15.99891222, 4.507761548), Point(2.169142056, 17.99877625, 4.484586704), Point(2.171749226, 19.99864028, 4.46141186)], {0;1;2}: [Point(4.133140159, 0, 4.916749846), Point(4.135747329, 1.999864028, 4.893575002), Point(4.138354498, 3.999728055, 4.870400158), Point(4.140961668, 5.999592083, 4.847225314), Point(4.143568838, 7.999456111, 4.82405047), Point(4.146176008, 9.999320138, 4.800875626), Point(4.148783178, 11.99918417, 4.777700782), Point(4.151390348, 13.99904819, 4.754525938), Point(4.153997518, 15.99891222, 4.731351094), Point(4.156604688, 17.99877625, 4.70817625), Point(4.159211858, 19.99864028, 4.685001407)], {0;1;3}: [Point(6.120602791, 0, 5.140339392), Point(6.123209961, 1.999864028, 5.117164548), Point(6.125817131, 3.999728055, 5.093989704), Point(6.128424301, 5.999592083, 5.07081486), Point(6.131031471, 7.999456111, 5.047640016), Point(6.133638641, 9.999320138, 5.024465172), Point(6.136245811, 11.99918417, 5.001290328), Point(6.13885298, 13.99904819, 4.978115484), Point(6.14146015, 15.99891222, 4.954940641), Point(6.14406732, 17.99877625, 4.931765797), Point(6.14667449, 19.99864028, 4.908590953)], {0;1;4}: [Point(8.108065423, 0, 5.363928938), Point(8.110672593, 1.999864028, 5.340754094), Point(8.113279763, 3.999728055, 5.31757925), Point(8.115886933, 5.999592083, 5.294404406), Point(8.118494103, 7.999456111, 5.271229562), Point(8.121101273, 9.999320138, 5.248054718), Point(8.123708443, 11.99918417, 5.224879875), Point(8.126315613, 13.99904819, 5.201705031), Point(8.128922783, 15.99891222, 5.178530187), Point(8.131529953, 17.99877625, 5.155355343), Point(8.134137123, 19.99864028, 5.132180499)]))  # disabled

# ----
pt_25 = Point(Tree({0;0;0}: [Point(2.059310464, 1.751219295, 0), Point(1.618582738, 3.702054775, 0), Point(1.177855012, 5.652890256, 0), Point(0.737127286, 7.603725736, 0), Point(0.2963995599, 9.554561217, 0), Point(-0.1443281663, 11.5053967, 0), Point(-0.5850558924, 13.45623218, 0), Point(-1.025783619, 15.40706766, 0), Point(-1.466511345, 17.35790314, 0), Point(-1.907239071, 19.30873862, 0), Point(-2.347966797, 21.2595741, 0)], {0;0;1}: [Point(4.010145945, 2.191947021, 0), Point(3.569418219, 4.142782502, 0), Point(3.128690493, 6.093617982, 0), Point(2.687962766, 8.044453462, 0), Point(2.24723504, 9.995288943, 0), Point(1.806507314, 11.94612442, 0), Point(1.365779588, 13.8969599, 0), Point(0.9250518618, 15.84779538, 0), Point(0.4843241356, 17.79863086, 0), Point(0.04359640949, 19.74946634, 0), Point(-0.3971313167, 21.70030182, 0)], {0;0;2}: [Point(5.960981425, 2.632674747, 0), Point(5.520253699, 4.583510228, 0), Point(5.079525973, 6.534345708, 0), Point(4.638798247, 8.485181188, 0), Point(4.198070521, 10.43601667, 0), Point(3.757342794, 12.38685215, 0), Point(3.316615068, 14.33768763, 0), Point(2.875887342, 16.28852311, 0), Point(2.435159616, 18.23935859, 0), Point(1.99443189, 20.19019407, 0), Point(1.553704164, 22.14102955, 0)], {0;0;3}: [Point(7.911816906, 3.073402474, 0), Point(7.471089179, 5.024237954, 0), Point(7.030361453, 6.975073434, 0), Point(6.589633727, 8.925908915, 0), Point(6.148906001, 10.87674439, 0), Point(5.708178275, 12.82757988, 0), Point(5.267450549, 14.77841536, 0), Point(4.826722822, 16.72925084, 0), Point(4.385995096, 18.68008632, 0), Point(3.94526737, 20.6309218, 0), Point(3.504539644, 22.58175728, 0)], {0;0;4}: [Point(9.862652386, 3.5141302, 0), Point(9.42192466, 5.46496568, 0), Point(8.981196934, 7.41580116, 0), Point(8.540469207, 9.366636641, 0), Point(8.099741481, 11.31747212, 0), Point(7.659013755, 13.2683076, 0), Point(7.218286029, 15.21914308, 0), Point(6.777558303, 17.16997856, 0), Point(6.336830577, 19.12081404, 0), Point(5.896102851, 21.07164952, 0), Point(5.455375124, 23.022485, 0)], {0;1;0}: [Point(0.1582148939, 0, 4.469570754), Point(0.1608220639, 1.999864028, 4.44639591), Point(0.1634292338, 3.999728055, 4.423221066), Point(0.1660364038, 5.999592083, 4.400046222), Point(0.1686435737, 7.999456111, 4.376871378), Point(0.1712507437, 9.999320138, 4.353696534), Point(0.1738579136, 11.99918417, 4.33052169), Point(0.1764650835, 13.99904819, 4.307346846), Point(0.1790722535, 15.99891222, 4.284172002), Point(0.1816794234, 17.99877625, 4.260997158), Point(0.1842865934, 19.99864028, 4.237822314)], {0;1;1}: [Point(2.145677526, 0, 4.6931603), Point(2.148284696, 1.999864028, 4.669985456), Point(2.150891866, 3.999728055, 4.646810612), Point(2.153499036, 5.999592083, 4.623635768), Point(2.156106206, 7.999456111, 4.600460924), Point(2.158713376, 9.999320138, 4.57728608), Point(2.161320546, 11.99918417, 4.554111236), Point(2.163927716, 13.99904819, 4.530936392), Point(2.166534886, 15.99891222, 4.507761548), Point(2.169142056, 17.99877625, 4.484586704), Point(2.171749226, 19.99864028, 4.46141186)], {0;1;2}: [Point(4.133140159, 0, 4.916749846), Point(4.135747329, 1.999864028, 4.893575002), Point(4.138354498, 3.999728055, 4.870400158), Point(4.140961668, 5.999592083, 4.847225314), Point(4.143568838, 7.999456111, 4.82405047), Point(4.146176008, 9.999320138, 4.800875626), Point(4.148783178, 11.99918417, 4.777700782), Point(4.151390348, 13.99904819, 4.754525938), Point(4.153997518, 15.99891222, 4.731351094), Point(4.156604688, 17.99877625, 4.70817625), Point(4.159211858, 19.99864028, 4.685001407)], {0;1;3}: [Point(6.120602791, 0, 5.140339392), Point(6.123209961, 1.999864028, 5.117164548), Point(6.125817131, 3.999728055, 5.093989704), Point(6.128424301, 5.999592083, 5.07081486), Point(6.131031471, 7.999456111, 5.047640016), Point(6.133638641, 9.999320138, 5.024465172), Point(6.136245811, 11.99918417, 5.001290328), Point(6.13885298, 13.99904819, 4.978115484), Point(6.14146015, 15.99891222, 4.954940641), Point(6.14406732, 17.99877625, 4.931765797), Point(6.14667449, 19.99864028, 4.908590953)], {0;1;4}: [Point(8.108065423, 0, 5.363928938), Point(8.110672593, 1.999864028, 5.340754094), Point(8.113279763, 3.999728055, 5.31757925), Point(8.115886933, 5.999592083, 5.294404406), Point(8.118494103, 7.999456111, 5.271229562), Point(8.121101273, 9.999320138, 5.248054718), Point(8.123708443, 11.99918417, 5.224879875), Point(8.126315613, 13.99904819, 5.201705031), Point(8.128922783, 15.99891222, 5.178530187), Point(8.131529953, 17.99877625, 5.155355343), Point(8.134137123, 19.99864028, 5.132180499)]))  # disabled
# Tutorial:
# Create the following wire tower using input points, and only the PathMapper and Polyline components. You can use Preview to color the output.
image_12 = ImageSampler(
    FilePath="C:\Users\Rajaa Issa\Desktop\EssentialAlgorithmsAndDataStructures\Images\03_14_Tower.png",
    Filter="Colour",
    Interpolate=False,
    Umax=1,
    Umin=0,
    Vmax=1,
    Vmin=0,
    Wrap=1)  # disabled
sqgrid_8 = Square(Plane=PlaneXY(0, 0, 0), Size=1, ExtentX=panel_187, ExtentY=panel_188)  # -> Cells, Points; disabled

# ---- group: Create a polyline through each branch
pline_8 = PolyLine(Vertices=pt_25, Closed=False)  # disabled

# ----
swatch = ColourSwatch(SwatchColor=RGB(168, 222, 255))  # disabled
swatch_2 = ColourSwatch(SwatchColor=RGB(168, 222, 255))  # disabled

# ---- group: Flip trees
path_mapper = PathMapper(pt_23, source="{A;B;C}(i)", target="{A;B;i}(C)")  # disabled

# ---- group: Regroup trees vertically
path_mapper_2 = PathMapper(pt_23, source="{A;B;C}(i)", target="{A;C;i}(B)")  # disabled

# ---- group: Group corresponding branches in separate trees
viewer_88 = ParamViewer(pt_24)  # disabled

# ----
swatch_3 = ColourSwatch(SwatchColor=RGB(255, 215, 105))  # disabled

# ---- group: Null mapping (first step to identify the path) - Map left to right
path_mapper_3 = PathMapper(sqgrid_8.Points, source="{A;B;C}", target="{A;B;C}")  # disabled

# ----
preview = CustomPreview(Geometry=pt_24, Material=swatch)  # disabled
symsim = SymbolSimple(Style=5, Size=2, Rotation=0, Colour=swatch_2)  # disabled
viewer_89 = ParamViewer(pt_22)  # disabled
preview_2 = CustomPreview(Geometry=pline_8, Material=swatch_3)  # disabled
swatch_4 = ColourSwatch(SwatchColor=RGB(168, 222, 255))  # disabled
symbol = SymbolDisplay(Location=pt_22, Display=symsim)  # disabled

# ---- group: Connect points in each branch
pline_9 = PolyLine(Vertices=pt_24, Closed=False)  # disabled

# ----
swatch_5 = ColourSwatch(SwatchColor=RGB(255, 215, 105))  # disabled
viewer_90 = ParamViewer(pt_24)  # disabled

# ---- group: Group corresponding branches in seperate trees
path_mapper_4 = PathMapper(pt_24, source="{A;B;C}", target="{A;C;B}")  # disabled

# ---- group: Horizontal connections
pline_10 = PolyLine(Vertices=pt_23, Closed=False)  # disabled

# ---- group: Cross connections
pline_11 = PolyLine(Vertices=path_mapper, Closed=False)  # disabled

# ---- group: Vertical connections
pline_12 = PolyLine(Vertices=path_mapper_2, Closed=False)  # disabled

# ----
symsim_2 = SymbolSimple(Style=5, Size=2, Rotation=0, Colour=swatch_4)  # disabled

# ---- group: Simplify tree (remove A and B)
# Target
# { branch path} [ index ]
path_mapper_5 = PathMapper(sqgrid_8.Points, source="{A;B;C}", target="{C}")  # disabled

# ----
preview_3 = CustomPreview(Geometry=pline_9, Material=swatch_5)  # disabled
symbol_2 = SymbolDisplay(Location=pt_24, Display=symsim_2)  # disabled

# ---- group: Input data strucuture
viewer_91 = ParamViewer(pt_25)  # disabled
path_index_path_address = Panel(viewer_91)  # disabled

# ---- group: Input grids
pt_26 = Point(Tree({0;0;0}: [Point(0, 0, 0), Point(0, 1, 0), Point(0, 2, 0), Point(0, 3, 0), Point(0, 4, 0), Point(0, 5, 0), Point(0, 6, 0)], {0;0;1}: [Point(1, 0, 0), Point(1, 1, 0), Point(1, 2, 0), Point(1, 3, 0), Point(1, 4, 0), Point(1, 5, 0), Point(1, 6, 0)], {0;0;2}: [Point(2, 0, 0), Point(2, 1, 0), Point(2, 2, 0), Point(2, 3, 0), Point(2, 4, 0), Point(2, 5, 0), Point(2, 6, 0)], {0;0;3}: [Point(3, 0, 0), Point(3, 1, 0), Point(3, 2, 0), Point(3, 3, 0), Point(3, 4, 0), Point(3, 5, 0), Point(3, 6, 0)], {0;0;4}: [Point(4, 0, 0), Point(4, 1, 0), Point(4, 2, 0), Point(4, 3, 0), Point(4, 4, 0), Point(4, 5, 0), Point(4, 6, 0)], {0;0;5}: [Point(5, 0, 0), Point(5, 1, 0), Point(5, 2, 0), Point(5, 3, 0), Point(5, 4, 0), Point(5, 5, 0), Point(5, 6, 0)]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))  # disabled

# ----
swatch_6 = ColourSwatch(SwatchColor=RGB(255, 215, 105))  # disabled
swatch_7 = ColourSwatch(SwatchColor=RGB(161, 96, 96))  # disabled
swatch_8 = ColourSwatch(SwatchColor=RGB(168, 222, 255))  # disabled
viewer_92 = ParamViewer(pt_24)  # disabled
viewer_93 = ParamViewer(path_mapper_4)  # disabled
viewer_94 = ParamViewer(path_mapper_4)  # disabled
viewer_95 = ParamViewer(pt_26)  # disabled
preview_4 = CustomPreview(Geometry=pline_10, Material=swatch_6)  # disabled
preview_5 = CustomPreview(Geometry=pline_11, Material=swatch_7)  # disabled
preview_6 = CustomPreview(Geometry=pline_12, Material=swatch_8)  # disabled
viewer_96 = ParamViewer(path_mapper_5)  # disabled

# ---- group: Reverse the order of elements in each branch
path_mapper_6 = PathMapper(pt_25, source="{A;B;C}(i)", target="{A;B;C}(item_count - 1 - i)")  # disabled

# ---- group: Flip trees
# Flip each tree
path_mapper_7 = PathMapper(path_mapper_4, source="{A;B;C}(i)", target="{A;B;i}(C)")  # disabled

# ---- group: Combine the 2 steps in 1 / Regroup and flip trees
path_mapper_8 = PathMapper(pt_24, source="{A;B;C}(i)", target="{A;C;i}(B)")  # disabled

# ----
viewer_97 = ParamViewer(pt_26)  # disabled

# ---- group: Flip trees (elements with same indices grouped in their own branches)
path_mapper_9 = PathMapper(pt_25, source="{A;B;C}(i)", target="{A;B;i}(C)")  # disabled

# ---- group: Cobmine all branches into one simple tree
path_mapper_10 = PathMapper(pt_25, source="{A;B;C}", target="{path_index}")  # disabled

# ---- group: Null mapping (used to declare source paths strucuture)
path_mapper_11 = PathMapper(pt_25, source="{A;B;C}", target="{A;B;C}")  # disabled

# ---- group: All elements of all branches are put in a list (Flatten)
path_mapper_12 = PathMapper(pt_25, source="{A;B;C}", target="{0}")  # disabled

# ---- group: Each element becomes a branch of its own (Graft)
path_mapper_13 = PathMapper(pt_25, source="{A;B;C}(i)", target="{A;B;C;i}")  # disabled

# ----
viewer_98 = ParamViewer(pt_25)  # disabled

# ---- group: Flatten tree (place all elements in branch 0)
path_mapper_14 = PathMapper(sqgrid_8.Points, source="{A;B;C}", target="{0}")  # disabled

# ----
viewer_99 = ParamViewer(path_mapper_7)  # disabled
viewer_100 = ParamViewer(pt_25)  # disabled

# ---- group: Connect points in each branch
pline_13 = PolyLine(Vertices=path_mapper_7, Closed=False)  # disabled

# ---- group: Combine the 2 steps in 1
viewer_101 = ParamViewer(path_mapper_8)  # disabled

# ----
viewer_102 = ParamViewer(path_mapper_7)  # disabled
viewer_103 = ParamViewer(path_mapper_9)  # disabled
viewer_104 = ParamViewer(path_mapper_12)  # disabled
viewer_105 = ParamViewer(path_mapper_13)  # disabled
viewer_106 = ParamViewer(path_mapper_6)  # disabled
viewer_107 = ParamViewer(path_mapper_10)  # disabled
swatch_9 = ColourSwatch(SwatchColor=RGB(161, 96, 96))  # disabled
viewer_108 = ParamViewer(path_mapper_14)  # disabled
viewer_109 = ParamViewer(path_mapper_8)  # disabled
viewer_110 = ParamViewer(path_mapper_10)  # disabled
viewer_111 = ParamViewer(path_mapper_9)  # disabled
viewer_112 = ParamViewer(path_mapper_12)  # disabled
viewer_113 = ParamViewer(path_mapper_13)  # disabled
viewer_114 = ParamViewer(path_mapper_6)  # disabled
preview_7 = CustomPreview(Geometry=pline_13, Material=swatch_9)  # disabled

# ---- group: Number of runs
number_slider_7 = Slider(6, range=6..24)  # disabled

# ----
# Advanced Data Structures Assignment
# Q1:
# Create a parametric truss system that changes gradually in height as shown in the image
image_13 = ImageSampler(
    FilePath="C:\Users\Rajaa Issa\Desktop\EssentialAlgorithmsAndDataStructures\Images\03_15_VariableTruss.png",
    Filter="Colour",
    Interpolate=False,
    Umax=1,
    Umin=0,
    Vmax=1,
    Vmin=0,
    Wrap=1)  # disabled
# Q2:
# Given the input grid, use RelativeItem component to create diagonal triangles as shown in the image.
image_14 = ImageSampler(
    FilePath="C:\Users\Rajaa Issa\Desktop\EssentialAlgorithmsAndDataStructures\Images\03_16_Triangles.png",
    Filter="Colour",
    Interpolate=False,
    Umax=1,
    Umin=0,
    Vmax=1,
    Vmin=0,
    Wrap=1)  # disabled
# Q2:
# Create flat weave of threads using a rectangular grid as an initial input. Set your desired density and size.
# 
# Bonus:
# Make the weaving go along any surface
image_15 = ImageSampler(
    FilePath="C:\Users\Rajaa Issa\Desktop\EssentialAlgorithmsAndDataStructures\Images\03_19_WeaveBasic.png",
    Filter="Colour",
    Interpolate=False,
    Umax=1,
    Umin=0,
    Vmax=1,
    Vmin=0,
    Wrap=1)  # disabled
image_16 = ImageSampler(
    FilePath="C:\Users\Rajaa Issa\Desktop\EssentialAlgorithmsAndDataStructures\Images\03_20_WeaveSurface.png",
    Filter="Colour",
    Interpolate=False,
    Umax=1,
    Umin=0,
    Vmax=1,
    Vmin=0,
    Wrap=1)  # disabled
# Question 3:
# Use relative items between the 2 bounding grids provided to generate the connections shown in the image
image_17 = ImageSampler(
    FilePath="C:\Users\Rajaa Issa\Desktop\EssentialAlgorithmsAndDataStructures\Images\03_17_Zigzag.png",
    Filter="Colour",
    Interpolate=False,
    Umax=1,
    Umin=0,
    Vmax=1,
    Vmin=0,
    Wrap=1)  # disabled
# Question 3:
# Use relative items between the 2 bounding grids provided to generate the connections shown in the image
image_18 = ImageSampler(
    FilePath="C:\Users\Rajaa Issa\Desktop\EssentialAlgorithmsAndDataStructures\Images\03_22_TrussAdvanced_Q3.jpg",
    Filter="Colour",
    Interpolate=False,
    Umax=1,
    Umin=0,
    Vmax=1,
    Vmin=0,
    Wrap=1)  # disabled

# ---- group: Bottom grid
pt_27 = Point(Tree({0}: [Point(0, 0, 1), Point(0, 1, 1), Point(0, 2, 1), Point(0, 3, 1), Point(0, 4, 1), Point(0, 5, 1), Point(0, 6, 1), Point(0, 7, 1), Point(0, 8, 1)], {1}: [Point(1, 0, 1), Point(1, 1, 1), Point(1, 2, 1), Point(1, 3, 1), Point(1, 4, 1), Point(1, 5, 1), Point(1, 6, 1), Point(1, 7, 1), Point(1, 8, 1)], {2}: [Point(2, 0, 1), Point(2, 1, 1), Point(2, 2, 1), Point(2, 3, 1), Point(2, 4, 1), Point(2, 5, 1), Point(2, 6, 1), Point(2, 7, 1), Point(2, 8, 1)], {3}: [Point(3, 0, 1), Point(3, 1, 1), Point(3, 2, 1), Point(3, 3, 1), Point(3, 4, 1), Point(3, 5, 1), Point(3, 6, 1), Point(3, 7, 1), Point(3, 8, 1)], {4}: [Point(4, 0, 1), Point(4, 1, 1), Point(4, 2, 1), Point(4, 3, 1), Point(4, 4, 1), Point(4, 5, 1), Point(4, 6, 1), Point(4, 7, 1), Point(4, 8, 1)], {5}: [Point(5, 0, 1), Point(5, 1, 1), Point(5, 2, 1), Point(5, 3, 1), Point(5, 4, 1), Point(5, 5, 1), Point(5, 6, 1), Point(5, 7, 1), Point(5, 8, 1)], {6}: [Point(6, 0, 1), Point(6, 1, 1), Point(6, 2, 1), Point(6, 3, 1), Point(6, 4, 1), Point(6, 5, 1), Point(6, 6, 1), Point(6, 7, 1), Point(6, 8, 1)]))  # disabled

# ---- group: Top grid
pt_28 = Point(Tree({0}: [Point(0, 0, 1.291502622), Point(0, 1, 1.916079783), Point(0, 2, 2.32455532), Point(0, 3, 2.557438524), Point(0, 4, 2.633249581), Point(0, 5, 2.557438524), Point(0, 6, 2.32455532), Point(0, 7, 1.916079783), Point(0, 8, 1.291502622)], {1}: [Point(1, 0, 1.744562647), Point(1, 1, 2.32455532), Point(1, 2, 2.708203932), Point(1, 3, 2.92820323), Point(1, 4, 3), Point(1, 5, 2.92820323), Point(1, 6, 2.708203932), Point(1, 7, 2.32455532), Point(1, 8, 1.744562647)], {2}: [Point(2, 0, 2), Point(2, 1, 2.557438524), Point(2, 2, 2.92820323), Point(2, 3, 3.141428429), Point(2, 4, 3.211102551), Point(2, 5, 3.141428429), Point(2, 6, 2.92820323), Point(2, 7, 2.557438524), Point(2, 8, 2)], {3}: [Point(3, 0, 2.08276253), Point(3, 1, 2.633249581), Point(3, 2, 3), Point(3, 3, 3.211102551), Point(3, 4, 3.280109889), Point(3, 5, 3.211102551), Point(3, 6, 3), Point(3, 7, 2.633249581), Point(3, 8, 2.08276253)], {4}: [Point(4, 0, 2), Point(4, 1, 2.557438524), Point(4, 2, 2.92820323), Point(4, 3, 3.141428429), Point(4, 4, 3.211102551), Point(4, 5, 3.141428429), Point(4, 6, 2.92820323), Point(4, 7, 2.557438524), Point(4, 8, 2)], {5}: [Point(5, 0, 1.744562647), Point(5, 1, 2.32455532), Point(5, 2, 2.708203932), Point(5, 3, 2.92820323), Point(5, 4, 3), Point(5, 5, 2.92820323), Point(5, 6, 2.708203932), Point(5, 7, 2.32455532), Point(5, 8, 1.744562647)], {6}: [Point(6, 0, 1.291502622), Point(6, 1, 1.916079783), Point(6, 2, 2.32455532), Point(6, 3, 2.557438524), Point(6, 4, 2.633249581), Point(6, 5, 2.557438524), Point(6, 6, 2.32455532), Point(6, 7, 1.916079783), Point(6, 8, 1.291502622)]))  # disabled

# ---- group: Bottom grid / Branch spans
panel_189 = Panel("6")  # disabled

# ---- group: Bottom grid / Element spans
panel_190 = Panel("8")  # disabled

# ---- group: Number of trusses
# Step 2
# Plug the solution we had for a single truss
number_slider_8 = Slider(6, range=0..20)  # disabled

# ---- group: Variable height
# Step 3
# I dentify bottom and top grid of points, then connect corresponding elements in different branchs
panel_191 = Panel("1 to 3")  # disabled
range_8 = Range(Domain=panel_191, Steps=expr("x-1", number_slider_8))  # disabled

# ---- group: Distance between trusses
# Step 1
# Create base lines
number_slider_9 = Slider(2.2, range=1..10)  # disabled

# ----
number_slider_10 = Slider(5, range=5..10)  # disabled
number_slider_11 = Slider(0.086, range=0..1)  # disabled
number_slider_12 = Slider(2.5, range=1..10)  # disabled
number_slider_13 = Slider(5, range=5..10)  # disabled
number_slider_14 = Slider(0.204, range=0..1)  # disabled

# ---- group: Parameters
number_slider_15 = Slider(20, range=8..40)  # disabled
number_slider_16 = Slider(8, range=8..28)  # disabled
number_slider_17 = Slider(0.279, range=0..1)  # disabled
number_slider_18 = Slider(0.169, range=0..1)  # disabled

# ---- group: Branch spans
panel_192 = Panel("6")  # disabled

# ---- group: Element spans
panel_193 = Panel("8")  # disabled

# ---- group: Bottom grid
sqgrid_9 = Square(Plane=PlaneXY(0, 0, 0), Size=1, ExtentX=panel_189, ExtentY=panel_190)  # -> Cells, simplify(Points); disabled

# ----
points_23 = PointList(Points=pt_27)  # disabled
swatch_10 = ColourSwatch(SwatchColor=RGB(161, 96, 96))  # disabled

# ---- group: Number of runs
# Number of runs 6-20
panel_194 = Panel("10")  # disabled

# ---- group: Height
# Variable height 1-3
panel_195 = Panel("7")  # disabled

# ---- group: Input line
# Use previous truss solution with necessary modifications
# Use multiple lines
line_3 = Line(Line((2, 18, 0), (40, 18, 0)))  # disabled

# ----
panel_196 = Panel("2")  # disabled
sqgrid_10 = Square(Plane=PlaneXY(0, 0, 0), Size=1, ExtentX=panel_192, ExtentY=panel_193)  # -> Cells, simplify(Points); disabled
Z_6 = UnitZ(Factor=range_8)  # disabled

# ---- group: Offset mask for the base
panel_197 = Panel("{0}[+2]")  # disabled

# ---- group: Top grid
Z_7 = UnitZ(Factor=1)  # disabled
move_7 = Move(Geometry=sqgrid_9.Points, Motion=Z_7)  # -> Geometry, Transform; disabled

# ---- group: Divide line to double number of runs
panel_198 = Panel("2")  # disabled
multiplication_2 = Multiplication(A=panel_194, B=panel_198)  # disabled
divide_4 = DivideCurve(Curve=line_3, Count=multiplication_2, Kinks=False)  # -> Points, Tangents, Parameters; disabled

# ----
points_24 = PointList(Points=pt_27, Size=0.2)  # disabled
preview_8 = CustomPreview(Geometry=sqgrid_10.Points, Material=swatch_10)  # disabled

# ---- group: Generate list of distances
series = Series(Start=0, Step=number_slider_9, Count=number_slider_8)  # disabled

# ----
panel_199 = Panel("""False
True""")  # disabled
panel_200 = Panel(series)  # disabled

# ---- group: Multi-line input is combined
panel_201 = Panel("""{*;(0,2,...)}[0,2,...]
{*;(1,3,...)}[1,3,...]""")  # disabled

# ---- group: surface
S = Surface(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)  # disabled

# ----
relitem_9 = RelativeItem(Tree=pt_27, Offset=panel_197, WrapPaths=False, WrapItems=False)  # -> ItemA, ItemB; disabled

# ---- group: Selection mask
panel_202 = Panel("""{*;(0,2,...)}[0,2,...]
{*;(1,3,...)}[1,3,...]""")  # disabled

# ---- group: Offset mask
panel_203 = Panel("{+1}[+1]")  # disabled

# ---- group: Bottom cross bars
panel_204 = Panel("""True
False""")  # disabled
cull_4 = CullPattern(List=pt_27, CullPattern=panel_204)  # disabled
flip_7 = FlipMatrix(Data=cull_4)  # disabled
pline_14 = PolyLine(Vertices=flip_7, Closed=False)  # -> flatten(Polyline); disabled

# ----
viewer_115 = ParamViewer(sqgrid_10.Points)  # disabled
panel_205 = Panel("""False
True""")  # disabled
Y = UnitY(Factor=series)  # disabled

# ---- group: Initial input line along x-axis
line_4 = Line(Line((2, 2, 0), (18, 2, 0)))  # disabled

# ----
panel_206 = Panel("{0,2,...}")  # disabled
panel_207 = Panel("{0,2,...}")  # disabled
points_25 = PointList(Points=move_7.Geometry, Size=0.1)  # disabled

# ---- group: planar grid
recgrid = Rectangular(
    Plane=PlaneXY(0, 0, 0),
    SizeX=number_slider_12,
    SizeY=number_slider_12,
    ExtentX=number_slider_13,
    ExtentY=number_slider_10)  # -> Cells, Points; disabled

# ---- group: divide srf
sdivide_2 = DivideSurface(Surface=S, UCount=number_slider_15, VCount=number_slider_16)  # -> Points, Normals, Parameters; disabled

# ----
panel_208 = Panel("""True
False""")  # disabled
ln_12 = Line(StartPoint=relitem_9.ItemA, EndPoint=relitem_9.ItemB)  # disabled

# ---- group: Split in 2 trees using offset mask
relitem_10 = RelativeItem(Tree=sqgrid_10.Points, Offset=panel_203, WrapPaths=False, WrapItems=False)  # -> ItemA, ItemB; disabled

# ---- group: Copy line
move_8 = Move(Geometry=line_4, Motion=Y)  # -> Geometry, Transform; disabled

# ---- group: List of lines
crv_13 = Curve(move_8.Geometry)  # disabled

# ---- group: Divide line to double number of runs
multiplication_3 = Multiplication(A=number_slider_7, B=panel_196)  # disabled
divide_5 = DivideCurve(Curve=crv_13, Count=multiplication_3, Kinks=False)  # -> Points, Tangents, Parameters; disabled

# ---- group: Bottom points
cull_5 = CullPattern(List=divide_5.Points, CullPattern=invert(panel_199))  # disabled

# ---- group: Base Points
pt_29 = Point(cull_5)  # disabled

# ----
viewer_116 = ParamViewer(pt_29)  # disabled
flip_8 = FlipMatrix(Data=pt_29)  # disabled

# ---- group: Top points
cull_6 = CullPattern(List=divide_5.Points, CullPattern=panel_199)  # disabled
move_9 = Move(Geometry=cull_6, Motion=Z_6)  # -> Geometry, Transform; disabled

pt_30 = Point(move_9.Geometry)  # disabled

# ----
viewer_117 = ParamViewer(pt_30)  # disabled
flip_9 = FlipMatrix(Data=pt_30)  # disabled

# ---- group: Top points
cull_7 = CullPattern(List=divide_4.Points, CullPattern=panel_205)  # disabled
Z_8 = UnitZ(Factor=panel_195)  # disabled
move_10 = Move(Geometry=cull_7, Motion=Vector(0, 0, 7))  # -> Geometry, Transform; disabled

# ---- group: Split bottom grid
split_7 = SplitTree(Data=sqgrid_9.Points, Masks=flatten(panel_207))  # -> Positive, Negative; disabled

# ---- group: Split top grid
split_8 = SplitTree(Data=move_7.Geometry, Masks=flatten(panel_206))  # -> Positive, Negative; disabled

# ---- group: Bottom points
cull_8 = CullPattern(List=divide_4.Points, CullPattern=invert(panel_205))  # disabled

# ----
viewer_118 = ParamViewer(flip_9)  # disabled
flip_10 = FlipMatrix(Data=recgrid.Points)  # disabled
viewer_119 = ParamViewer(flip_8)  # disabled

# ---- group: Base Points
pt_31 = Point(cull_5)  # disabled

# ----
cull_9 = CullPattern(List=ln_12, CullPattern=panel_208)  # disabled

# ---- group: Flipped points grid
flip_11 = FlipMatrix(Data=sdivide_2.Points)  # disabled

# ---- group: Flipped normals grid
flip_12 = FlipMatrix(Data=sdivide_2.Normals)  # disabled

# ----
panel_209 = Panel("{0}[+1]")  # disabled

# ---- group: Create 3rd set of points
Z_9 = UnitZ(Factor=1)  # disabled
move_11 = Move(Geometry=relitem_10.ItemB, Motion=Z_9)  # -> Geometry, Transform; disabled

# ----
viewer_120 = ParamViewer(relitem_10.ItemA)  # disabled

# ---- group: Weave into one list
weave = Weave(Pattern=[0, 1], Stream0=cull_5, Stream1=move_9.Geometry, NullGaps=False)  # disabled

# ---- group: Isolate points to move
split_9 = SplitTree(Data=flip_10, Masks=panel_201)  # -> Positive, Negative; disabled
split_10 = SplitTree(Data=recgrid.Points, Masks=panel_201)  # -> Positive, Negative; disabled

# ----
viewer_121 = ParamViewer(cull_9)  # disabled

# ---- group: Top points
pt_32 = Point(move_9.Geometry)  # disabled

# ---- group: Isolate points to move
split_11 = SplitTree(Data=sdivide_2.Points, Masks=panel_202)  # -> Positive, Negative; disabled
split_12 = SplitTree(Data=flip_11, Masks=panel_202)  # -> Positive, Negative; disabled

# ----
viewer_122 = ParamViewer(relitem_10.ItemB)  # disabled

# ---- group: Middle points
weave_2 = Weave(Pattern=[0, 1], Stream0=cull_8, Stream1=move_10.Geometry, NullGaps=False)  # disabled

# ----
Z_10 = UnitZ(Factor=number_slider_14)  # disabled

# ---- group: Offset mask for the truss
panel_210 = Panel("{0}[+1]")  # disabled

# ----
number_slider_19 = Slider(0.034, range=0.01..0.1)  # disabled

# ---- group: Top
pline_15 = PolyLine(Vertices=move_9.Geometry, Closed=False)  # disabled

# ---- group: Middle
pline_16 = PolyLine(Vertices=weave, Closed=False)  # disabled

# ---- group: Bottom
pline_17 = PolyLine(Vertices=cull_5, Closed=False)  # disabled

# ---- group: Cross Bottom
pline_18 = PolyLine(Vertices=flip_8, Closed=False)  # disabled

# ---- group: Cross Top
pline_19 = PolyLine(Vertices=flip_9, Closed=False)  # disabled

# ---- group: B branch
panel_211 = Panel("{1}")  # disabled
flatten_4 = FlattenTree(Tree=relitem_10.ItemB, Path=panel_211)  # disabled

# ---- group: A branch
panel_212 = Panel("{0}")  # disabled
flatten_5 = FlattenTree(Tree=relitem_10.ItemA, Path=panel_212)  # disabled

# ---- group: C branch
panel_213 = Panel("{2}")  # disabled
flatten_6 = FlattenTree(Tree=move_11.Geometry, Path=panel_213)  # disabled

# ---- group: Find relative trees of the positive part
relitem2_6 = RelativeItems(TreeA=split_7.Positive, TreeB=split_8.Positive, Offset=panel_209, WrapPaths=False, WrapItems=False)  # -> ItemA, ItemB; disabled

# ---- group: Shift positive bottom
shift_2 = ShiftList(List=split_7.Positive, Shift=1, Wrap=False)  # disabled

# ---- group: Reverse negative and find trees, shift and weave
relitem2_7 = RelativeItems(TreeA=reverse(split_7.Negative), TreeB=reverse(split_8.Negative), Offset=panel_209, WrapPaths=False, WrapItems=False)  # -> ItemA, ItemB; disabled
shift_3 = ShiftList(List=reverse(split_7.Negative), Shift=1, Wrap=False)  # disabled
weave_3 = Weave(Pattern=[0, 1, 2], Stream0=relitem2_7.ItemA, Stream1=relitem2_7.ItemB, Stream2=shift_3, NullGaps=False)  # disabled
dcon = DeleteConsecutive(Set=weave_3, Wrap=False)  # -> Set, Count; disabled

# ----
num_64 = Number(number_slider_17)  # disabled
flatten_7 = FlattenTree(Tree=cull_9, Path="{0}")  # disabled
viewer_123 = ParamViewer(move_11.Geometry)  # disabled

# ---- group: Top
# Create pipes through curves
pline_20 = PolyLine(Vertices=move_10.Geometry, Closed=False)  # disabled

# ---- group: Middle
pline_21 = PolyLine(Vertices=weave_2, Closed=False)  # disabled

# ---- group: Bottom
pline_22 = PolyLine(Vertices=cull_8, Closed=False)  # disabled

# ---- group: Move isolated points up and down
move_12 = Move(Geometry=split_10.Negative, Motion=expr("-x", Z_10))  # -> Geometry, Transform; disabled
move_13 = Move(Geometry=split_9.Positive, Motion=expr("-x", Z_10))  # -> Geometry, Transform; disabled
move_14 = Move(Geometry=split_10.Positive, Motion=Z_10)  # -> Geometry, Transform; disabled
move_15 = Move(Geometry=split_9.Negative, Motion=Z_10)  # -> Geometry, Transform; disabled

# ----
panel_214 = Panel("0.02")  # disabled
panel_215 = Panel("0.01")  # disabled
panel_216 = Panel("0.05")  # disabled
relitem2_8 = RelativeItems(TreeA=pt_27, TreeB=pt_28, Offset=panel_210, WrapPaths=False, WrapItems=False)  # -> ItemA, ItemB; disabled
swatch_11 = ColourSwatch(SwatchColor=RGB(45, 164, 237))  # disabled

# ---- group: Weave points and remove duplicates
weave_4 = Weave(Pattern=[0, 1, 2], Stream0=relitem2_6.ItemA, Stream1=relitem2_6.ItemB, Stream2=shift_2, NullGaps=False)  # disabled
dcon_2 = DeleteConsecutive(Set=weave_4, Wrap=False)  # -> Set, Count; disabled

# ----
pipe = Pipe(Curve=[pline_14, flatten_7], Radius=number_slider_19, Caps=0)  # disabled

# ---- group: Pipe truss
pipe_2 = Pipe(Curve=pline_16, Radius=panel_214, Caps=0)  # disabled

# ---- group: Pipe top and base
pipe_3 = Pipe(Curve=[pline_15, pline_17], Radius=panel_215, Caps=0)  # disabled

# ---- group: Pipe cross beams
pipe_4 = Pipe(Curve=[pline_18, pline_19], Radius=panel_216, Caps=0)  # disabled

# ---- group: Move up and down
amp = Amplitude(Vector=sdivide_2.Normals, Amplitude=num_64)  # disabled
amp_2 = Amplitude(Vector=sdivide_2.Normals, Amplitude=num_64)  # disabled
amp_3 = Amplitude(Vector=flip_12, Amplitude=num_64)  # disabled
amp_4 = Amplitude(Vector=flip_12, Amplitude=num_64)  # disabled
move_16 = Move(Geometry=split_11.Positive, Motion=amp)  # -> Geometry, Transform; disabled
move_17 = Move(Geometry=split_12.Negative, Motion=amp_4)  # -> Geometry, Transform; disabled

# ----
ln_13 = Line(StartPoint=relitem2_8.ItemA, EndPoint=relitem2_8.ItemB)  # disabled
panel_217 = Panel("""True
False""")  # disabled

# ---- group: Create one strucuture for the 3 sets
merge_2 = Merge(Data1=flatten_5, Data2=flatten_4, Data3=flatten_6)  # disabled

# ----
preview_9 = CustomPreview(Geometry=pipe, Material=swatch_11)  # disabled

# ---- group: Recombine points
combine_5 = CombineData(Input0=move_15.Geometry, Input1=move_13.Geometry)  # -> Result, Index; disabled
combine_6 = CombineData(Input0=move_14.Geometry, Input1=move_12.Geometry)  # -> Result, Index; disabled

# ----
swatch_12 = ColourSwatch(SwatchColor=RGB(168, 222, 255))  # disabled
swatch_13 = ColourSwatch(SwatchColor=RGB(161, 96, 96))  # disabled
panel_218 = Panel("3")  # disabled
panel_219 = Panel("3")  # disabled
viewer_124 = ParamViewer(merge_2)  # disabled
cull_10 = CullPattern(List=ln_13, CullPattern=panel_217)  # disabled

# ---- group: Move up and down / T = -T
move_18 = Move(Geometry=split_11.Negative, Motion=expr("-x", amp_2))  # -> Geometry, Transform; disabled

move_19 = Move(Geometry=split_12.Positive, Motion=expr("-x", amp_3))  # -> Geometry, Transform; disabled

# ----
preview_10 = CustomPreview(Geometry=pipe_4, Material=swatch_12)  # disabled
viewer_125 = ParamViewer(cull_10)  # disabled
preview_11 = CustomPreview(Geometry=[pipe_2, pipe_3], Material=swatch_13)  # disabled

# ---- group: Merge into one strucuture
merge_3 = Merge(Data1=dcon_2.Set, Data2=dcon.Set)  # disabled

# ---- group: Group corresponding corners
flip_13 = FlipMatrix(Data=merge_2)  # disabled

# ---- group: Generate curves through points
intcrv = Interpolate(Vertices=combine_5.Result, Degree=panel_218, Periodic=False, KnotStyle=1)  # -> Curve, Length, Domain; disabled
intcrv_2 = Interpolate(Vertices=combine_6.Result, Degree=panel_219, Periodic=False, KnotStyle=1)  # -> Curve, Length, Domain; disabled

# ----
number_slider_20 = Slider(0.022, range=0.01..0.1)  # disabled
viewer_126 = ParamViewer(flip_13)  # disabled

# ---- group: Recombine points
combine_7 = CombineData(Input0=move_16.Geometry, Input1=move_18.Geometry)  # -> Result, Index; disabled
combine_8 = CombineData(Input0=move_17.Geometry, Input1=move_19.Geometry)  # -> Result, Index; disabled

# ---- group: Create boundary curve
pline_23 = PolyLine(Vertices=flip_13, Closed=True)  # disabled

# ----
panel_220 = Panel("3")  # disabled

# ---- group: Create pipes
pline_24 = PolyLine(Vertices=merge_3, Closed=False)  # disabled
pipe_5 = Pipe(Curve=pline_24, Radius=number_slider_20, Caps=0)  # disabled

# ----
panel_221 = Panel("3")  # disabled

# ---- group: Offset mask for the truss
panel_222 = Panel("{0}[-1]")  # disabled

# ----
pipe_6 = Pipe(Curve=intcrv_2.Curve, Radius=number_slider_11, Caps=0)  # disabled
pipe_7 = Pipe(Curve=intcrv.Curve, Radius=number_slider_11, Caps=0)  # disabled

# ---- group: Create surfaces
boundary_2 = BoundarySurfaces(Edges=flatten(pline_23))  # disabled

# ---- group: Generate curves
intcrv_3 = Interpolate(Vertices=combine_7.Result, Degree=panel_221, Periodic=False, KnotStyle=1)  # -> Curve, Length, Domain; disabled
intcrv_4 = Interpolate(Vertices=combine_8.Result, Degree=panel_220, Periodic=False, KnotStyle=1)  # -> Curve, Length, Domain; disabled

# ----
swatch_14 = ColourSwatch(SwatchColor=RGB(168, 222, 255))  # disabled
relitem2_9 = RelativeItems(TreeA=pt_27, TreeB=pt_28, Offset=panel_222, WrapPaths=False, WrapItems=False)  # -> ItemA, ItemB; disabled
swatch_15 = ColourSwatch(SwatchColor=RGB(161, 96, 96))  # disabled
swatch_16 = ColourSwatch(SwatchColor=RGB(168, 222, 255))  # disabled
swatch_17 = ColourSwatch(SwatchColor=RGB(45, 164, 237))  # disabled
num_65 = Number(number_slider_18)  # disabled
preview_12 = CustomPreview(Geometry=boundary_2, Material=swatch_14)  # disabled
preview_13 = CustomPreview(Geometry=pipe_6, Material=swatch_15)  # disabled
preview_14 = CustomPreview(Geometry=pipe_7, Material=swatch_16)  # disabled
ln_14 = Line(StartPoint=relitem2_9.ItemA, EndPoint=relitem2_9.ItemB)  # disabled
panel_223 = Panel("""False
True""")  # disabled
swatch_18 = ColourSwatch(SwatchColor=RGB(161, 96, 96))  # disabled
swatch_19 = ColourSwatch(SwatchColor=RGB(168, 222, 255))  # disabled

# ---- group: Display
preview_15 = CustomPreview(Geometry=pipe_5, Material=swatch_17)  # disabled

# ----
pipe_8 = Pipe(Curve=intcrv_3.Curve, Radius=num_65, Caps=0)  # disabled
pipe_9 = Pipe(Curve=intcrv_4.Curve, Radius=num_65, Caps=0)  # disabled
cull_11 = CullPattern(List=ln_14, CullPattern=panel_223)  # disabled
viewer_127 = ParamViewer(cull_11)  # disabled
preview_16 = CustomPreview(Geometry=pipe_8, Shader=swatch_18)  # disabled
preview_17 = CustomPreview(Geometry=pipe_9, Shader=swatch_19)  # disabled

# ---- group: Grouping
graft_5 = GraftTree(Tree=cull_9, IncludeEmptyLists=True, IncludeNullItems=True)  # disabled
graft_6 = GraftTree(Tree=cull_10, IncludeEmptyLists=True, IncludeNullItems=True)  # disabled
graft_7 = GraftTree(Tree=cull_11, IncludeEmptyLists=True, IncludeNullItems=True)  # disabled
merge_4 = Merge(Data1=graft_5, Data2=graft_6, Data3=graft_7)  # disabled

# ---- group: Top bars
panel_224 = Panel("""False
True""")  # disabled
cull_12 = CullPattern(List=pt_28, CullPattern=panel_224)  # disabled
flip_14 = FlipMatrix(Data=cull_12)  # disabled
pline_25 = PolyLine(Vertices=cull_12, Closed=False)  # -> flatten(Polyline); disabled
pline_26 = PolyLine(Vertices=flip_14, Closed=False)  # -> flatten(Polyline); disabled

# ---- group: Join grouped points into triangles
join = JoinCurves(Curves=merge_4, Preserve=False)  # disabled

# ---- group: Create surfaces
boundary_3 = BoundarySurfaces(Edges=flatten(join))  # disabled

# ----
swatch_20 = ColourSwatch(SwatchColor=RGB(255, 215, 105))  # disabled
number_slider_21 = Slider(0.034, range=0.01..0.1)  # disabled
number_slider_22 = Slider(0.022, range=0.01..0.1)  # disabled
preview_18 = CustomPreview(Geometry=boundary_3, Material=swatch_20)  # disabled
swatch_21 = ColourSwatch(SwatchColor=RGB(168, 222, 255))  # disabled
swatch_22 = ColourSwatch(SwatchColor=RGB(161, 96, 96))  # disabled
pipe_10 = Pipe(Curve=[pline_25, pline_26], Radius=number_slider_21, Caps=0)  # disabled
pipe_11 = Pipe(Curve=boundary_3, Radius=number_slider_22, Caps=0)  # disabled
preview_19 = CustomPreview(Geometry=pipe_10, Material=swatch_21)  # disabled
preview_20 = CustomPreview(Geometry=pipe_11, Material=swatch_22)  # disabled
