# Grasshopper definition C#ScriptingForGrasshopperSamples_1stEdition_20200318.gh (Grasshopper 1.0.7)

panel = Panel("Points and Vectors")  # disabled
panel_2 = Panel("vector operations")  # disabled
# Point3d structure
# Show the use of constructors, methods, properties and operations
panel_3 = Panel("Chapter 3 RhinoCommon Geometry")
panel_4 = Panel("Angle between vectors")  # disabled
panel_5 = Panel("Chapter 4: Design Algorithms")
# Essential Guide to C# Scripting
# Robert McNeel & Associates, 2020
# All rights reserved under Creative Commons Attribution-Share Alike 3.0 United States License.
# To enable any of the solutions:
# Please select the components you want to activate then go to Solution>Enable Selected
# Input parameters
panel_6 = Panel("Chapter 1: GH C# component")
# Point3d distance method
number_slider = Slider(19.63, range=0..100)  # disabled
number_slider_2 = Slider(51.27, range=0..100)  # disabled
number_slider_3 = Slider(79.63, range=0..100)  # disabled

# ---- group: Create a circle
# Use different strucutres from the Rhino.Geometry namespace
c_script = CSharpScript()  # -> out, A, B; disabled
# ---------- c_script: C# ----------
    //Generate a random radius of a circle
    Random rand = new Random();
    double radius = rand.Next(10, 20);
    //Create xy_plane using the Plane static function WorldXY
    Plane plane = Plane.WorldXY;
    //Set plane origin to (4,1,0)
    Point3d center = new Point3d(2, 1, 0);
    plane.Origin = center;
    //Create a circle from plane and radius
    Circle circle = new Circle(plane, radius);

    A = circle;
    B = center;
# ---------- end c_script ----------

# ---- group: move vector
# Point3d ArePointsCoplanar static method
panel_7 = Panel("4,5,6")  # disabled

# ----
panel_8 = Panel("1 to 100")  # disabled

# ---- group: other point
# Point3d transform method
panel_9 = Panel("1,2,0")  # disabled

# ---- group: point 1
# Use the "+" operator
panel_10 = Panel("1,2,3")  # disabled

# ---- group: point 2
panel_11 = Panel("4,5,6")  # disabled

# ----
# Point3d constructor
number_slider_4 = Slider(19.63, range=0..100)  # disabled
number_slider_5 = Slider(51.27, range=0..100)  # disabled
# Point3d properties to set and get X, Y and Z
number_slider_6 = Slider(79.63, range=0..100)  # disabled
# Conway Game of Life
number_slider_7 = Slider(16, range=2..40)  # disabled

# ---- group: vector
panel_12 = Panel("3")  # disabled
panel_13 = Panel("2")  # disabled
panel_14 = Panel("1.5")  # disabled
vec = VectorXYZ(XComponent=panel_12, YComponent=panel_13, ZComponent=panel_14)  # -> Vector, Length; disabled

# ---- group: X
panel_15 = Panel("2.1")  # disabled

# ---- group: Y
panel_16 = Panel("3.1")  # disabled

# ---- group: Z
# The use of "Point3d.origin" static method
panel_17 = Panel("4.1")  # disabled

# ----
panel_18 = Panel("1.5")  # disabled
panel_19 = Panel("1.5")  # disabled
panel_20 = Panel("1.5")  # disabled
panel_21 = Panel("6")  # disabled
panel_22 = Panel("6")  # disabled
panel_23 = Panel("6")  # disabled
panel_24 = Panel("6")  # disabled

# ---- group: get origin point
c_script_2 = CSharpScript()  # -> out, Origin; disabled
# ---------- c_script_2: C# usings ----------
using System.IO;
using System.Linq;
using System.Data;
using System.Drawing;
using System.Reflection;
using System.Windows.Forms;
using System.Xml;
using System.Xml.Linq;
using System.Runtime.InteropServices;

using Rhino.DocObjects;
using Rhino.Collections;
using GH_IO;
using GH_IO.Serialization;
# ---------- c_script_2: C# ----------
    Origin = Point3d.Origin;
# ---------- end c_script_2 ----------

# ---- group: point
pt = Point(Point(4, 5, 0))  # disabled

# ----
panel_25 = Panel("Sine wave geometry")  # disabled
number_slider_8 = Slider(16, range=4..16)  # disabled
number_slider_9 = Slider(16, range=12..36)  # disabled
panel_26 = Panel("Subdivision mesh")  # disabled
number_slider_10 = Slider(0.17, range=0..1)  # disabled

# ---- group: list of input points
panel_27 = Panel("""4,5,6
1,1,6
0,0,6""")  # disabled

# ---- group: tolerance
panel_28 = Panel("0.01")  # disabled

# ---- group: X input
panel_29 = Panel("19")  # disabled

# ---- group: Y and Z input
panel_30 = Panel("0")  # disabled

# ---- group: input point
pt_2 = Point(Point(13, 0, 4))  # disabled

# ----
# De Casteljau algorithm to evaluate a parameter on a Bezier curve
number_slider_11 = Slider(16, range=5..20)  # disabled
number_slider_12 = Slider(3, range=0..10)  # disabled
circle = Circle(c_script.A)  # disabled
pt_3 = Point(c_script.B)  # disabled
seed = Slider(15, range=2..20)  # disabled

# ---- group: v0
vec_2 = Vector(Vector(9.631814031, 0, 0))  # disabled

# ---- group: v1
vec_3 = Vector(Vector(0, 9.932808219, 0))  # disabled

# ----
# Item access of a tree (one item at a time)
crv = Curve([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])  # disabled
panel_31 = Panel("2")  # disabled
crv_2 = Curve([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])  # disabled
panel_32 = Panel("2")  # disabled
crv_3 = Curve([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])  # disabled
panel_33 = Panel("2")  # disabled
random = Random(Range=panel_8, Number=panel_21, Seed=2)  # disabled
series = Series(Start=panel_18, Step=panel_18, Count=panel_22)  # disabled
series_2 = Series(Start=panel_19, Step=panel_19, Count=panel_23)  # disabled
series_3 = Series(Start=panel_20, Step=panel_20, Count=panel_24)  # disabled
panel_34 = Panel("Data access")  # disabled
panel_35 = Panel("Item access")  # disabled

# ---- group: Vector operations
c_script_3 = CSharpScript()  # -> out, Pt0, Pt1, Vec0, Vec1, AddVec, SubtractVec, DotVec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; disabled
# ---------- c_script_3: C# ----------
    //Create a New instance Of a point And a vector:
    Point3d p0 = new Point3d(3, 6, 0);
    Vector3d v0 = new Vector3d(4, 1.5, 0);
    double factor = 0.5;

    //Move a point by a vector:
    Point3d p1 = new Point3d(Point3d.Unset);
    p1 = p0 + v0;

    //Distance between 2 points:
    double distance = 0;
    distance = p0.DistanceTo(p1);

    //Point subtraction(create vector between two points):
    Vector3d v1 = new Vector3d(Vector3d.Unset);
    v1 = Point3d.Origin - p0;

    //Vector addition (create average vector):
    Vector3d addVectors = new Vector3d(Vector3d.Unset);
    addVectors = v0 + v1;

    //Vector subtraction:
    Vector3d subVectors = new Vector3d(Vector3d.Unset);
    subVectors = v0 - v1;

    //Vector dot product (if result Is positive number then vectors are In the same direction):
    double dot = 0;
    dot = v0 * v1;

    //Vector cross product (result is a vector normal to the 2 input vectors)
    Vector3d corss = new Vector3d(Vector3d.Unset);
    corss = Vector3d.CrossProduct(v0, v1);

    //Scale a vector:
    Vector3d scaleV0 = new Vector3d(Vector3d.Unset);
    scaleV0 = factor * v0;

    //Get vector length:
    double v0Length = v0.Length;

    //Assign output
    Pt0 = p0;
    Pt1 = p1;
    Vec0 = v0;
    Vec1 = v1;
    AddVec = addVectors;
    SubtractVec = subVectors;
    DotVec = dot;
    CrossVec = corss;
    ScaleVec0 = scaleV0;
    LengthVec0 = v0Length;
# ---------- end c_script_3 ----------

# ---- group: Create an arc
c_script_4 = CSharpScript(circle=c_script.A)  # -> out, A; disabled
# ---------- c_script_4: C# ----------
    //Create an arc from circle and interval
    Interval angleInterval = new Interval(0, Math.PI);
    Arc arc = new Arc(circle, angleInterval);

    A = arc;
# ---------- end c_script_4 ----------

# ---- group: input point
panel_36 = Panel("1,2,3")  # disabled

# ----
move = Move(Motion=panel_7)  # -> Geometry, Transform; disabled

# ---- group: geometry
geo = Geometry()  # disabled

# ---- group: vector
vec_4 = Vector(pt)  # disabled

# ----
panel_37 = Panel(pt)  # disabled
# Output string for compile error messages,
# debugging and print messages
# Output parameters,
# or the script return value(s)
c_script_5 = CSharpScript()  # -> Out, A
panel_38 = Panel(c_script_2.Origin)  # disabled
divide = DivideCurve(Curve=crv, Count=panel_31, Kinks=False)  # -> Points, Tangents, Parameters; disabled
divide_2 = DivideCurve(Curve=crv_2, Count=panel_32, Kinks=False)  # -> Points, Tangents, Parameters; disabled
divide_3 = DivideCurve(Curve=crv_3, Count=panel_33, Kinks=False)  # -> Points, Tangents, Parameters; disabled
pt_4 = Point(Point(-107, -2, 0))  # disabled
pt_5 = Point(Point(-107, 27.93411096, 0))  # disabled
pt_6 = Point(Point(-66.91869209, 22.64406509, 0))  # disabled
pt_7 = Point(Point(-47.87050772, -2, 0))  # disabled
pt_8 = Point(Point(-107, -2, 0))  # disabled
pt_9 = Point(Point(-107, 27.93411096, 0))  # disabled
pt_10 = Point(Point(-66.91869209, 22.64406509, 0))  # disabled
pt_11 = Point(Point(-47.87050772, -2, 0))  # disabled
c_script_6 = CSharpScript(pts=panel_27, tol=panel_28)  # -> out, IsCoplanar; inputs pts: list of Point3d, tol: Double; disabled
# ---------- c_script_6: C# ----------
    //Test if the list of input points are co-planar
    bool coplanar = Point3d.ArePointsCoplanar(pts, tol);

    //Assign the co-planar test to output
    IsCoplanar = coplanar;
# ---------- end c_script_6 ----------

# ---- group: add two points
c_script_7 = CSharpScript(pt1=panel_10, pt2=panel_11)  # -> out, Point; inputs pt1: Point3d, pt2: Point3d; disabled
# ---------- c_script_7: C# ----------
    //Add 2 points and assign result to output
    Point = pt1 + pt2;
# ---------- end c_script_7 ----------

# ----
S = Surface(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)  # disabled

# ---- group: Get point coordinates
c_script_8 = CSharpScript(pt=pt_2)  # -> out, A, B, C; inputs pt: Point3d; disabled
# ---------- c_script_8: C# ----------
    //Assign the point coordinates to output
    A = pt.X;
    B = pt.Y;
    C = pt.Z;
# ---------- end c_script_8 ----------

# ----
srf = Surface(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)  # disabled
crv_4 = Curve(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)  # disabled

# ---- group: Strucutres are passed by value
c_script_9 = CSharpScript(x=panel_29, y=panel_30, z=panel_30)  # -> out, Point; inputs x: Double, y: Double, z: Double; disabled
# ---------- c_script_9: C# ----------
    Point3d pt = new Point3d(x, y, z);
    Print("pt.X before ChaneX: " + pt.X);

    //Call a function to change the value of X in the point
    ChangeX(pt);

    Print("pt.X after ChaneX: x=" + pt.X);

    Point = pt;
# ---------- c_script_9: C# additional code ----------
  public void ChangeX(Point3d pt)
  {
    pt.X = 100;
    Print("pt.X inside ChaneX: x=" + pt.X);
  }
# ---------- end c_script_9 ----------

# ---- group: Set point coordinates
c_script_10 = CSharpScript(x=panel_15, y=panel_16, z=panel_17)  # -> out, Point; inputs x: Double, y: Double, z: Double; disabled
# ---------- c_script_10: C# ----------
    //Declare a new point
    Point3d new_pt = new Point3d(Point3d.Unset);

    //Set "new_pt" coordinates
    new_pt.X = x;
    new_pt.Y = y;
    new_pt.Z = z;

    //Assign the point coordinates to output
    Point = new_pt;
# ---------- end c_script_10 ----------

# ---- group: Calculate angle
c_script_11 = CSharpScript(v0=vec_2, v1=vec_3)  # -> out, A; inputs v0: Vector3d, v1: Vector3d; disabled
# ---------- c_script_11: C# ----------
    //Check input
    if(v0.IsZero || v1.IsZero)
    {
      Print("Invalid input");
      return;
    }
    // Unitize the input vectors
    v0.Unitize();
    v1.Unitize();
    double dot = v0 * v1;
    Print("v0 dot v1 = " + dot);
    // Force the dot product of the two input vectors to
    // fall within the domain for inverse cosine, which
    // is -1 <= x <= 1. This will prevent runtime
    // "domain error" math exceptions.
    if ((dot < -1.0))
      dot = -1.0;
    if ((dot > 1.0))
      dot = 1.0;
    A = System.Math.Acos(dot);
# ---------- end c_script_11 ----------

# ----
int = Integer(random)  # disabled
panel_39 = Panel("0,0,0")  # disabled
panel_40 = Panel(series_2)  # disabled
panel_41 = Panel(series_3)  # disabled
panel_42 = Panel(series)  # disabled

# ---- group: Create a tree of numbers
# Costruct and traverse the tree
c_script_12 = CSharpScript()  # -> out, Numbers; disabled
# ---------- c_script_12: C# ----------
    DataTree<double> numTree = new DataTree<double>();
    int pathIndex = 0;
    for (int b = 0; b <= 1; b++) {
      List<double> numList = new List<double>();
      GH_Path path = new GH_Path(pathIndex);
      pathIndex = pathIndex + 1;
      for (int i = 0; i <= 2; i++) {
        numList.Add(10);
      }
      numTree.AddRange(numList, path);
    }
    Numbers = numTree;
# ---------- end c_script_12 ----------

# ----
num = Number(c_script_12.Numbers)  # disabled

# ---- group: Find the sum of numbers in the tree
c_script_13 = CSharpScript(x=num)  # -> out, Sum; inputs x: tree of Double; disabled
# ---------- c_script_13: C# ----------
    double xSum = 0;
    foreach (List<double> branch in x.Branches)
    {
      foreach (double num in branch)
      {
        xSum = xSum + num;
      }
    }
    Sum = xSum;
# ---------- end c_script_13 ----------

# ---- group: display vectors
vdis = VectorDisplay(Anchor=Point(0, 0, 0), Vector=vec_2)  # disabled
vdis_2 = VectorDisplay(Anchor=Point(0, 0, 0), Vector=vec_3)  # disabled

# ----
panel_43 = Panel(num)  # disabled
c_script_14 = CSharpScript(x=number_slider, y=number_slider_2, z=number_slider_3, other=panel_9)  # -> out, Point, Distance; inputs x: Double, y: Double, z: Double, other: Point3d; disabled
# ---------- c_script_14: C# ----------
    //Create an instance of a point and initialize to x, y and z
    Point3d pt = new Point3d(x, y, z);

    //Declare a distance variable and initialize to "0"
    double dis = 0;

    //Calculate the distance from "pt" to the "other" input point
    dis = pt.DistanceTo(other);

    //Assign the point "pt" to the A output
    Point = pt;

    //Assign the distance to the B output
    Distance = dis;
# ---------- end c_script_14 ----------
c_script_15 = CSharpScript(x=number_slider_4, y=number_slider_5, z=number_slider_6)  # -> out, Point; inputs x: Double, y: Double, z: Double; disabled
# ---------- c_script_15: C# ----------
    //Create an instance of a point and initialize to x, y and z
    Point3d pt = new Point3d(x, y, z);

    //Assign the point "pt" to output
    Point = pt;
# ---------- end c_script_15 ----------
crv_5 = Curve(c_script_4.A)  # disabled
c_script_16 = CSharpScript(pt=panel_36, xform=move.Transform)  # -> out, Point; inputs pt: Point3d, xform: Transform; disabled
# ---------- c_script_16: C# ----------
    //Create an instance of a point and initialize to input point
    Point3d newPt = new Point3d(pt);

    //Transform the point
    newPt.Transform(xform);

    //Assign the point "new_pt" to the A output
    Point = newPt;
# ---------- end c_script_16 ----------

# ---- group: moved geometry
move_2 = Move(Geometry=geo, Motion=vec.Vector)  # -> Geometry, Transform; disabled

# ---- group: create sine wave geometry
c_script_17 = CSharpScript(num=number_slider_11)  # -> out, OutCurves, OutSurface, OutLoft; inputs num: Int32; disabled
# ---------- c_script_17: C# ----------
    //list of all points
    List<Point3d> allPoints = new List<Point3d>();
    //list of curves
    List<Curve> curves = new List<Curve>();

    for(int y = 0; y < num; y++)
    {
      //curve points
      List<Point3d> crvPoints = new List<Point3d>();
      for(int x = 0; x < num; x++)
      {
        double z = Math.Sin(Math.PI / 180 + (x + y));
        Point3d pt = new Point3d(x, y, z);
        crvPoints.Add(pt);
        allPoints.Add(pt);
      }
      //create a degree 3 curve from control points
      Curve crv = Curve.CreateControlPointCurve(crvPoints, 3);
      curves.Add(crv);
    }
    //create a nurbs surface from control points
    NurbsSurface srf = NurbsSurface.CreateFromPoints(allPoints, num, num, 3, 3);

    //create a loft brep from curves
    Brep[ ] breps = Brep.CreateFromLoft(curves, Point3d.Unset, Point3d.Unset, LoftType.Tight, false);

    //Assign output
    OutCurves = curves;
    OutSurface = srf;
    OutLoft = breps;
# ---------- end c_script_17 ----------

# ---- group: Process the whole list (add 10)
c_script_18 = CSharpScript(xList=series_2)  # -> out, A; inputs xList: list of Double; disabled
# ---------- c_script_18: C# ----------
    List<double> newList = new List<double>();
    foreach( var x in xList)
      newList.Add(x + 10);
    Print("Run# " + Iteration);
    A = newList;
# ---------- end c_script_18 ----------

# ----
c_script_19 = CSharpScript(pt=divide.Points)  # -> out, Sphere; inputs pt: Point3d; disabled
# ---------- c_script_19: C# ----------
    Sphere ptSphere = new Sphere(pt, 0.5);
    Print("Run# " + Iteration);
    Sphere = ptSphere;
# ---------- end c_script_19 ----------
c_script_20 = CSharpScript(ptList=divide_2.Points)  # -> out, Spheres; inputs ptList: list of Point3d; disabled
# ---------- c_script_20: C# ----------
    List<Sphere> sphereList = new List<Sphere>();
    foreach (Point3d pt in ptList) {
      Sphere sphere = new Sphere(pt, 0.5);
      sphereList.Add(sphere);
    }
    Print("Run# " + Iteration);
    Spheres = sphereList;
# ---------- end c_script_20 ----------
c_script_21 = CSharpScript(ptTree=divide_3.Points)  # -> out, Spheres; inputs ptTree: tree of Point3d; disabled
# ---------- c_script_21: C# ----------
    //Declare a tree of spheres
    DataTree<Sphere> sphereTree = new DataTree<Sphere>();
    int pathIndex = 0;
    foreach (List<Point3d> branch in ptTree.Branches) {
      List<Sphere> sphereList = new List<Sphere>();
      GH_Path path = new GH_Path(pathIndex);
      pathIndex = pathIndex + 1;
      foreach (Point3d pt in branch)
      {
        Sphere sphere = new Sphere(pt, 0.5);
        sphereList.Add(sphere);
      }
      sphereTree.AddRange(sphereList, path);
    }
    Print("Run #" + Iteration);
    Spheres = sphereTree;
# ---------- end c_script_21 ----------

# ---- group: Process the whole list to calculate the sum
c_script_22 = CSharpScript(xList=series_3)  # -> out, Sum; inputs xList: list of Double; disabled
# ---------- c_script_22: C# ----------
    double xSum = 0;
    foreach( var x in xList)
      xSum = xSum + x;
    Print("Run# " + Iteration);
    Sum = xSum;
# ---------- end c_script_22 ----------

# ---- group: display the vector
vdis_3 = VectorDisplay(Anchor=Point(-10, -7, 0), Vector=vec.Vector)  # disabled

# ---- group: Subdiving a surface
c_script_23 = CSharpScript(srf=srf, inPolylines=crv_4, degree=number_slider_12)  # -> out, OutPolylines, OutMesh; inputs srf: Surface, inPolylines: list of Polyline, degree: Int32; disabled
# ---------- c_script_23: C# ----------
    //create a collection of all panels
    List<Polyline> outPanels = new List<Polyline>();

    //limit the degree to 6
    if( degree > 6)
      degree = 6;

    for(int i = 0; i < degree; i++)
    {
      //outer polylines
      List<Polyline> plines = new List<Polyline>();

      //mid polylines
      List<Polyline> midPlines = new List<Polyline>();

      //generate subdivided panels
      bool result = SubPanelOnSurface(srf, inPolylines.ToArray(), ref plines, ref midPlines);
      if( result == false)
        break;
      //add outer panels
      outPanels.AddRange(plines);

      //add mid panels only in the last iteration
      if(i == degree - 1) //add mid panels
        outPanels.AddRange(midPlines);
      else //subdivide mid panels only
        inPolylines = midPlines;
    }

    //Create a mesh from all polylines
    Mesh joinedMesh = new Mesh();
    for(int i = 0; i < outPanels.Count; i++)
    {
      var mesh = Mesh.CreateFromClosedPolyline(outPanels[i]);
      joinedMesh.Append(mesh);
    }
    //make sure all mesh faces normals are in the same general direction
    joinedMesh.UnifyNormals();

    //Assign output
    OutPolylines = outPanels;
    OutMesh = joinedMesh;
# ---------- c_script_23: C# additional code ----------
  public bool SubPanelOnSurface(
    Surface srf,
    Polyline[] inputPanels,
    ref List<Polyline> outPanels,
    ref List<Polyline> midPanels)
  {
    //check for a valid input
    if (inputPanels.Length == 0 || null == srf)
      return false;

    for (int i = 0; i < inputPanels.Length; i++)
    {
      Polyline ipline = inputPanels[i];
      if (!ipline.IsValid || !ipline.IsClosed)
        continue;

      //stack of points
      List<Point3d> stack = new List<Point3d>();
      Polyline newPline = new Polyline();
      for (int j = 1; j < ipline.Count; j++)
      {
        Line line = new Line(ipline[j - 1], ipline[j]);
        if (line.IsValid)
        {
          Point3d mid = line.PointAt(0.5);
          double s, t;
          srf.ClosestPoint(mid, out s, out t);
          mid = srf.PointAt(s, t);
          newPline.Add(mid);

          stack.Add(ipline[j - 1]);
          stack.Add(mid);
        }
      }
      //add the first 2 point to close last triangle
      stack.Add(stack[0]);
      stack.Add(stack[1]);

      //close
      newPline.Add(newPline[0]);
      midPanels.Add(newPline);

      for (int j = 2; j < stack.Count; j = j + 1)
      {
        Polyline p = new Polyline { stack[j - 2], stack[j - 1], stack[j], stack[j - 2] };

        outPanels.Add(p);
      }
    }

    return true;
  }
# ---------- end c_script_23 ----------

# ---- group: Process one item at a time (add 10)
c_script_24 = CSharpScript(x=series)  # -> out, A; inputs x: Double; disabled
# ---------- c_script_24: C# ----------
    A = x + 10;
    Print("Run# " + Iteration);
# ---------- end c_script_24 ----------

# ---- group: generate grid of points and random state for each point
c_script_25 = CSharpScript(srf=S, uNum=number_slider_8, vNum=number_slider_9, seed=seed)  # -> out, PointGrid, StateGrid; inputs srf: Surface, uNum: Int32, vNum: Int32, seed: Int32; disabled
# ---------- c_script_25: C# ----------
    if(uNum < 2)
      uNum = 2;
    if(vNum < 2)
      vNum = 2;

    double uStep = srf.Domain(0).Length / uNum;
    double vStep = srf.Domain(1).Length / vNum;
    double uMin = srf.Domain(0).Min;
    double vMin = srf.Domain(1).Min;

    //create a grid of points and a grid of states
    DataTree<Point3d> pointsTree = new DataTree<Point3d>();
    DataTree<int> statesTree = new DataTree<int>();
    int pathIndex = 0;
    Random rand = new Random(seed);
    for (int i = 0; i <= uNum; i++)
    {
      List<Point3d> ptList = new List<Point3d>();
      List<int> stateList = new List<int>();
      GH_Path path = new GH_Path(pathIndex);
      pathIndex = pathIndex + 1;
      for (int j = 0; j <= vNum; j++)
      {
        Point3d srfPt = srf.PointAt(uMin + i * uStep, vMin + j * vStep);
        ptList.Add(srfPt);
        int randState = rand.Next(0, 2);
        stateList.Add(randState);
      }
      pointsTree.AddRange(ptList, path);
      statesTree.AddRange(stateList, path);
    }

    PointGrid = pointsTree;
    StateGrid = statesTree;
# ---------- end c_script_25 ----------

# ---- group: De Casteljau algorithm to evaluate a Bezier curve
c_script_26 = CSharpScript(pt0=pt_4, pt1=pt_5, pt2=pt_6, pt3=pt_7, t=number_slider_10)  # -> out, BezierCrv, EvalPt; inputs pt0: Point3d, pt1: Point3d, pt2: Point3d, pt3: Point3d, t: Double; disabled
# ---------- c_script_26: C# ----------
    List<Point3d> points = new List<Point3d>();
    points.Add(pt0);
    points.Add(pt1);
    points.Add(pt2);
    points.Add(pt3);

    Point3d pt = Point3d.Unset;
    EvalPoint(points, t, ref pt);

    if(pt.IsValid)
      EvalPt = pt;

    BezierCurve crv = new BezierCurve(points);
    BezierCrv = crv.ToNurbsCurve();
# ---------- c_script_26: C# additional code ----------
  void EvalPoint(List<Point3d> points, double t, ref Point3d evalPt)
  {
    if(points.Count < 2)
      return;

    List<Point3d> tPoints = new List<Point3d>();
    for(int i = 1; i < points.Count; i++)
    {
      Line line = new Line(points[i - 1], points[i]);
      Point3d pt = line.PointAt(t);
      tPoints.Add(pt);
    }

    if(tPoints.Count == 1)
      evalPt = tPoints[0];

    EvalPoint(tPoints, t, ref evalPt);

  }
# ---------- end c_script_26 ----------

# ---- group: De Casteljau algorithm to interpolate a Bezier curve
c_script_27 = CSharpScript(pt0=pt_8, pt1=pt_9, pt2=pt_10, pt3=pt_11, segments=number_slider_7)  # -> out, BezierCrv; inputs pt0: Point3d, pt1: Point3d, pt2: Point3d, pt3: Point3d, segments: Int32; disabled
# ---------- c_script_27: C# ----------
    if(segments < 2)
      segments = 2;

    List<Point3d> bezierPts = new List<Point3d>();
    bezierPts.Add(pt0);
    bezierPts.Add(pt1);
    bezierPts.Add(pt2);
    bezierPts.Add(pt3);

    List<Point3d> evalPts = new List<Point3d>();
    double step = 1 / (double) segments;
    for(int i = 0; i <= segments; i++)
    {
      double t = i * step;
      Point3d pt = Point3d.Unset;
      EvalPoint(bezierPts, t, ref pt);

      if(pt.IsValid)
        evalPts.Add(pt);
    }

    Polyline pline = new Polyline(evalPts);
    BezierCrv = pline;
# ---------- c_script_27: C# additional code ----------
  void EvalPoint(List<Point3d> points, double t, ref Point3d evalPt)
  {
    if(points.Count < 2)
      return;

    List<Point3d> tPoints = new List<Point3d>();
    for(int i = 1; i < points.Count; i++)
    {
      Line line = new Line(points[i - 1], points[i]);
      Point3d pt = line.PointAt(t);
      tPoints.Add(pt);
    }

    if(tPoints.Count == 1)
      evalPt = tPoints[0];

    EvalPoint(tPoints, t, ref evalPt);

  }
# ---------- end c_script_27 ----------

# ---- group: Test if a number is even
c_script_28 = CSharpScript(num=int)  # -> out, IsEven; inputs num: Int32; disabled
# ---------- c_script_28: C# ----------
    int mod = num % 2;
    IsEven = (mod == 0 ? true : false);
# ---------- end c_script_28 ----------

# ----
panel_44 = Panel(int)  # disabled

# ---- group: Create vertical lines at ends
c_script_29 = CSharpScript(arc=c_script_4.A)  # -> out, P1, P2, L1, L2; disabled
# ---------- c_script_29: C# ----------
    //Extract end points
    Point3d start_pt = arc.StartPoint;
    Point3d end_pt = arc.EndPoint;

    //Create a vertical vector with length = 10
    Vector3d vec = Vector3d.ZAxis;
    //Use the multiplication operation to scale the vector
    vec = vec * 10;

    //Create start and end lines
    Line line_1 = new Line(start_pt, vec);
    Line line_2 = new Line(end_pt, vec);

    //Assign output
    P1 = start_pt;
    P2 = end_pt;
    L1 = line_1;
    L2 = line_2;
# ---------- end c_script_29 ----------

# ---- group: p0
pt_12 = Point(c_script_3.Pt0)  # disabled

# ---- group: p1
pt_13 = Point(c_script_3.Pt1)  # disabled

# ----
panel_45 = Panel(c_script_13.Sum)  # disabled
viewer = ParamViewer(c_script_13.Sum)  # disabled

# ---- group: pt1+pt2
panel_46 = Panel(c_script_7.Point)  # disabled

# ---- group: display the vector
vdis_4 = VectorDisplay(Anchor=panel_39, Vector=vec_4)  # disabled

# ----
panel_47 = Panel(c_script_6.IsCoplanar)  # disabled
panel_48 = Panel(c_script_11.out)  # disabled
deg = Degrees(Radians=c_script_11.A)  # disabled
panel_49 = Panel(c_script_11.A)  # disabled

# ---- group: X
panel_50 = Panel(c_script_8.A)  # disabled

# ---- group: Y
panel_51 = Panel(c_script_8.B)  # disabled

# ---- group: Z
panel_52 = Panel(c_script_8.C)  # disabled

# ---- group: point set to input X, Y and Z
panel_53 = Panel(c_script_10.Point)  # disabled

# ----
viewer_2 = ParamViewer(c_script_12.Numbers)  # disabled
panel_54 = Panel(c_script_15.Point)  # disabled

# ---- group: Changes inside the function does not affect original data
panel_55 = Panel(c_script_9.out)  # disabled

# ----
panel_56 = Panel(c_script_9.Point)  # disabled
viewer_3 = ParamViewer(divide_2.Points)  # disabled
panel_57 = Panel(c_script_14.Point)  # disabled
panel_58 = Panel(c_script_14.Distance)  # disabled
panel_59 = Panel(c_script_24.A)  # disabled
panel_60 = Panel(c_script_18.A)  # disabled
viewer_4 = ParamViewer(divide.Points)  # disabled
panel_61 = Panel(c_script_22.Sum)  # disabled
viewer_5 = ParamViewer(c_script_20.Spheres)  # disabled

# ---- group: transformed point
panel_62 = Panel(c_script_16.Point)  # disabled

# ----
viewer_6 = ParamViewer(c_script_19.Sphere)  # disabled
viewer_7 = ParamViewer(divide_3.Points)  # disabled
panel_63 = Panel(deg)  # disabled
panel_64 = Panel(c_script_28.IsEven)  # disabled
viewer_8 = ParamViewer(c_script_21.Spheres)  # disabled
panel_65 = Panel(c_script_20.out)  # disabled
number_slider_13 = Slider(8, range=1..20)  # disabled
panel_66 = Panel(c_script_19.out)  # disabled
panel_67 = Panel(c_script_21.out)  # disabled

# ---- group: Run the script 6 times
panel_68 = Panel(c_script_24.out)  # disabled

# ---- group: Run the script once
panel_69 = Panel(c_script_18.out)  # disabled

# ---- group: The script runs once
panel_70 = Panel(c_script_22.out)  # disabled

# ---- group: Create vertical lines at ends
c_script_30 = CSharpScript(line1=c_script_29.L1, line2=c_script_29.L2)  # -> out, C, S, SC; inputs line1: Line, line2: Line; disabled
# ---------- c_script_30: C# ----------
    //Create a cyliner at line1 with radius = 1/4 the length
    double height = line1.Length;
    double radius = height / 4;
    Circle c_circle = new Circle(line1.From, radius);
    Cylinder cylinder = new Cylinder(c_circle, height);

    //Create a sphere at the center of line2 with radius = 1/4 the length
    Point3d s_center = line2.PointAt(0.5);
    Sphere sphere = new Sphere(s_center, radius);

    //Assign output
    C = cylinder;
    S = sphere;
    SC = s_center;
# ---------- end c_script_30 ----------

# ----
panel_71 = Panel(c_script_12.Numbers)  # disabled
crv_6 = Curve(c_script_23.OutPolylines)  # disabled
mesh = Mesh(c_script_23.OutMesh)  # disabled
crv_7 = Curve(c_script_17.OutCurves)  # disabled
srf_2 = Surface(c_script_17.OutSurface)  # disabled
brep = Brep(c_script_17.OutLoft)  # disabled

# ---- group: display v0
vdis_5 = VectorDisplay(Anchor=c_script_3.Pt0, Vector=c_script_3.Vec0)  # disabled

# ---- group: display v1
vdis_6 = VectorDisplay(Anchor=pt_12, Vector=c_script_3.Vec1)  # disabled

# ---- group: display v0 + v1
vdis_7 = VectorDisplay(Anchor=pt_12, Vector=c_script_3.AddVec)  # disabled

# ---- group: display v0 - v1
vdis_8 = VectorDisplay(Anchor=Point(0, 0, 0), Vector=c_script_3.SubtractVec)  # disabled

# ---- group: V0 Dot V1
panel_72 = Panel(c_script_3.DotVec)  # disabled

# ---- group: display v0xv1
vdis_9 = VectorDisplay(Anchor=pt_12, Vector=c_script_3.CrossVec)  # disabled

# ---- group: scale v0
vdis_10 = VectorDisplay(Anchor=pt_12, Vector=c_script_3.ScaleVec0)  # disabled

# ---- group: Length of V0
panel_73 = Panel(c_script_3.LengthVec0)  # disabled

# ----
swatch = ColourSwatch(SwatchColor=RGBA(255, 39, 0, 224))  # disabled
sph = Sphere(Base=c_script_25.PointGrid, Radius=0.2)  # disabled
preview = CustomPreview(Geometry=sph, Material=swatch)  # disabled

# ---- group: GameOfLife engin
c_script_31 = CSharpScript(grid=c_script_25.StateGrid, gen=number_slider_13)  # -> out, OutGrid; inputs grid: tree of Int32, gen: Int32; disabled
# ---------- c_script_31: C# ----------
    //Get state at the defined generation
    for(int i = 0; i < gen; i++)
      grid = NewGeneration(grid);

    OutGrid = grid;
# ---------- c_script_31: C# additional code ----------
  // Run a generaion in the game of life
  // Edge condition periodic
  public DataTree<int> NewGeneration(DataTree<int> inStates)
  {
    int i, j, c, nc;
    List<int> prvBranch;
    List<int> nxtBranch;
    List<int> branch;
    DataTree<int> states = new DataTree<int>();
    states = inStates;

    for (i = 0; i <= states.Branches.Count - 1; i++)
    {
      branch = states.Branches[i];
      for (j = 0; j <= branch.Count - 1; j++)
      {
        c = branch[j];
        nc = 0;

        // Check neighbouring states
        // next
        nc = nc + branch[(j + 1 + branch.Count) % branch.Count];
        // prv
        nc = nc + branch[(j - 1 + branch.Count) % branch.Count];

        // top
        nxtBranch = states.Branches[(i + 1 + states.Branches.Count) % states.Branches.Count];
        nc = nc + nxtBranch[(j + 1 + nxtBranch.Count) % nxtBranch.Count];
        nc = nc + nxtBranch[(j + nxtBranch.Count) % nxtBranch.Count];
        nc = nc + nxtBranch[(j - 1 + nxtBranch.Count) % nxtBranch.Count];

        // bottom
        prvBranch = states.Branches[(i - 1 + states.Branches.Count) % states.Branches.Count];
        nc = nc + prvBranch[(j + 1 + prvBranch.Count) % prvBranch.Count];
        nc = nc + prvBranch[(j + prvBranch.Count) % prvBranch.Count];
        nc = nc + prvBranch[(j - 1 + prvBranch.Count) % prvBranch.Count];

        // set the new state
        if (c == 1)
        {
          if (nc < 2 | nc > 3)
            c = 0;
        }
        else if (c == 0)
        {
          if (nc == 3)
            c = 1;
        }
        branch[j] = c;
      }
    }
    return states;
  }
# ---------- end c_script_31 ----------

# ---- group: degree
number_slider_14 = Slider(3, range=0..10)  # disabled

# ----
panel_74 = Panel("Chapter 2 C# Programming basics")

# ---- group: input points
pt_14 = Point([Point(15.23135224, 0.4425926866, 0), Point(18.31028626, 17.54778169, 0), Point(4.112979386, 32.9424518, 0), Point(15.06030035, 33.45560747, 0)])  # disabled

pt_15 = Point(Point(7.29915752, 5.632655062, 0))  # disabled
pt_16 = Point(Point(25.71034725, 10.60865229, 0))  # disabled

# ---- group: points
pt_17 = Point([Point(10, 10, 0), Point(20, 20, 0), Point(30, 10, 0), Point(40, 20, 0), Point(50, 10, 0)])  # disabled

# ---- group: input curve
crv_8 = Curve(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)  # disabled

# ----
panel_75 = Panel("3.14")  # disabled
pt_18 = Point(Point(7, 6, 0))  # disabled
crv_9 = Curve(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)  # disabled
panel_76 = Panel("Arrays")  # disabled

# ---- group: remove points
cull = CullPattern(List=c_script_25.PointGrid, CullPattern=c_script_31.OutGrid)  # disabled

# ---- group: Declare and assign array values in one statement
c_script_32 = CSharpScript()  # -> out, A; disabled
# ---------- c_script_32: C# ----------
    //Declare and initialize the days of the week array
    string[ ] weekdays = {"Sunday","Monday","Tuesday","Wednesday","Thursday","Friday","Saturday"};

    //Assign myArray to the output A
    A = weekdays;
# ---------- end c_script_32 ----------

# ---- group: Declare then assign array values
c_script_33 = CSharpScript()  # -> out, A; disabled
# ---------- c_script_33: C# ----------
    //Declare the days of the week in one statement, then assign the values later
    string[ ] weekdays = new string[7];
    weekdays[0] = "Sunday";
    weekdays[1] = "Monday";
    weekdays[2] = "Tuesday";
    weekdays[3] = "Wednesday";
    weekdays[4] = "Thursday";
    weekdays[5] = "Friday";
    weekdays[6] = "Saturday";

    //Assign myArray to the output A
    A = weekdays;
# ---------- end c_script_33 ----------

# ---- group: ERROR: Do not create a new instance of abstract class
# Instantiating an instance of a "Curve" abstract class creates an error
c_script_34 = CSharpScript()  # -> out, A; disabled
# ---------- c_script_34: C# ----------
    //ERROR: attempt to create an instance of the abstract "Curve" class
      Rhino.Geometry.Curve crv = new Rhino.Geometry.Curve();
# ---------- end c_script_34 ----------

# ---- group: Create polyline curve
c_script_35 = CSharpScript(pts=pt_14)  # -> out, Crv, Type; inputs pts: list of Point3d; disabled
# ---------- c_script_35: C# ----------
    //Declare and create a new instance of a polyline curve from points
    var crv = new Rhino.Geometry.PolylineCurve(pts);

    //Assign curve to A output
    Crv = crv;

    //Assign curve type to B output
    Type = crv.GetType();
# ---------- end c_script_35 ----------

# ---- group: create new LineCurve object
c_script_36 = CSharpScript(p0=pt_15, p1=pt_16)  # -> out, OutLine; inputs p0: Point3d, p1: Point3d; disabled
# ---------- c_script_36: C# ----------
    //Create an instance of a point object and unset
    LineCurve lineCurve = new Rhino.Geometry.LineCurve(p0, p1);
    Print(lineCurve.ToString());

    //assign output
    OutLine = lineCurve;
# ---------- end c_script_36 ----------

# ---- group: create new nurbscurve object
c_script_37 = CSharpScript(points=pt_17, degree=number_slider_14)  # -> out, InterpolateCrv, NurbsCrv; inputs points: list of Point3d, degree: Int32; disabled
# ---------- c_script_37: C# ----------
    //Declare a curve variable
    Rhino.Geometry.Curve interCrv = default(Rhino.Geometry.Curve);
    //Create new instance of a curve from interpolate points
    interCrv = Rhino.Geometry.Curve.CreateInterpolatedCurve(points, degree);

    //Declare a curve variable
    Rhino.Geometry.Curve nurbsCrv = default(Rhino.Geometry.Curve);
    //Create new instance of a curve from control points
    nurbsCrv = Rhino.Geometry.Curve.CreateControlPointCurve(points, degree);


    Rhino.Geometry.Curve crv = Curve.CreateControlPointCurve(points, degree);
    Rhino.Geometry.NurbsCurve nc = crv as Rhino.Geometry.NurbsCurve;

    //Assign output
    InterpolateCrv = interCrv;
    NurbsCrv = nurbsCrv;
# ---------- end c_script_37 ----------

# ---- group: Create curve using offset method
c_script_38 = CSharpScript(crv=crv_8)  # -> out, OffsetCrv; inputs crv: Curve; disabled
# ---------- c_script_38: C# ----------
    Curve[] curves = crv.Offset(Plane.WorldXY, 1.4, 0.01, CurveOffsetCornerStyle.None);
    OffsetCrv = curves;
# ---------- end c_script_38 ----------

# ---- group: navigate Point3d class members using auto-complete
c_script_39 = CSharpScript()  # -> out; disabled
# ---------- c_script_39: C# ----------
    //Create an instance of a point object and initialize to origin (0,0,0)
    Rhino.Geometry.Point3d pt = new Rhino.Geometry.Point3d(0, 0, 0);

    //type "pt." to navigate Point3d members
    //pt.
# ---------- end c_script_39 ----------

# ---- group: set/get Point3d variables
c_script_40 = CSharpScript(x=panel_75)  # -> out, A; inputs x: Double; disabled
# ---------- c_script_40: C# ----------
    //Create an instance of a point object and initialize to origin (0,0,0)
      Point3d pt = new Point3d(0, 0, 0);

      //Get coordinates and print to "output"
      Print("X = " + pt.X);

      //Set the x coordinate to a new value from input
      pt.X = x;

      //Print the new x value
      Print("X = " + pt.X);

      //Get the pt "x" value and assign to output
      A = pt.X;
# ---------- end c_script_40 ----------

# ---- group: Copy data
c_script_41 = CSharpScript(pt=pt_18, crv=crv_9)  # -> out, newCrv; inputs pt: Point3d, crv: Curve; disabled
# ---------- c_script_41: C# ----------
    //Different ways to copy data between objects
    //Use the constructor when you instantiate an instance Of the Point3d class
    Point3d newPt1 = new Point3d(pt);
    Print("new pt1 = " + newPt1.ToString());

    //Use the “= Operator” If the Class provides one
    Point3d newPt2 = new Point3d(Point3d.Unset);
    newPt2 = pt;
    Print("new pt2 = " + newPt2.ToString());

    //Copy the properties one by one
    Point3d newPt3 = new Point3d(Point3d.Unset);
    newPt3.X = pt.X;
    newPt3.Y = pt.Y;
    newPt3.Z = pt.Z;
    Print("new pt3 = " + newPt3.ToString());

    //Some geometry  classes provide “Duplicate” method that Is very efficient to use
    newCrv = crv.DuplicateCurve();
# ---------- end c_script_41 ----------

# ----
panel_77 = Panel(c_script_32.A)  # disabled
panel_78 = Panel(c_script_33.A)  # disabled

swatch_2 = ColourSwatch(SwatchColor=RGBA(45, 38, 255, 224))  # disabled
sph_2 = Sphere(Base=cull, Radius=0.4)  # disabled
preview_2 = CustomPreview(Geometry=sph_2, Material=swatch_2)  # disabled

panel_79 = Panel(c_script_34.out)  # disabled
panel_80 = Panel(c_script_36.out)  # disabled
panel_81 = Panel(c_script_36.OutLine)  # disabled
panel_82 = Panel(c_script_35.Type)  # disabled

# ---- group: Output curve
crv_10 = Curve(c_script_35.Crv)  # disabled

# ----
panel_83 = Panel(c_script_38.OffsetCrv)  # disabled
panel_84 = Panel(c_script_40.out)  # disabled
panel_85 = Panel(c_script_41.out)  # disabled
panel_86 = Panel(c_script_41.newCrv)  # disabled
panel_87 = Panel(c_script_40.A)  # disabled

# ---- group: output interpolate curve
crv_11 = Curve(c_script_37.InterpolateCrv)  # disabled

# ---- group: output nurbs curve
crv_12 = Curve(c_script_37.NurbsCrv)  # disabled

# ----
# L-Sytems Definition - Dragon Curve
panel_88 = Panel("Generative algorithms")  # disabled
panel_89 = Panel("Lists")  # disabled

# ---- group: Variables
# L-Sytems Definition - Fractal Plant
panel_90 = Panel("X, F")  # disabled

# ---- group: Constants
panel_91 = Panel("+ -")  # disabled

# ---- group: Starting string
panel_92 = Panel("X")  # disabled

# ---- group: Rules
panel_93 = Panel("F ->")  # disabled
panel_94 = Panel("X ->")  # disabled
panel_95 = Panel("- ->")  # disabled
panel_97 = Panel("+ ->")  # disabled
panel_98 = Panel("FF")  # disabled
panel_99 = Panel("F-[[X]+X]+F[+FX]-X")  # disabled
panel_100 = Panel("Rotate 30")  # disabled
panel_101 = Panel("Rotate -30")  # disabled
panel_102 = Panel("Draw Forward")  # disabled

# ---- group: Variable
panel_103 = Panel("X, Y, F")  # disabled

# ---- group: Rules
panel_105 = Panel("Y ->")  # disabled
panel_109 = Panel("Rotate 90")  # disabled
panel_110 = Panel("Rotate -90")  # disabled
panel_111 = Panel("X+YF+")  # disabled
panel_112 = Panel("-FX-Y")  # disabled

# ---- group: Starting string
panel_115 = Panel("FX")  # disabled

# ---- group: Declate a new list and add values
c_script_42 = CSharpScript()  # -> out, A; disabled
# ---------- c_script_42: C# ----------
    //Declare a dynamic ordered collection using “List”
    List<string> myWorkDays = new List<string>();

    //Add any number of new elements to the list
    myWorkDays.Add("Tuesday");
    myWorkDays.Add("Wednesday");
    myWorkDays.Add("Thursday");
    myWorkDays.Add("Friday");

    //Assign myArray to output
    A = myWorkDays;
# ---------- end c_script_42 ----------

# ----
panel_116 = Panel(c_script_42.A)  # disabled

# ---- group: input curve
crv_13 = Curve(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)  # disabled

# ---- group: number of segments
number_slider_15 = Slider(6, range=3..20)  # disabled

# ----
number_slider_16 = Slider(0.5, range=0..1)  # disabled
num_2 = Slider(12, range=1..20)  # disabled
panel_117 = Panel("Curve methods")  # disabled
panel_118 = Panel("CURVES")  # disabled
panel_119 = Panel("Create curves")  # disabled
panel_120 = Panel("Lightweight curves")  # disabled

# ---- group: calmped
toggle = BooleanToggle(False)  # disabled

# ----
num_3 = Slider(5, range=1..20)  # disabled
radius = Slider(1.4629, range=0..100)  # disabled
panel_121 = Panel("Conditional statements")  # disabled
panel_122 = Panel("if statement")  # disabled
panel_123 = Panel("if... else... statement")  # disabled
list = ValueList({"0", "1", "2"}, selected="0")  # disabled
list_2 = ValueList({"0", "1", "2", "150"}, selected="1")  # disabled
list_3 = ValueList({"0", "1", "2"}, selected="0")  # disabled
list_4 = ValueList({"-1", "0", "1", "120"}, selected="-1")  # disabled

# ---- group: input surface
srf_3 = Surface(reparameterize(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))  # disabled

# ----
number_slider_17 = Slider(5, range=2..10)  # disabled

# ---- group: control points
pt_19 = Point([Point(17, -3, 0), Point(20, 2, 0), Point(24, -3, 0), Point(29, -2, 0), Point(30, 2, 0)])  # disabled

# ---- group: degree
panel_124 = Panel("3")  # disabled

# ---- group: p0
pt_20 = Point(Point(20, -8, 0))  # disabled

# ---- group: p1
pt_21 = Point(Point(27, -6, 0))  # disabled

# ---- group: p0
pt_22 = Point(Point(20, -8, 0))  # disabled

# ---- group: p1
pt_23 = Point(Point(27, -6, 0))  # disabled

pt_24 = Point(Point(28, -11, 0))  # disabled

# ---- group: points
pt_25 = Point([Point(17, -3, 0), Point(20, 2, 0), Point(24, -3, 0), Point(29, -2, 0), Point(30, 2, 0)])  # disabled

# ---- group: center
pt_26 = Point(Point(20, -8, 0))  # disabled

# ---- group: degree
list_5 = ValueList({"One": 1, "Two": 2, "Three": 2² - 1, "Four": Sqrt(16)}, selected="Three")  # disabled

# ---- group: Check if a number is equal to zero
c_script_43 = CSharpScript(myNumber=list)  # -> out; inputs myNumber: Double; disabled
# ---------- c_script_43: C# ----------
    //Using if statement to check if a number is equal to zero
    if (myNumber == 0)
    {
      Print("myNumber is zero");
    }
# ---------- end c_script_43 ----------

# ---- group: Check if a number is between 0 and 100
c_script_44 = CSharpScript(myNumber=list_2)  # -> out; inputs myNumber: Double; disabled
# ---------- c_script_44: C# ----------
    //Using if, else statement to check if a number is between 0 and 100
    if (myNumber >= 0 && myNumber <= 100)
    {
      Print("myNumber is between 0 and 100");
    }
# ---------- end c_script_44 ----------

# ---- group: Check if a number is positive
c_script_45 = CSharpScript(myNumber=list_3)  # -> out; inputs myNumber: Double; disabled
# ---------- c_script_45: C# ----------
    //Using if statement to check if a number is positive
    if (myNumber > 0)
    {
      Print("positive");
    }
    else
    {
      Print("less than 1");
    }
# ---------- end c_script_45 ----------

c_script_46 = CSharpScript(myNumber=list_4)  # -> out; inputs myNumber: Double; disabled
# ---------- c_script_46: C# ----------
    if (myNumber > 0)
    {
      Print("myNumber is positive");
    }
    else if (myNumber < 0)
    {
      Print("myNumber is negative");
    }
    else
    {
      Print("myNumber is zero");
    }
# ---------- end c_script_46 ----------

# ---- group: input points
pt_27 = Point([Point(17, -3, 0), Point(20, 2, 0), Point(24, -3, 0), Point(29, -2, 0), Point(30, 2, 0)])  # disabled

# ---- group: input curves
crv_14 = Curve(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)  # disabled
crv_15 = Curve(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)  # disabled

# ----
panel_125 = Panel("5")  # disabled

# ---- group: edge length
length = Slider(5.2024, range=1..10)  # disabled

# ---- group: Get the curve domain
c_script_47 = CSharpScript(crv=crv_13)  # -> out, CrvDomain; inputs crv: Curve; disabled
# ---------- c_script_47: C# ----------
    //Get the domain or interval of the curve
    Interval domain = crv.Domain;

    //Output the domain
    CrvDomain = domain;
# ---------- end c_script_47 ----------

# ---- group: Get the curve end points
c_script_48 = CSharpScript(crv=crv_13)  # -> out, A, B; inputs crv: Curve; disabled
# ---------- c_script_48: C# ----------
    //Get the start point
      Point3d start_pt = crv.PointAtStart;

      //Get the end point
      Point3d end_pt = crv.PointAtEnd;

      //Output
      A = start_pt;
      B = end_pt;
# ---------- end c_script_48 ----------

# ---- group: Recursive Function to Generate Dragon String
c_script_49 = CSharpScript(startString=panel_115, ruleX=panel_111, ruleY=panel_112, num=num_2)  # -> out, DragonString; inputs startString: String, ruleX: String, ruleY: String, num: Int32; disabled
# ---------- c_script_49: C# ----------
    // Declare string
    string finalString = startString;

    // Generate the string
    GrowString(ref num, ref finalString, ruleX, ruleY);

    // Return the string
    DragonString = finalString;
# ---------- c_script_49: C# additional code ----------
  void GrowString(ref int num, ref string finalString, string ruleX, string ruleY)
  {
    // Decrement the count with each new excution of the grow function
    num = num - 1;
    char rule;

    // Create new string
    string newString = "";
    for (int i = 0; i < finalString.Length ; i++)
    {
      rule = finalString[i];
      if (rule == 'X')
        newString = newString + ruleX;
      if (rule == 'Y')
        newString = newString + ruleY;
      if (rule == 'F' | rule == '+' | rule == '-')
        newString = newString + rule;
    }
    finalString = newString;

    // Stopper condition
    if (num == 0)
      return;

    // Grow again
    GrowString(ref num, ref finalString, ruleX, ruleY);
  }
# ---------- end c_script_49 ----------

# ---- group: Get the curve tangent vector at the start of the curve
c_script_50 = CSharpScript(crv=crv_13)  # -> out, StartPoint, TangentVector; inputs crv: Curve; disabled
# ---------- c_script_50: C# ----------
    //Get the tangent at start
    Vector3d tangent = crv.TangentAtStart;

    //Get the start point
    Point3d pt = crv.PointAtStart;

    //Output
    StartPoint = pt;
    TangentVector = tangent;
# ---------- end c_script_50 ----------

# ---- group: Get the knot list of a NurbsCurve
c_script_51 = CSharpScript(crv=crv_13)  # -> out, Knots; inputs crv: Curve; disabled
# ---------- c_script_51: C# ----------
    //Find the nurbs form of the curve
    NurbsCurve nc = crv.ToNurbsCurve();

    List<double> knotList = new List<double>();
    int count = 0;
    count = nc.Points.Count;
    int i = 0;

    //Loop to get all knots values
    for (i = 0; i <= count - 1; i++) {
      double knot = nc.Knots[i];
      knotList.Add(knot);
    }

    //Output knots
    Knots = knotList;
# ---------- end c_script_51 ----------

# ---- group: Divide curve by number
c_script_52 = CSharpScript(crv=crv_13, num=number_slider_15)  # -> out, A; inputs crv: Curve, num: Int32; disabled
# ---------- c_script_52: C# ----------
    //Declare an array of points
    Point3d[] points = {};

    //Divide the curve by number
    crv.DivideByCount(num, true, out points);

    //Output
    A = points;
# ---------- end c_script_52 ----------

# ---- group: Get the control points of a NurbsCurve
c_script_53 = CSharpScript(crv=crv_13)  # -> out, CPoints; inputs crv: Curve; disabled
# ---------- c_script_53: C# ----------
    //Find the nurbs form of the curve
    NurbsCurve nc = crv.ToNurbsCurve();

    List<Point3d> cp_list = new List<Point3d>();
    int count = 0;
    count = nc.Points.Count;
    int i = 0;

    //Loop to get all cv points
    for (i = 0; i <= count - 1; i++) {
      ControlPoint cp = new ControlPoint();
      cp = nc.Points[i];
      cp_list.Add(cp.Location);
    }

    //Output control points
    CPoints = cp_list;
# ---------- end c_script_53 ----------

# ----
xy = XYPlane(Origin=Point(0, 0, 0))  # disabled
panel_126 = Panel("-1.2")  # disabled
panel_127 = Panel("0.01")  # disabled

# ---- group: input curve
crv_16 = Curve(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)  # disabled

# ---- group: Create a lightweight Line (value type)
c_script_54 = CSharpScript(p0=pt_20, p1=pt_21)  # -> out, OutLine; inputs p0: Point3d, p1: Point3d; disabled
# ---------- c_script_54: C# ----------
    //Create an instance of a line
    Line line = new Line(p0, p1);

    OutLine = line;
# ---------- end c_script_54 ----------

# ---- group: Create a lightweight Arc (value type)
c_script_55 = CSharpScript(p0=pt_22, p1=pt_23, p2=pt_24)  # -> out, OutArc; inputs p0: Point3d, p1: Point3d, p2: Point3d; disabled
# ---------- c_script_55: C# ----------
    //Create an instance of an Arc
    Arc arc = new Arc(p0, p1, p2);

    //check if arc is valid
    if (arc.IsValid) {
      //Assign arc to output
      OutArc = arc;
    }
# ---------- end c_script_55 ----------

# ---- group: Create a lightweight polyline (value type)
c_script_56 = CSharpScript(points=pt_25)  # -> out, OutPolyline; inputs points: list of Point3d; disabled
# ---------- c_script_56: C# ----------
    //Create a new instance of a polyline
    Polyline pline = new Polyline(points);

    OutPolyline = pline;
# ---------- end c_script_56 ----------

# ---- group: Recursive fractal tree string
c_script_57 = CSharpScript(startString=panel_92, ruleX=panel_99, ruleY=panel_98, num=num_3)  # -> out, FractalString; inputs startString: String, ruleX: String, ruleY: String, num: Int32; disabled
# ---------- c_script_57: C# ----------
    // Declare string
    string fractalString = startString;

    // Generate the string
    GrowString(ref num, ref fractalString, ruleX, ruleY);

    // Return the string
    FractalString = fractalString;
# ---------- c_script_57: C# additional code ----------
  void GrowString(ref int num, ref string finalString, string ruleX, string ruleF)
  {
    // Decrement the count with each new excution of the grow function
    num = num - 1;
    char rule;

    // Create new string
    string newString = "";
    for (int i = 0; i < finalString.Length; i++)
    {
      rule = finalString[i];

      if (rule == 'X')
        newString = newString + ruleX;

      if (rule == 'F')
        newString = newString + ruleF;

      if (rule == '[' || rule == ']' || rule == '+' || rule == '-')
        newString = newString + rule;
    }

    finalString = newString;

    // Stopper condition
    if (num == 0)
      return;

    // Grow again
    GrowString(ref num, ref finalString, ruleX, ruleF);
  }
# ---------- end c_script_57 ----------

# ---- group: Create a LineCurve using the constructor and "New" keyword
c_script_58 = CSharpScript()  # -> out, OutLineCurve, OutNurbsCurve, Pt0, Pt1; disabled
# ---------- c_script_58: C# ----------
    //Create an instance of a line curve
    Point3d p0 = new Point3d(0, 0, 0);
    Point3d p1 = new Point3d(5, 1, 0);

    LineCurve line_crv = new LineCurve(p0, p1);
    OutLineCurve = line_crv;

    //convert LineCurve to a NurbsCurve
    NurbsCurve nc = line_crv.ToNurbsCurve();
    OutNurbsCurve = nc;

    Pt0 = p0;
    Pt1 = p1;
# ---------- end c_script_58 ----------

# ---- group: Create an ArchCurve using the constructor and "New" keyword
c_script_59 = CSharpScript()  # -> out, OutArcCurve, OutNurbsCurve, Pt0, Pt1, Pt2; disabled
# ---------- c_script_59: C# ----------
    var p0 = new Point3d(0, 0, 0);
    var p1 = new Point3d(5, 1, 0);
    var p2 = new Point3d(6, -3, 0);

    //Create an instance of an Arc
    Arc arc = new Arc(p0, p1, p2);

    //Create a new instance of ArcCurve
    ArcCurve arcCurve = new ArcCurve(arc);
    OutArcCurve = arcCurve;

    //convert ArcCurve to a NurbsCurve
    var nc = arcCurve.ToNurbsCurve();
    OutNurbsCurve = nc;

    Pt0 = p0;
    Pt1 = p1;
    Pt2 = p2;
# ---------- end c_script_59 ----------

# ---- group: Create an PolylineCurve from a list of points
c_script_60 = CSharpScript()  # -> out, OutPlineCurve, Points; disabled
# ---------- c_script_60: C# ----------
    var p0 = new Point3d(0, 0, 0);
    var p1 = new Point3d(5, 1, 0);
    var p2 = new Point3d(6, -3, 0);
    Point3d[] pointList = {p0, p1, p2};

    //Create a new instance of ArcCurve
    PolylineCurve plineCurve = new PolylineCurve(pointList);

    //Check if the curve is valid then assign curve to the output value A
    if (plineCurve != null)
      OutPlineCurve = plineCurve;

    Points = pointList;
# ---------- end c_script_60 ----------

# ---- group: edge length
length_2 = Slider(1.3218, range=1..10)  # disabled

# ---- group: Create a lightweight Circle (value type)
c_script_61 = CSharpScript(c=pt_26, r=radius)  # -> out, OutCircle; inputs c: Point3d, r: Double; disabled
# ---------- c_script_61: C# ----------
    //Create an instance of a circle
    Circle cir = new Circle(c, r);

    OutCircle = cir;
# ---------- end c_script_61 ----------

# ---- group: Rotated ellipes
c_script_62 = CSharpScript()  # -> out, OutCurves; disabled
# ---------- c_script_62: C# ----------
    double R = 0.01; //angle in radian
    int N = 20; //number of ellipses
    double X = 1.5; // shift along X axis

    //Declare a new list of ellipse curve type
    List<Ellipse> eList = new List<Ellipse>();

    //Use a loop to create a number of ellipse curves
    Plane plane = Plane.WorldXY;

    for (Int32 i = 1; i <= N; i++) {
      Point3d pt = new Point3d(X, 0, 0);
      Vector3d Y = new Vector3d(0, 1, 0);
      plane.Rotate(R * i, Y, pt);

      //Declare and instantiate a new ellipse
      Ellipse C = new Ellipse(plane, (double) i / 2, i);

      //Add the ellipse to the list
      eList.Add(C);
    }

    //Assign the list to the output value A
    OutCurves = eList;
# ---------- end c_script_62 ----------

# ---- group: Create clamped NurbsCurve from control points
c_script_63 = CSharpScript(cPoints=pt_19, degree=panel_124, periodic=toggle)  # -> out, OutCurve; inputs cPoints: list of Point3d, degree: Int32, periodic: Boolean; disabled
# ---------- c_script_63: C# ----------
    //Create an instance of a periodic (smoothly closed) or clamped (open) NurbsCurve
    //Use the "Create" method in NurbsCurve class
    NurbsCurve nc = NurbsCurve.Create(periodic, degree, cPoints);

    //Check if the curve is valid then assign curve to the output value A
    if (nc != null) {
      OutCurve = nc;
    }
# ---------- end c_script_63 ----------

# ---- group: Create NurbsCurve from control points
c_script_64 = CSharpScript(points=pt_27, degree=list_5)  # -> out, OutCurve; inputs points: list of Point3d, degree: Int32; disabled
# ---------- c_script_64: C# ----------
    //Declare a variable of type Curve
    Curve nc = default(Curve);

    //Create an instance of a Nurbs Curve using input points as control points
    // and input degree
    nc = Rhino.Geometry.Curve.CreateControlPointCurve(points, degree);

    //Assign curve to the output value A
    OutCurve = nc;
# ---------- end c_script_64 ----------

# ---- group: Create tween curves between 2 input curves
c_script_65 = CSharpScript(curve0=crv_14, curve1=crv_15, count=panel_125)  # -> out, Curves; inputs curve0: Curve, curve1: Curve, count: Int32; disabled
# ---------- c_script_65: C# ----------
    //Declare a variable of type Curve
    Curve[] tweenCrvs = null;

    //Create an array of tween curves from two input curves and number
    tweenCrvs = Rhino.Geometry.Curve.CreateTweenCurves(curve0, curve1, count, 0.01);

    //Assign curve to the output value A
    Curves = tweenCrvs;
# ---------- end c_script_65 ----------

# ----
panel_128 = Panel(c_script_43)  # disabled
panel_129 = Panel(c_script_44)  # disabled
panel_130 = Panel(c_script_45)  # disabled
panel_131 = Panel(c_script_46)  # disabled
panel_132 = Panel(c_script_53.CPoints)  # disabled
curve_domain = Panel(c_script_47.CrvDomain)  # disabled
panel_133 = Panel(c_script_48.A)  # disabled
panel_134 = Panel(c_script_48.B)  # disabled

# ---- group: Extract iso-curve from a surface. A new instance of a curve is the return value of a method
c_script_66 = CSharpScript(srf=srf_3, p=number_slider_16)  # -> out, OutIsoCurve; inputs srf: Surface, p: Double; disabled
# ---------- c_script_66: C# ----------
    var isoCurve = srf.IsoCurve(0, p);
    OutIsoCurve = isoCurve;
# ---------- end c_script_66 ----------

# ---- group: Multiple offset of curve
c_script_67 = CSharpScript(crv=crv_16, num=number_slider_17, dis=panel_126, tol=panel_127, plane=xy)  # -> out, OutCurves; inputs crv: Curve, num: Int32, dis: Double, tol: Double, plane: Plane; disabled
# ---------- c_script_67: C# ----------
    //Declare the list of curve
    List<Curve> crvs = new List<Curve>();

    //The curve to offset
    Curve last_crv = crv;

    //Create offset curves
    for (int i = 1; i <= num; i++) {
      //offset
      Curve[] crv_array = last_crv.Offset(plane, dis, tol, CurveOffsetCornerStyle.None);

      //Ignore if output is multiple offset curves
      if (crv.IsValid && crv_array.Count() == 1) {
        //append offset curve to array
        crvs.Add(crv_array[0]);

        //update the next curve to offset
        last_crv = crv_array[0];
      } else {
        break;
      }
    }

    //Assign output
    A = crvs;
# ---------- end c_script_67 ----------

# ----
knots = Panel(c_script_51.Knots)  # disabled
panel_135 = Panel(c_script_52.A)  # disabled
vdis_11 = VectorDisplay(Anchor=c_script_50.StartPoint, Vector=expr("6*x", c_script_50.TangentVector))  # disabled
panel_136 = Panel(c_script_50.StartPoint)  # disabled
panel_137 = Panel(c_script_50.TangentVector)  # disabled
panel_138 = Panel(c_script_54.OutLine)  # disabled
panel_139 = Panel(c_script_55.OutArc)  # disabled
panel_140 = Panel(c_script_61.OutCircle)  # disabled
panel_141 = Panel(c_script_62.OutCurves)  # disabled

# ---- group: periodic
toggle_2 = BooleanToggle(True)  # disabled

# ----
panel_142 = Panel(c_script_56.OutPolyline)  # disabled
panel_143 = Panel(c_script_49.DragonString)  # disabled
panel_144 = Panel(c_script_58.OutLineCurve)  # disabled
panel_145 = Panel(c_script_58.OutNurbsCurve)  # disabled
panel_146 = Panel(c_script_58.Pt0)  # disabled
panel_147 = Panel(c_script_58.Pt1)  # disabled
panel_148 = Panel(c_script_59.OutArcCurve)  # disabled
panel_149 = Panel(c_script_59.OutNurbsCurve)  # disabled
panel_150 = Panel(c_script_59.Pt0)  # disabled
panel_151 = Panel(c_script_59.Pt1)  # disabled
panel_152 = Panel(c_script_59.Pt2)  # disabled
panel_153 = Panel(c_script_60.OutPlineCurve)  # disabled
panel_154 = Panel(c_script_60.Points)  # disabled

# ---- group: Generate Points List
c_script_68 = CSharpScript(dragonString=c_script_49.DragonString, length=length)  # -> out, DragonPoints; inputs dragonString: String, length: Double; disabled
# ---------- c_script_68: C# ----------
    //Parse instruction string to generate points
    //Let base point be world origin
    Point3d pt = Point3d.Origin;

    //Declare points array
    var arrPoints = new List<Point3d>();
    arrPoints.Add(pt);

    //Drawing direction vector - Strat as xaxis
    //Vector direction will be rotated depending on (+,-) instructions
    var vec = new Vector3d(1.0, 0.0, 0.0);

    //Declare loop variables
    char rule;
    for(int i = 0 ; i < dragonString.Length;i++)
    {
      //Aleays start for 1 and length 1 to get one char at a time
      rule = dragonString[i];
      //Move Forward using direction vector
      if( rule == 'F')
      {
        pt = pt + (vec * length);
        arrPoints.Add(pt);
      }

      //Rotate Left
      if( rule == '+')
        vec.Rotate(Math.PI / 2, Vector3d.ZAxis);

      //Rotate Right
      if( rule == '-')
        vec.Rotate(-Math.PI / 2, Vector3d.ZAxis);
    }

    DragonPoints = arrPoints;
# ---------- end c_script_68 ----------

# ----
panel_155 = Panel("while loop")  # disabled
# for and foreach loops
panel_156 = Panel("Loops")  # disabled

swatch_3 = ColourSwatch(SwatchColor=RGB(189, 189, 189))  # disabled
pline = PolyLine(Vertices=c_script_53.CPoints, Closed=False)  # disabled
preview_3 = CustomPreview(Geometry=pline, Material=swatch_3)  # disabled

# ---- group: Input positive int
panel_157 = Panel("46")  # disabled

# ---- group: Generate Points List
c_script_69 = CSharpScript(fractalString=c_script_57.FractalString, length=length_2)  # -> out, FractalLines; inputs fractalString: String, length: Double; disabled
# ---------- c_script_69: C# ----------
    //Parse instruction string to generate points
    //Let base point be world origin
    Point3d pt = Point3d.Origin;

    //Declare points array
    //Vector rotates with (+,-) instructions by 30 degrees
    List<Point3d> arrPoints = new List<Point3d>();

    //Draw forward direction
    //Vector direction will be rotated depending on (+,-) instructions
    Vector3d vec = new Vector3d(0.0, 1.0, 0.0);

    //Stacks of points and vectors
    List<Point3d> ptStack = new List<Point3d>();
    List<Vector3d> vStack = new List<Vector3d>();

    //Declare loop variables
    char rule;
    for(int i = 0 ; i < fractalString.Length; i++)
    {
      //Always start for 1 and length 1 to get one char at a time
      rule = fractalString[i];

      //Rotate Left
      if( rule == '+')
        vec.Rotate(Math.PI / 6, Vector3d.ZAxis);

      //Rotate Right
      if( rule == '-')
        vec.Rotate(-Math.PI / 6, Vector3d.ZAxis);


      //Draw Forward by direction
      if( rule == 'F')
      {
        //Add current points
        Point3d newPt1 = new Point3d(pt);
        arrPoints.Add(newPt1);

        //Calculate next point
        Point3d newPt2 = new Point3d(pt);
        newPt2 = newPt2 + (vec * length);
        //Add next point
        arrPoints.Add(newPt2);

        //Save new location
        pt = newPt2;
      }

      //Save point location
      if( rule == '[')
      {
        //Save current point and direction
        Point3d newPt = new Point3d(pt);
        ptStack.Add(newPt);

        Vector3d newV = new Vector3d(vec);
        vStack.Add(newV);
      }

      //Retrieve point and direction
      if( rule == ']')
      {
        pt = ptStack[ptStack.Count - 1];
        vec = vStack[vStack.Count - 1];

        //Remove from stack
        ptStack.RemoveAt(ptStack.Count - 1);
        vStack.RemoveAt(vStack.Count - 1);
      }
    }

    //Generate lines
    List<Line> allLines = new List<Line>();
    for(int i = 1; i < arrPoints.Count; i = i + 2)
    {
      Line line = new Line(arrPoints[i - 1], arrPoints[i]);
      allLines.Add(line);
    }


    FractalLines = allLines;
# ---------- end c_script_69 ----------

# ----
panel_158 = Panel(c_script_57.FractalString)  # disabled

# ---- group: use for loop to print numbers 1-10
c_script_70 = CSharpScript()  # -> out, A; disabled
# ---------- c_script_70: C# ----------
    int i;
    for (i = 1; i <= 10; i++)
    {
      //Convert a number to string
      Print(i.ToString());
      //Another way to print
      Print("" + i);
    }
# ---------- end c_script_70 ----------

# ---- group: use for loop to print even numbers for 10 to -10
c_script_71 = CSharpScript()  # -> out, A; disabled
# ---------- c_script_71: C# ----------
    for (int i = 10; i >= -10; i = i - 2)
    {
      Print(i.ToString());
    }
# ---------- end c_script_71 ----------

# ---- group: use for to loop through the alphabet
c_script_72 = CSharpScript()  # -> out, A; disabled
# ---------- c_script_72: C# ----------
    string alphabet = "ABCDEFGHIJKLMNOPQRSTUVWXYZ";
    char[ ] letters = alphabet.ToCharArray();
    for (int i = 0; i <= letters.Length - 1; i++)
    {
      Print(i.ToString() + " = " + letters[i]);
    }
# ---------- end c_script_72 ----------

# ---- group: for loop the indices of a list
c_script_73 = CSharpScript()  # -> out, A; disabled
# ---------- c_script_73: C# ----------
    //List Of places
    List< String > places_list = new List<String >();
    places_list.Add("Paris");
    places_list.Add("NY");
    places_list.Add("Beijing");

    //Loop counter
    int i = 0;
    int count = places_list.Count();

    //Loop starting from 0 to count -1 (count = 3, but last index of the places_list is 2)
    for (i = 0; i < count; i++)
    { 
      Print( "I have been to " + places_list[i] );
    }
# ---------- end c_script_73 ----------

# ---- group: foreach loop the elements of a list
c_script_74 = CSharpScript()  # -> out, A; disabled
# ---------- c_script_74: C# ----------
    //List of places
    var places_list = new List< string >();
    places_list.Add("Paris");
    places_list.Add("NY");
    places_list.Add("Beijing");

    //Loop
    foreach (string place in places_list)
    {
      Print(place);
    }
# ---------- end c_script_74 ----------

# ---- group: While loop through elements of a list
c_script_75 = CSharpScript()  # -> out, A; disabled
# ---------- c_script_75: C# ----------
    //Array Of places
    List<string> places_list = new List<string>();
    places_list.Add("Paris");
    places_list.Add("NY");
    places_list.Add("Beijing");

    int i = 0;
    string place = null;
    int count = places_list.Count();

    //Loop
    i = 0;
    //(i < count) evaluates To True Or False
    while (i < count)
    {
      place = places_list[i];
      Print(place);
      i = i + 1;
    }
# ---------- end c_script_75 ----------

# ---- group: Add positive int until < 1000
c_script_76 = CSharpScript()  # -> out, A; disabled
# ---------- c_script_76: C# ----------
    int sum = 0;
    int counter = 0;
    int number = 2;

    //Loop
    while (sum < 1000)
    {
      sum = sum + number;
      //Make sure you increment the counter and the number
      counter = counter + 1;
      number = number + 2;
    }
    //Remove last number
    sum -= number;
    counter--;

    Print("Count = " + counter);
    Print("Sum = " + sum);
# ---------- end c_script_76 ----------

# ---- group: Collatz conjecture
c_script_77 = CSharpScript(x=panel_157)  # -> out, A; inputs x: Int32; disabled
# ---------- c_script_77: C# ----------
    while(x > 1)
    {
      Print(x.ToString());
      if(x % 2 == 0)
        x = x / 2;
      else
        x = x * 3 + 1;
    }
    Print(x.ToString());
# ---------- end c_script_77 ----------

# ---- group: Create periodic NurbsCurve from control points
c_script_78 = CSharpScript(cPoints=pt_19, degree=panel_124, periodic=toggle_2)  # -> out, OutCurve; inputs cPoints: list of Point3d, degree: Int32, periodic: Boolean; disabled; same code as c_script_63

# ----
panel_159 = Panel(c_script_70.out)  # disabled
panel_160 = Panel(c_script_71.out)  # disabled
panel_161 = Panel(c_script_73.out)  # disabled
panel_162 = Panel(c_script_74.out)  # disabled
panel_163 = Panel(c_script_77.out)  # disabled
panel_164 = Panel(c_script_72.out)  # disabled
panel_165 = Panel(c_script_75.out)  # disabled
panel_166 = Panel(c_script_76.out)  # disabled

# ---- group: draw polyling
pline_2 = PolyLine(Vertices=c_script_68.DragonPoints, Closed=False)  # disabled

# ----
panel_167 = Panel("SURFACES")  # disabled
number_slider_18 = Slider(1.3, range=0.1..10)  # disabled
number_slider_19 = Slider(4, range=2..10)  # disabled
number_slider_20 = Slider(0.51, range=0..1)  # disabled
number_slider_21 = Slider(0.25, range=0..1)  # disabled
panel_168 = Panel("Surface methods")  # disabled
panel_169 = Panel("0.001")  # disabled

# ---- group: Create a PlanarSurface from a plane and 2 intervals
c_script_79 = CSharpScript()  # -> out, PlanarSurface; disabled
# ---------- c_script_79: C# ----------
    var plane = Plane.WorldXY;
    var x_interval = new Interval(1.0, 3.5);
    var y_interval = new Interval(2.0, 6.0);

    var planeSrf = new PlaneSurface(plane, x_interval, y_interval);

    PlanarSurface = planeSrf;
# ---------- end c_script_79 ----------

# ---- group: input surfaces
srf_4 = Surface(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)  # disabled
srf_5 = Surface(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)  # disabled

# ---- group: input surface
srf_6 = Surface(reparameterize(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))  # disabled

# ---- group: Create a sphere
c_script_80 = CSharpScript()  # -> out, OutSphere; disabled
# ---------- c_script_80: C# ----------
    Point3d center = Point3d.Origin;
    double radius = 7.5;

    Sphere sp = new Sphere(center, radius);

    OutSphere = sp;
# ---------- end c_script_80 ----------

# ---- group: Create a cylinder
c_script_81 = CSharpScript()  # -> out, OutCylinder; disabled
# ---------- c_script_81: C# ----------
    double height = 7.5;
    double radius = 2.5;
    Point3d center = Point3d.Origin;
    Circle base_circle = new Circle(center, radius);

    Cylinder cy = new Cylinder(base_circle, height);

    OutCylinder = cy;
# ---------- end c_script_81 ----------

# ---- group: Create a cone
c_script_82 = CSharpScript()  # -> out, OutCone; disabled
# ---------- c_script_82: C# ----------
    double height = 7.5;
    double radius = 7.5;

    Cone co = new Cone(Plane.WorldXY, height, radius);

    OutCone = co;
# ---------- end c_script_82 ----------

# ---- group: Create a torus
c_script_83 = CSharpScript()  # -> out, OutTorus; disabled
# ---------- c_script_83: C# ----------
    double minorRadius = 2.5;
    double majorRadius = 7.5;

    Torus to = new Torus(Plane.WorldXY, majorRadius, minorRadius);

    OutTorus = to;
# ---------- end c_script_83 ----------

# ----
panel_170 = Panel("1.2")  # disabled
panel_171 = Panel("0.01")  # disabled
panel_172 = Panel("Nested loops")  # disabled

# ---- group: input surface
srf_7 = Surface(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)  # disabled

srf_8 = Surface(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)  # disabled

# ----
panel_173 = Panel("""apple
orange
banana
strawberry""")  # disabled
panel_174 = Panel("""apple
orange
banana
strawberry""")  # disabled
panel_175 = Panel(c_script_79.PlanarSurface)  # disabled

# ---- group: Create a fillet surface between two input surfaces
c_script_84 = CSharpScript(srfA=srf_4, srfB=srf_5, radius=number_slider_18, tol=panel_169)  # -> out, OutSurfaces; inputs srfA: Surface, srfB: Surface, radius: Double, tol: Double; disabled
# ---------- c_script_84: C# ----------
    //Declare an array of surfaces
    Surface[] surfaces = {};

    //Check for a valid input
    if (srfA != null && srfB != null) {
      //Create fillet surfaces
      surfaces = Surface.CreateRollingBallFillet(srfA, srfB, radius, tol);
    }

    //Output
    OutSurfaces = surfaces;
# ---------- end c_script_84 ----------

# ---- group: Check is a surface is closed in the u and the v direction and also if the surface is planar
c_script_85 = CSharpScript(srf=srf_8)  # -> out, IsClosedU, IsClosedV, IsPlanar; inputs srf: Surface; disabled
# ---------- c_script_85: C# ----------
    //Check if the input surface is closed in the u or v direction
    IsClosedU = srf.IsClosed(0);
    IsClosedV = srf.IsClosed(1);

    //Check if the surface is planar at zero tolerance
    IsPlanar = srf.IsPlanar();
# ---------- end c_script_85 ----------

# ---- group: Evaluate a surface
c_script_86 = CSharpScript(srf=srf_6, u=number_slider_20, v=number_slider_21)  # -> out, EvalPt, TanU, TanV; inputs srf: Surface, u: Double, v: Double; disabled
# ---------- c_script_86: C# ----------
    //Declare and intentiate the evaluation point and derivative vectors
    Point3d point = new Point3d(Point3d.Unset);
    Vector3d[] derivatives = {};

    //Evaluate the surface and extract only the first derivative to get u & v tangents
    srf.Evaluate(u, v, 1, out point, out derivatives);


    EvalPt = point;
    TanU = derivatives[0];
    TanV = derivatives[1];
# ---------- end c_script_86 ----------

# ---- group: Multiple offset of surface
c_script_87 = CSharpScript(srf=srf_7, num=number_slider_19, dis=panel_170, tol=panel_171)  # -> out, OutSrf; inputs srf: Surface, num: Int32, dis: Double, tol: Double; disabled
# ---------- c_script_87: C# ----------
    //Declare the list of curve
    List<Surface> srfs = new List<Surface>();

    //The surface to offset
    Surface last_srf = srf;

    //Create offset curves
    for (int i = 1; i <= num; i++) {
      //offset
      Surface offset_srf = last_srf.Offset(dis, tol);

      //Ignore if output is multiple offset curves
      if (srf.IsValid) {
        //append offset curve to array
        srfs.Add(offset_srf);

        //update the next curve to offset
        last_srf = offset_srf;
      } else {
        break;
      }
    }

    //Assign output
    A = srfs;
# ---------- end c_script_87 ----------
# ---- group: Try to get a Cone from a RevSurface
c_script_88 = CSharpScript()  # -> out, RevSrf, ConeSrf; disabled
# ---------- c_script_88: C# ----------
    //Declare and instantiate an axis and a curve
    Line axis = new Line (Point3d.Origin, new Point3d(0, 0, 10));
    LineCurve crv = new LineCurve(new Point3d(2, 0, 0), new Point3d(3.5, 0, 5));

    //Create surface of revolution
    RevSurface revSrf = RevSurface.Create(crv, axis);
    RevSrf = revSrf;

    //Try to get a Cone
    Cone cone;
    if( revSrf.TryGetCone(out cone))
      ConeSrf = cone;
# ---------- end c_script_88 ----------

# ----
panel_176 = Panel(c_script_80.OutSphere)  # disabled
panel_177 = Panel(c_script_81.OutCylinder)  # disabled
panel_178 = Panel(c_script_82.OutCone)  # disabled
panel_179 = Panel(c_script_83.OutTorus)  # disabled
panel_180 = Panel("5")  # disabled

# ---- group: Check for an orange and how many fruits has at least 1 r
c_script_89 = CSharpScript(fruits=panel_174)  # -> out, A; inputs fruits: list of String; disabled
# ---------- c_script_89: C# ----------
    //Check if there is at least one orange
    foreach (string fruit in fruits)
    {
      //Check if it is an orange
      if (fruit == "orange")
      {
        //Check if the letter is ‘a"
        Print("Found an orange");
        //No need to check the rest of the list, exit the loop
        break;
      }
    }
    //Check how many fruits has at least one letter ‘r’ in the name
    int count = 0;
    //Loop through the fruits
    foreach (string fruit in fruits)
    {
      //loop through the letters in each fruit
      foreach (char letter in fruit)
      {
        //Check if the letter is ‘r"
        if(letter == 'r')
        {
          count = count + 1;
          //No need to check the rest of the letters, and skip to the next fruit
          continue;
        }
      }
    }
    Print("Number of fruits that has at least one letter r is: " + count);
    A = count;
# ---------- end c_script_89 ----------

# ---- group: output the number of letter a
c_script_90 = CSharpScript(fruits=panel_173)  # -> out, A; inputs fruits: list of String; disabled
# ---------- c_script_90: C# ----------
    //Declare and initialize the count
    int count = 0;

    //Loop through the fruits

    foreach (string fruit in fruits)
    {
      //loop through the letters in each fruit

      foreach (char letter in fruit)
      {
        //compare to see if the letter is the same as input "x"
        if (letter == 'a')
        {
          count = count + 1;
        }
      }
    }
    Print("Letter a is repeated " + count + " times");
    A = count;
# ---------- end c_script_90 ----------

# ---- group: Variables
# L-Sytems Definition - Penrose Tiling
panel_181 = Panel("1, 6, 7, 8, 9, [, ]")  # disabled

# ---- group: Starting string
panel_182 = Panel("[7]++[7]++[7]++[7]++[7]")  # disabled

# ---- group: Rules
# (eliminate at each iteration)
panel_184 = Panel("7 ->")  # disabled
panel_185 = Panel("8 ->")  # disabled
panel_186 = Panel("9 ->")  # disabled
panel_188 = Panel("6 ->")  # disabled
panel_189 = Panel("1 ->")  # disabled
panel_192 = Panel("+81--91[---61--71]+")  # disabled
panel_193 = Panel("-61++71[+++81++91]-")  # disabled
panel_194 = Panel("--81++++61[+91++++71]--71")  # disabled
panel_195 = Panel("81++91----71[-81----61]++")  # disabled
panel_196 = Panel("Rotate 36")  # disabled
panel_197 = Panel("Rotate -36")  # disabled

# ----
panel_199 = Panel(c_script_85.IsClosedU)  # disabled
panel_200 = Panel(c_script_85.IsClosedV)  # disabled
panel_201 = Panel(c_script_85.IsPlanar)  # disabled
amp = Amplitude(Vector=[c_script_86.TanU, c_script_86.TanV], Amplitude=panel_180)  # disabled
panel_202 = Panel(c_script_87.OutSrf)  # disabled
panel_203 = Panel(c_script_88.RevSrf)  # disabled
panel_204 = Panel(c_script_88.ConeSrf)  # disabled

srf_9 = Surface(c_script_88.RevSrf)  # disabled
srf_10 = Surface(c_script_88.ConeSrf)  # disabled

pt_28 = Point(c_script_86.EvalPt)  # disabled
panel_205 = Panel(c_script_84.OutSurfaces)  # disabled
panel_206 = Panel(c_script_90.out)  # disabled
panel_207 = Panel(c_script_90.A)  # disabled
panel_208 = Panel(c_script_89.out)  # disabled
panel_209 = Panel(c_script_89.A)  # disabled
vdis_12 = VectorDisplay(Anchor=c_script_86.EvalPt, Vector=amp)  # disabled
panel_210 = Panel("10")  # disabled
panel_211 = Panel("MESHES")  # disabled

# ---- group: vertex index to delete
number_slider_22 = Slider(32, range=0..100)  # disabled

# ----
Z = UnitZ(Factor=panel_210)  # disabled

# ---- group: profile curve
crv_17 = Curve(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)  # disabled

# ---- group: axis line
line = Line(Line((5, 0, 0), (5, 0, 25)))  # disabled

# ---- group: input points
pt_29 = Point([Point(13.19469112, 6.180913445, 0.4462141947), Point(14.04232519, 1.84769065, -1.33077427), Point(10.18994361, 7, 0), Point(12, 1.838740025, 1.007029275)])  # disabled

# ---- group: input curve
crv_18 = Curve(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)  # disabled

# ----
num_4 = Slider(4, range=1..20)  # disabled
panel_212 = Panel("Methods")  # disabled
panel_213 = Panel("3")  # disabled
panel_214 = Panel("12.5")  # disabled
panel_215 = Panel("66")  # disabled
panel_216 = Panel("0")  # disabled
panel_217 = Panel("23")  # disabled
panel_218 = Panel("12.5")  # disabled
panel_219 = Panel("0.1")  # disabled

# ---- group: input mesh
mesh_2 = Mesh(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)  # disabled

mesh_3 = Mesh(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)  # disabled

mesh_4 = Mesh(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)  # disabled

# ---- group: test point
pt_30 = Point(Point(0, -5, 0))  # disabled

# ---- group: input mesh
mesh_5 = Mesh(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)  # disabled

# ---- group: Create a new planar rectangular mesh from scratch
c_script_91 = CSharpScript()  # -> out, OutMesh; disabled
# ---------- c_script_91: C# ----------
    //Create simple rectangular mesh
    //Create a new instance of a mesh
    Rhino.Geometry.Mesh mesh = new Rhino.Geometry.Mesh();

    //Add mesh vertices
    mesh.Vertices.Add(0.0, 0.0, 0.0);//0
    mesh.Vertices.Add(5.0, 0.0, 0.0);//1
    mesh.Vertices.Add(5.0, 5.0, 0.0);//2
    mesh.Vertices.Add(0.0, 5.0, 0.0);//3

    //Add mesh faces
    mesh.Faces.AddFace(0, 1, 2, 3);

    //Compute mesh normals
    mesh.Normals.ComputeNormals();

    //Generate any additional mesh data
    mesh.Compact();

    //Assign output
    OutMesh = mesh;
# ---------- end c_script_91 ----------

# ---- group: Create a new mesh from scratch with two trinagular faces
c_script_92 = CSharpScript()  # -> out, OutMesh; disabled
# ---------- c_script_92: C# ----------
    //Create simple triangular mesh
    //Create a new instance of a mesh
    Rhino.Geometry.Mesh mesh = new Rhino.Geometry.Mesh();

    //Add mesh vertices
    mesh.Vertices.Add(0.0, 0.0, 0.0);//0
    mesh.Vertices.Add(5.0, 0.0, 2.0);//1
    mesh.Vertices.Add(5.0, 5.0, 0.0);//2
    mesh.Vertices.Add(0.0, 5.0, 2.0);//3

    //Add mesh faces
    mesh.Faces.AddFace(0, 1, 2);
    mesh.Faces.AddFace(0, 2, 3);

    //Compute mesh normals
    mesh.Normals.ComputeNormals();

    //Generate any additional mesh data
    mesh.Compact();

    //Assign output
    OutMesh = mesh;
# ---------- end c_script_92 ----------

# ---- group: input mesh
mesh_6 = Mesh(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)  # disabled

# ---- group: input brep
brep_2 = Brep(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)  # disabled

# ---- group: input closed polyline
crv_19 = Curve(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)  # disabled

# ---- group: input mesh
mesh_7 = Mesh(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)  # disabled

# ---- group: Create a RevSurface from line and profile curve
c_script_93 = CSharpScript(revCrv=crv_17, revAxis=line)  # -> out, RevolutionSurface; inputs revCrv: Curve, revAxis: Line; disabled
# ---------- c_script_93: C# ----------
    var revSrf = RevSurface.Create(revCrv, revAxis);

    RevolutionSurface = revSrf;
# ---------- end c_script_93 ----------

# ---- group: Create a NurbsSurface from points
c_script_94 = CSharpScript(points=pt_29)  # -> A; inputs points: list of Point3d; disabled
# ---------- c_script_94: C# ----------
    //Create a surface from points
      NurbsSurface ns = default(NurbsSurface);
      ns = NurbsSurface.CreateThroughPoints(points, 2, 2, 1, 1, false, false);

      //Output
      A = ns;
# ---------- end c_script_94 ----------

# ---- group: input mesh
mesh_8 = Mesh(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)  # disabled

# ---- group: Display the vector
end = EndPoints(Curve=crv_18)  # -> Start, End; disabled
vdis_13 = VectorDisplay(Anchor=end.Start, Vector=Z)  # disabled

# ---- group: Create a NurbsSurface from curve and direction
c_script_95 = CSharpScript(crv=crv_18, dir=Z)  # -> out, A, B; inputs crv: Curve, dir: Vector3d; disabled
# ---------- c_script_95: C# ----------
    //Create a nurbs surface from extruding a curve in some dir
    var nSrf = NurbsSurface.CreateExtrusion(crv, dir);
    //Output the Nurbs Surface
    A = nSrf;

    //Create an extrusion from extruding a curve in some dir
    var ex = Extrusion.Create(crv, 10, false);
    //Grasshopper outputs the Extrusion as a Nurbs Surface
    B = ex;


    //Note that in Grasshopper 1.0 there is not explicit support to extrusion surfaces
    //  and hence the output is converted to a nurbs surface.
    //  the only way to bake an Extrusion instance is to add the object to the active
    //  document from within the scripting component as in the following:
    //  (uncomment the following line to add the extrusion object directly to Rhino)
    //Rhino.RhinoDoc.ActiveDoc.Objects.AddExtrusion(ex);
# ---------- end c_script_95 ----------

# ---- group: Check if a number is prime, and output numbers it is divisible by
c_script_96 = CSharpScript(num=panel_215)  # -> out, IsPrime, Factors; inputs num: Int32; disabled
# ---------- c_script_96: C# ----------
    //Assign variables to output
    List<int> factors = new List<int>();
    IsPrime = isPrimeNumber(num, factors);

    //Assign output
    Factors = factors;
# ---------- c_script_96: C# additional code ----------
  //Addition method
  bool isPrimeNumber(int num, List<int> factors)
  {
    //all numbers are divisible by 1
    factors.Add(1);
    bool primeFlag = true;
    for( int i = 2; i < (num / 2); i++)
    {
      if( num % i == 0)
      {
        primeFlag = false;
        factors.Add(i);
      }
    }
    //all numbers are divisible by the number itself
    factors.Add(num);

    return primeFlag;
  }
# ---------- end c_script_96 ----------

# ---- group: Mesh topology Claculate the outline of a mesh
c_script_97 = CSharpScript(mesh=mesh_2)  # -> out, MeshOutline; inputs mesh: Mesh; disabled
# ---------- c_script_97: C# ----------
    // Get the mesh's topology
    Rhino.Geometry.Collections.MeshTopologyEdgeList mesh_edges = mesh.TopologyEdges;
    List<Line> lines = new List<Line>();

    // Find all of the mesh edges that have only a single mesh face
    for (int i = 0; i <= mesh_edges.Count - 1; i++) {
      int num_of_faces = mesh_edges.GetConnectedFaces(i).Length;

      if ((num_of_faces == 1)) {
        Line line = mesh_edges.EdgeLine(i);
        lines.Add(line);
      }
    }

    //Assign output
    A = lines;
# ---------- end c_script_97 ----------

# ---- group: Extract naked edges from a mesh
c_script_98 = CSharpScript(mesh=mesh_3)  # -> out, NakedEdges; inputs mesh: Mesh; disabled
# ---------- c_script_98: C# ----------
    //Declare an array of polylines
    Polyline[] meshNakedEdges = {};

    //Create a new mesh from polyline
    meshNakedEdges = mesh.GetNakedEdges();

    //Output
    NakedEdges = meshNakedEdges;
# ---------- end c_script_98 ----------

# ---- group: divide function uses pass by reference
c_script_99 = CSharpScript(x=panel_218, y=panel_216)  # -> out, A; inputs x: Double, y: Double; disabled
# ---------- c_script_99: C# ----------
    //Declare and initialize the result variable
    double rc = 0.0;

    //Pass the divide result variable by reference to allow changing its value inside the method
    bool valid = Divide(x, y, ref rc);
    if( valid)
    {
      //Assign variables to output
      A = rc;
    }
    else
    {
      Print("Divide by zero error");
    }
# ---------- c_script_99: C# additional code ----------
  //Divide method
  public bool Divide(double x, double y, ref double rc)
  {
    if (Math.Abs(y) < 1e-100)
      return false;
    else
      rc = x / y;
    return true;
  }
# ---------- end c_script_99 ----------

# ---- group: output the sum and multiplication results of 2 numbers
c_script_100 = CSharpScript(x=panel_214, y=panel_213)  # -> out, A, B; inputs x: Double, y: Double; disabled
# ---------- c_script_100: C# ----------
    //Declare and initialize the variables
    double add_xy = 0.0;
    double multiply_xy = 0.0;

    //Assign function result to to the addition result variable
    add_xy = Add(x, y);

    //Pass the multiplication result variable by reference to allow changing its value inside the sub
    Multiply(x, y, ref multiply_xy);

    //Assign variables to output
    A = add_xy;
    B = multiply_xy;
# ---------- c_script_100: C# additional code ----------
  
  //Addition method
  public double Add(double x, double y)
  {
    return x + y;
  }

  //Multiplication method
  public void Multiply(double x, double y, ref double rc)
  {
    rc = x * y;
  }
# ---------- end c_script_100 ----------

# ---- group: Create a new mesh using an input brep
c_script_101 = CSharpScript(brep=brep_2)  # -> out, OutMesh; inputs brep: Brep; disabled
# ---------- c_script_101: C# ----------
    //Set mesh parameters to default
    MeshingParameters mp = MeshingParameters.Default;

    //Create meshes from brep
    var new_mesh = Mesh.CreateFromBrep(brep, mp);

    //Output
    OutMesh = new_mesh;
# ---------- end c_script_101 ----------

# ---- group: Create a new mesh using an input closed polyline
c_script_102 = CSharpScript(pline=crv_19)  # -> out, OutMesh; inputs pline: Polyline; disabled
# ---------- c_script_102: C# ----------
    //Create a new mesh from polyline
    var new_mesh = Mesh.CreateFromClosedPolyline(pline);

    //Output
    A = new_mesh;
# ---------- end c_script_102 ----------

# ---- group: Change vertices locations randomly
c_script_103 = CSharpScript(mesh=mesh_7)  # -> out, OutMesh; inputs mesh: Mesh; disabled
# ---------- c_script_103: C# ----------
    //Change mesh vertex location
    int index = 0;
    Random rand = new Random();
    foreach (Point3f loc in mesh.Vertices) {
      Point3f new_loc = loc;
      new_loc.Z = rand.Next(10) / 3;
      mesh.Vertices[index] = new_loc;
      index = index + 1;
    }

    //Assign output
    OutMesh = mesh;
# ---------- end c_script_103 ----------
c_script_104 = CSharpScript(mesh=mesh_7)  # -> out, OutMesh; inputs mesh: Mesh; disabled
# ---------- c_script_104: C# ----------
    //Create a new instance of random generator
    Random rand = new Random();

    for (int i = 0; i <= mesh.Vertices.Count - 1; i++)
    {
      //Get vertex
      Point3f loc = mesh.Vertices[i];
      loc.Z = rand.Next(10) / 3;

      //Assign new location
      mesh.Vertices.SetVertex(i, loc);
    }

    //Assign output
    OutMesh = mesh;
# ---------- end c_script_104 ----------

# ---- group: delete random set of mesh faces
c_script_105 = CSharpScript(mesh=mesh_6)  # -> out, OutMesh; inputs mesh: Mesh; disabled
# ---------- c_script_105: C# ----------
    List<int> face_indices = new List<int>();
    int count = mesh.Faces.Count;

    //Create a new instance of random generator
    Random rand = new Random();

    for (int i = 0; i <= count - 1; i += 2)
    {
      int index = rand.Next(count);
      //Assign new location
      face_indices.Add(index);
    }

    //delete duplicate indices
    List<int> distinct_indices = face_indices.Distinct().ToList();

    //delete faces
    mesh.Faces.DeleteFaces(distinct_indices);

    //Assign output
    A = mesh;
# ---------- end c_script_105 ----------

# ----
panel_220 = Panel(c_script_91.OutMesh)  # disabled
panel_221 = Panel(c_script_92.OutMesh)  # disabled

# ---- group: Recursive Function to Generate Penrose String
c_script_106 = CSharpScript(startString=panel_182, rule6=panel_195, rule7=panel_192, rule8=panel_193, rule9=panel_194, num=num_4)  # -> out, PenroseString; inputs startString: String, rule6: String, rule7: String, rule8: String, rule9: String, num: Int32; disabled
# ---------- c_script_106: C# ----------
    // Declare string
    string finalString;
    finalString = startString;

    // Generate the string
    GrowString(ref num, ref finalString, rule6, rule7, rule8, rule9);

    // Return the string
    PenroseString = finalString;
# ---------- c_script_106: C# additional code ----------
  void GrowString(ref int num, ref string finalString, string rule6, string rule7, string rule8, string rule9)
  {
    // Decrement the count with each new execution  of the grow function
    num = num - 1;
    char rule;

    // Create new string
    string newString = "";
    for (int i = 0; i < finalString.Length; i++)
    {
      rule = finalString[i];
      if (rule == '6')
        newString = newString + rule6;
      if (rule == '7')
        newString = newString + rule7;
      if (rule == '8')
        newString = newString + rule8;
      if (rule == '9')
        newString = newString + rule9;

      if (rule == '[' || rule == ']' || rule == '+' || rule == '-')
        newString = newString + rule;
    }

    finalString = newString;

    // Stopper condition
    if (num == 0)
      return;

    // Grow again
    GrowString(ref num, ref finalString, rule6, rule7, rule8, rule9);
  }
# ---------- end c_script_106 ----------

# ---- group: Test if a given point is inside a mesh
c_script_107 = CSharpScript(mesh=mesh_4, pt=pt_30, tol=panel_219)  # -> out, IsInside; inputs mesh: Mesh, pt: Point3d, tol: Double; disabled
# ---------- c_script_107: C# ----------
    //Test if a given point is inside a mesh
    IsInside = mesh.IsPointInside(pt, tol, true);
# ---------- end c_script_107 ----------

# ---- group: delete every other face from the mesh then split disjoint meshes
c_script_108 = CSharpScript(mesh=mesh_5)  # -> out, OutMesh; inputs mesh: Mesh; disabled
# ---------- c_script_108: C# ----------
    List<int> face_indeces = new List<int>();

    //Loop through faces and delete every other face
    for (int i = 0; i <= mesh.Faces.Count - 1; i += 2) {
      face_indeces.Add(i);
    }

    //delete faces
    mesh.Faces.DeleteFaces(face_indeces);

    Mesh[] mesh_array = mesh.SplitDisjointPieces();

    //Assign output
    OutMesh = mesh_array;
# ---------- end c_script_108 ----------

# ---- group: Edge length
length_3 = Slider(6.3134, range=1..10)  # disabled

# ----
panel_222 = Panel(c_script_94)  # disabled

# ---- group: Delete a vertex and remove all faces associated with it
c_script_109 = CSharpScript(mesh=mesh_8, i=number_slider_22)  # -> out, OutMesh; inputs mesh: Mesh, i: Int32; disabled
# ---------- c_script_109: C# ----------
    //Remove a mesh vertex (make sure index falls within range)
    if (i >= 0 & i < mesh.Vertices.Count)
    {
      mesh.Vertices.Remove(i, true);
    }

    //Assign output
    OutMesh = mesh;
# ---------- end c_script_109 ----------

# ----
panel_223 = Panel(c_script_95.A)  # disabled
panel_224 = Panel(c_script_95.B)  # disabled
panel_225 = Panel(c_script_100.B)  # disabled
panel_226 = Panel(c_script_100.A)  # disabled
panel_227 = Panel(c_script_99.out)  # disabled
panel_228 = Panel(c_script_96.IsPrime)  # disabled
panel_229 = Panel(c_script_96.Factors)  # disabled
panel_230 = Panel(c_script_99.A)  # disabled
panel_231 = Panel(c_script_93.RevolutionSurface)  # disabled
panel_232 = Panel(c_script_101.OutMesh)  # disabled
panel_233 = Panel(c_script_98.NakedEdges)  # disabled
panel_234 = Panel(c_script_97.MeshOutline)  # disabled
panel_235 = Panel(c_script_107.IsInside)  # disabled

# ---- group: Deconstruct the mesh
demesh = DeconstructMesh(Mesh=c_script_91.OutMesh)  # -> Vertices, Faces, Colours, Normals; disabled

demesh_2 = DeconstructMesh(Mesh=c_script_92.OutMesh)  # -> Vertices, Faces, Colours, Normals; disabled

# ----
X = UnitX(Factor=12)  # disabled
move_3 = Move(Geometry=c_script_97.MeshOutline, Motion=X)  # -> Geometry, Transform; disabled

Z_2 = UnitZ(Factor=3)  # disabled
move_4 = Move(Geometry=c_script_98.NakedEdges, Motion=Z_2)  # -> Geometry, Transform; disabled

# ---- group: extract mesh edges
medges = MeshEdges(Mesh=c_script_105.OutMesh)  # -> NakedEdges, InteriorEdges, NonManifoldEdges; disabled

# ----
panel_236 = Panel(c_script_108.OutMesh)  # disabled

# ---- group: extract mesh edges
medges_2 = MeshEdges(Mesh=c_script_102.OutMesh)  # -> NakedEdges, InteriorEdges, NonManifoldEdges; disabled

medges_3 = MeshEdges(Mesh=c_script_104.OutMesh)  # -> NakedEdges, InteriorEdges, NonManifoldEdges; disabled

medges_4 = MeshEdges(Mesh=c_script_109.OutMesh)  # -> NakedEdges, InteriorEdges, NonManifoldEdges; disabled

# ---- group: Generate Penrose tiles
c_script_110 = CSharpScript(penroseString=c_script_106.PenroseString, length=length_3)  # -> out, PenroseLines; inputs penroseString: String, length: Double; disabled
# ---------- c_script_110: C# ----------
    //Parse instruction string to generate points
    //Let base point be world origin
    Point3d pt = Point3d.Origin;

    //Declare points array
    //Vector rotates with (+,-) instructions by 36 degrees
    List<Point3d> arrPoints = new List<Point3d>();

    //Draw forward direction
    //Vector direction will be rotated depending on (+,-) instructions
    Vector3d vec = new Vector3d(1.0, 0.0, 0.0);

    //Stacks of points and vectors
    List<Point3d> ptStack = new List<Point3d>();
    List<Vector3d> vStack = new List<Vector3d>();

    //Declare loop variables
    char rule;
    for(int i = 0 ; i < penroseString.Length; i++)
    {
      //Always start for 1 and length 1 to get one char at a time
      rule = penroseString[i];

      //Rotate Left
      if( rule == '+')
        vec.Rotate(36 * (Math.PI / 180), Vector3d.ZAxis);

      //Rotate Right
      if( rule == '-')
        vec.Rotate(-36 * (Math.PI / 180), Vector3d.ZAxis);


      //Draw Forward by direction
      if( rule == '1')
      {
        //Add current points
        Point3d newPt1 = new Point3d(pt);
        arrPoints.Add(newPt1);

        //Calculate next point
        Point3d newPt2 = pt + (vec * length);
        //Add next point
        arrPoints.Add(newPt2);

        //Save new location
        pt = newPt2;
      }

      //Save point location
      if( rule == '[')
      {
        //Save current point and direction
        Point3d newPt = new Point3d(pt);
        ptStack.Add(newPt);

        Vector3d newVec = new Vector3d(vec);
        vStack.Add(newVec);
      }

      //Retrieve point and direction
      if( rule == ']')
      {
        pt = ptStack[ptStack.Count - 1];
        vec = vStack[vStack.Count - 1];

        //Remove from stack
        ptStack.RemoveAt(ptStack.Count - 1);
        vStack.RemoveAt(vStack.Count - 1);
      }
    }

    //Generate lines
    List<Line> allLines = new List<Line>();
    for(int i = 1; i < arrPoints.Count; i = i + 2)
    {
      Line line = new Line(arrPoints[i - 1], arrPoints[i]);
      allLines.Add(line);
    }


    PenroseLines = allLines;
# ---------- end c_script_110 ----------

# ----
panel_237 = Panel(c_script_106.PenroseString)  # disabled

# ---- group: extract edges
medges_5 = MeshEdges(Mesh=c_script_108.OutMesh)  # -> NakedEdges, InteriorEdges, NonManifoldEdges; disabled

# ---- group: 2nd point
swatch_4 = ColourSwatch(SwatchColor=RGB(0, 0, 255))  # disabled
panel_238 = Panel("12")  # disabled
panel_239 = Panel("1")  # disabled
panel_240 = Panel("1")  # disabled

# ---- group: 1st point
swatch_5 = ColourSwatch(SwatchColor=RGB(255, 0, 0))  # disabled
panel_241 = Panel("5")  # disabled
panel_242 = Panel("0")  # disabled
panel_243 = Panel("4")  # disabled

# ---- group: 2nd point
swatch_6 = ColourSwatch(SwatchColor=RGB(0, 0, 255))  # disabled
panel_244 = Panel("1")  # disabled
panel_245 = Panel("12")  # disabled
panel_246 = Panel("1")  # disabled

# ---- group: 1st point
swatch_7 = ColourSwatch(SwatchColor=RGB(255, 0, 0))  # disabled
panel_247 = Panel("0")  # disabled
panel_248 = Panel("5")  # disabled
panel_249 = Panel("4")  # disabled

# ----
panel_250 = Panel("BREPS")  # disabled

# ---- group: point+color
swatch_8 = ColourSwatch(SwatchColor=RGB(122, 75, 255))  # disabled
panel_251 = Panel("1")  # disabled
panel_252 = Panel("12")  # disabled
panel_253 = Panel("1")  # disabled

# ---- group: point 0
swatch_9 = ColourSwatch(SwatchColor=RGB(122, 75, 255))  # disabled
panel_254 = Panel("1")  # disabled
panel_255 = Panel("5")  # disabled
panel_256 = Panel("4.3")  # disabled

# ---- group: Input brep
brep_3 = Brep(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)  # disabled

# ---- group: second point
swatch_10 = ColourSwatch(SwatchColor=RGB(122, 75, 255))  # disabled
panel_257 = Panel("12")  # disabled
panel_258 = Panel("1")  # disabled
panel_259 = Panel("1")  # disabled

# ---- group: input brep
brep_4 = Brep(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)  # disabled

# ---- group: first point
swatch_11 = ColourSwatch(SwatchColor=RGB(122, 75, 255))  # disabled
panel_260 = Panel("5")  # disabled
panel_261 = Panel("1")  # disabled
panel_262 = Panel("4.3")  # disabled

# ---- group: input corner points
pt_31 = Point([Point(0, 0, 0), Point(0, 17, 0), Point(-21, 17, 0), Point(-21, 0, 0), Point(-9.496207278, -4.796335135, 16), Point(3.350507129, 6.337484018, 16), Point(-10.40303418, 22.20695476, 16), Point(-23.24974858, 11.0731356, 16)])  # disabled

# ----
panel_263 = Panel("Brep methods")  # disabled
# custom types (enums, structs and classes)
list_6 = ValueList({"Red": 1, "Yellow": 2, "Green": 3, "Blue": 4}, selected="Blue")  # disabled

# ---- group: input
brep_5 = Brep(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)  # disabled

brep_6 = Brep(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)  # disabled

# ----
panel_264 = Panel("0.1")  # disabled

# ---- group: Input 2 breps
brep_7 = Brep([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])  # disabled

# ----
panel_265 = Panel("0.1")  # disabled

# ---- group: Planar brep with holes
brep_8 = Brep(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)  # disabled

# ----
brep_9 = Brep([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])  # disabled

# ---- group: input boundary curves
crv_20 = Curve([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])  # disabled

# ---- group: input boundary breps
brep_10 = Brep([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])  # disabled

# ----
panel_266 = Panel("0.01")  # disabled
points = PointList(Points=pt_31, Tags=True, Lines=True, Size=2)  # disabled

# ---- group: input brep
brep_11 = Brep(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)  # disabled

brep_12 = Brep(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)  # disabled

# ---- group: count the brep topology parts and extract geometry
c_script_111 = CSharpScript(brep=brep_3)  # -> out, Vertices, Curves, Surfaces; inputs brep: Brep; disabled
# ---------- c_script_111: C# ----------
    //print the number of geometry elements
    Print("brep.Vertices.Count = {0}", brep.Vertices.Count);
    Print("brep.Curves3D.Count = {0}", brep.Curves3D.Count);
    //untrimmed curves of all edges
    Print("brep.Curves2D.Count = {0}", brep.Curves2D.Count);
    Print("brep.Surfaces.Count = {0}", brep.Surfaces.Count);
    //untrimed surface of all faces

    //print the number of topology elements
    Print("brep.Trims.Count = {0}", brep.Trims.Count);
    Print("brep.Loops.Count = {0}", brep.Loops.Count);
    Print("brep.Faces.Count = {0}", brep.Faces.Count);
    Print("brep.Edges.Count = {0}", brep.Edges.Count);

    //extract 3d geometry elements
    Vertices = brep.Vertices;
    Curves = brep.Curves3D;
    Surfaces = brep.Surfaces;
# ---------- end c_script_111 ----------

# ---- group: Navigate the topology of the brep
c_script_112 = CSharpScript(brep=brep_4)  # -> out, Faces, FaceSurfaces, Loops2DCurves, Loops3DCurves, Edges, Trims2DCurves, Vertices; inputs brep: Brep; disabled
# ---------- c_script_112: C# ----------
    Rhino.Geometry.Collections.BrepFaceList faces = brep.Faces;
    List<Rhino.Geometry.Surface> surfaces = new List<Rhino.Geometry.Surface>();
    for(int fi = 0; fi < faces.Count; fi++)
    {
      BrepFace face = faces[fi];
      //Get Adjacent faces
      var aFaces = face.AdjacentFaces();
      //Get Adjacent edges
      var aEdges = face.AdjacentEdges();
      //Get face loops
      var faceLoops = face.Loops;
      //Get the 3D untrimmed surface
      var face3dSurface = face.UnderlyingSurface();
      surfaces.Add(face3dSurface);
    }
    Faces = faces;
    FaceSurfaces = surfaces;

    //BrepLoop topology (2D parameter space)
    Rhino.Geometry.Collections.BrepLoopList loops = brep.Loops;
    List<Rhino.Geometry.Curve> loops2DCrvs = new List<Rhino.Geometry.Curve>();
    List<Rhino.Geometry.Curve> loops3DCrvs = new List<Rhino.Geometry.Curve>();
    for(int li = 0; li < loops.Count; li++)
    {
      BrepLoop loop = loops[li];
      //Get loop face
      var loopFace = loop.Face;
      //Get loop trims
      var loopTrims = loop.Trims;
      //Get loop 2D and 3D curves
      var loop2dCurve = loop.To2dCurve();
      var loop3dCurve = loop.To3dCurve();
      loops2DCrvs.Add(loop2dCurve);
      loops3DCrvs.Add(loop3dCurve);
    }
    Loops2DCurves = loops2DCrvs;
    Loops3DCurves = loops3DCrvs;

    //BrepEdge topology (3D modeling space)
    Rhino.Geometry.Collections.BrepEdgeList edges = brep.Edges;
    for(int ei = 0; ei < edges.Count; ei++)
    {
      BrepEdge edge = edges[ei];
      //Get edge faces
      var eFaces_i = edge.AdjacentFaces();
      //Get edge start and end vertices
      var eStartVertex = edge.StartVertex;
      var eEndVertex = edge.EndVertex;
      //Get edge trim indices
      var eTrimIndeces = edge.TrimIndices();
      //Get edge 3D curve
      var e3dCurve = edge.EdgeCurve;
    }
    Edges = edges;

    //BrepTrim topology (2D parameter space)
    Rhino.Geometry.Collections.BrepTrimList trims = brep.Trims;
    for(int ti = 0; ti < trims.Count; ti++)
    {
      BrepTrim trim = trims[ti];
      //Get the edge
      var trimEdge = trim.Edge;
      //Get trim start and end vertices
      var trimStartVertex = trim.StartVertex;
      var trimEndVertex = trim.EndVertex;
      //Get trim loop
      var trimLoop = trim.Loop;
      //Get trim face
      var trimFace = trim.Face;
      //Get trim 2D curve
      var trim2dCurve = trim.TrimCurve;
    }
    Trims2DCurves = trims;

    //BrepVertex topology (3D modeling space)
    Rhino.Geometry.Collections.BrepVertexList vertices = brep.Vertices;
    for(int vi = 0; vi < vertices.Count; vi++)
    {
      BrepVertex vertex = vertices[vi];
      //Get vertex edges
      var vEdges = vertex.EdgeIndices();
      //Get vertex location
      var vPoint = vertex.Location;
    }
    Vertices = vertices;
# ---------- end c_script_112 ----------

# ---- group: Enum
c_script_113 = CSharpScript(signal=list_6)  # -> out; inputs signal: Int32; disabled
# ---------- c_script_113: C# ----------
    //Use if statement
    if( signal == (int) Traffic.Red)
      Print("STOP");
    else if(signal == (int) Traffic.Yellow)
      Print("YEILD");
    else if(signal == (int) Traffic.Green)
      Print("GO");
    else
      Print("This is not a traffic signal color!");
# ---------- c_script_113: C# additional code ----------
  //Define enum with traffic lights
  enum Traffic
  {
    Red = 1,
    Yellow = 2,
    Green = 3
  }
# ---------- end c_script_113 ----------

# ---- group: Struct example
c_script_114 = CSharpScript(x=panel_260, y=panel_262, z=panel_261, c=swatch_11, x1=panel_257, y1=panel_258, z1=panel_259, c1=swatch_10)  # -> out, MatchLoc, MatchColor, Saturation; inputs x: Double, y: Double, z: Double, c: Color, x1: Double, y1: Double, z1: Double, c1: Color; disabled
# ---------- c_script_114: C# usings ----------
using System.Drawing;
# ---------- c_script_114: C# ----------
    ColorPoint cp0 = new ColorPoint();
    //Using default constructor sets fiels to zero
    Print("Default ColorPoint 0: X=" + cp0.X + ", Y=" + cp0.Y + ", Z=" + cp0.Z + ", Color=" + cp0.C.Name);
    //set fields
    cp0.X = x;
    cp0.Y = y;
    cp0.Z = z;
    cp0.C = c;
    Print("ColorPoint 0: X=" + cp0.X + ", Y=" + cp0.Y + ", Z=" + cp0.Z + ", Color=" + cp0.C.Name);

    ColorPoint cp1 = new ColorPoint();
    //set fields
    cp1.X = x1;
    cp1.Y = y1;
    cp1.Z = z1;
    cp1.C = c1;
    Print("ColorPoint 1: X=" + cp1.X + ", Y=" + cp1.Y + ", Z=" + cp1.Z + ", Color=" + cp1.C.Name);

    //compare location
    MatchLoc = false;
    if(cp0.X == cp1.X && cp0.Y == cp1.Y && cp0.Z == cp1.Z)
      MatchLoc = true;

    //compare color
    MatchColor = cp0.C.Equals(cp1.C);

    //get saturation
    Saturation = cp0.Saturation;
# ---------- c_script_114: C# additional code ----------
  struct ColorPoint{
    //fields for the point XYZ location and color
    private double _x;
    private double _y;
    private double _z;
    private System.Drawing.Color _c;
    //properties to get and set the location and color
    public double X { get { return _x; } set { _x = value; } }
    public double Y { get { return _y; } set { _y = value; } }
    public double Z { get { return _z; } set { _z = value; } }
    public System.Drawing.Color C { get { return _c; } set { _c = value; } }
    public double Saturation { get { return _c.GetSaturation(); } }
  }
# ---------- end c_script_114 ----------

# ---- group: Preview 1st point
pt_32 = ConstructPoint(XCoordinate=panel_241, YCoordinate=panel_243, ZCoordinate=panel_242)  # disabled
preview_4 = CustomPreview(Geometry=pt_32, Material=swatch_5)  # disabled

# ---- group: Struct example
c_script_115 = CSharpScript(x=panel_241, y=panel_243, z=panel_242, c=swatch_5, x1=panel_238, y1=panel_239, z1=panel_240, c1=swatch_4)  # -> out, MatchLoc, MatchColor, AverageColor, AveragePoint; inputs x: Double, y: Double, z: Double, c: Color, x1: Double, y1: Double, z1: Double, c1: Color; disabled
# ---------- c_script_115: C# ----------
    ColorPoint cp0 = new ColorPoint(x, y, z, c);
    Print("ColorPoint 0: X=" + cp0.X + ", Y=" + cp0.Y + ", Z=" + cp0.Z + ", Color=" + cp0.C.Name + ", Saturation=" + cp0.Saturation());

    ColorPoint cp1 = new ColorPoint(x1, y1, z1, c1);
    Print("ColorPoint 1: X=" + cp1.X + ", Y=" + cp1.Y + ", Z=" + cp1.Z + ", Color=" + cp1.C.Name + ", Saturation=" + cp1.Saturation());

    //compare locationusing the static function "isEqualLocation" in ColorPoint
    MatchLoc = ColorPoint.isEqualLocation(cp0, cp1);

    //compare color using the static function "isEqualColor" in ColorPoint
    MatchColor = ColorPoint.isEqualColor(cp0, cp1);

    //Output average point and color
    ColorPoint aPt = ColorPoint.Average(cp0, cp1);
    AverageColor = aPt.C;
    AveragePoint = new Point3d(aPt.X, aPt.Y, aPt.Z);

    //First point passed by value
    Print("\nPass point1 by value");
    Print(" Before function call =(" + cp0.X + "," + cp0.Y + "," + cp0.Z + ")");
    ChangeLocationByValue(cp0);
    Print(" After function call =(" + cp0.X + "," + cp0.Y + "," + cp0.Z + ")");

    //Second points passed by reference
    Print("\nPass point2 by reference");
    Print(" Before function call =(" + cp1.X + "," + cp1.Y + "," + cp1.Z + ")");
    ChangeLocationByReference(ref cp1);
    Print(" After function call =(" + cp1.X + "," + cp1.Y + "," + cp1.Z + ")");
# ---------- c_script_115: C# additional code ----------
  struct ColorPoint{
    //fields
    private double _x;
    private double _y;
    private double _z;
    private System.Drawing.Color _c;

    //constructor
    public ColorPoint(double x, double y, double z, System.Drawing.Color c)
    {
      _x = x;
      _y = y;
      _z = z;
      _c = c;
    }

    //properties
    public double X { get { return _x; } set { _x = value; } }
    public double Y { get { return _y; } set { _y = value; } }
    public double Z { get { return _z; } set { _z = value; } }
    public System.Drawing.Color C { get { return _c; } set { _c = value; } }
    public double Saturation(){return _c.GetSaturation();}

    //static methods
    public static bool isEqualLocation(ColorPoint p1, ColorPoint p2)
    {
      return (p1.X == p2.X && p1.Y == p2.Y && p1.Z == p2.Z);
    }
    public static bool isEqualColor(ColorPoint p1, ColorPoint p2)
    {
      return p1.C.Equals(p2.C);
    }
    public static ColorPoint Average (ColorPoint a, ColorPoint b)
    {
      ColorPoint avPt = new ColorPoint();
      avPt.X = (a.X + b.X) / 2;
      avPt.Y = (a.Y + b.Y) / 2;
      avPt.Z = (a.Z + b.Z) / 2;
      avPt.C = Color.FromArgb((a.C.A + b.C.A) / 2, (a.C.R + b.C.R) / 2, (a.C.G + b.C.G) / 2, (a.C.B + b.C.B) / 2);
      return avPt;
    }

  }

  void ChangeLocationByValue(ColorPoint cp)
  {
    cp.X += 10;
    cp.Y += 10;
    cp.Z += 10;
    Print(" Inside change location= (" + cp.X + "," + cp.Y + "," + cp.Z + ")");
  }

  void ChangeLocationByReference(ref ColorPoint cp)
  {
    cp.X += 10;
    cp.Y += 10;
    cp.Z += 10;
    Print(" Inside change location= (" + cp.X + "," + cp.Y + "," + cp.Z + ")");
  }
# ---------- end c_script_115 ----------

# ---- group: preview 2nd point
pt_33 = ConstructPoint(XCoordinate=panel_238, YCoordinate=panel_239, ZCoordinate=panel_240)  # disabled
preview_5 = CustomPreview(Geometry=pt_33, Material=swatch_4)  # disabled

# ---- group: Preview 1st point
pt_34 = ConstructPoint(XCoordinate=panel_248, YCoordinate=panel_249, ZCoordinate=panel_247)  # disabled
preview_6 = CustomPreview(Geometry=pt_34, Material=swatch_7)  # disabled

# ---- group: class example
c_script_116 = CSharpScript(x=panel_248, y=panel_249, z=panel_247, c=swatch_7, x1=panel_245, y1=panel_246, z1=panel_244, c1=swatch_6)  # -> out, MatchLoc, MatchColor, AverageColor, AveragePoint; inputs x: Double, y: Double, z: Double, c: Color, x1: Double, y1: Double, z1: Double, c1: Color; disabled
# ---------- c_script_116: C# ----------
    CColorPoint cp0 = new CColorPoint(x, y, z, c);
    Print("ColorPoint 0: X=" + cp0.X + ", Y=" + cp0.Y + ", Z=" + cp0.Z + ", Color=" + cp0.C.Name + ", Saturation=" + cp0.Saturation());

    CColorPoint cp1 = new CColorPoint(x1, y1, z1, c1);
    Print("ColorPoint 1: X=" + cp1.X + ", Y=" + cp1.Y + ", Z=" + cp1.Z + ", Color=" + cp1.C.Name + ", Saturation=" + cp1.Saturation());

    //compare locationusing the static function "isEqualLocation" in ColorPoint
    MatchLoc = CColorPoint.IsEqualLocation(cp0, cp1);

    //compare color using the static function "isEqualColor" in ColorPoint
    MatchColor = CColorPoint.isEqualColor(cp0, cp1);

    //Output average point and color
    CColorPoint aPt = CColorPoint.Average(cp0, cp1);
    AverageColor = aPt.C;
    AveragePoint = new Point3d(aPt.X, aPt.Y, aPt.Z);

    //First point passed by value
    Print("\nPass point1 by value");
    Print(" Before function call =(" + cp0.X + "," + cp0.Y + "," + cp0.Z + ")");
    ChangeLocationByValue(cp0);
    Print(" After function call =(" + cp0.X + "," + cp0.Y + "," + cp0.Z + ")");

    //Second points passed by reference
    Print("\nPass point2 by reference");
    Print(" Before function call =(" + cp1.X + "," + cp1.Y + "," + cp1.Z + ")");
    ChangeLocationByReference(ref cp1);
    Print(" After function call =(" + cp1.X + "," + cp1.Y + "," + cp1.Z + ")");

    //Note: class instances are ALWAYS passed by reference with or without "ref"
# ---------- c_script_116: C# additional code ----------
  class CPoint{
    //fields
    private double _x;
    private double _y;
    private double _z;
    //constructors
    public CPoint() : this(0, 0, 0) //default calls another constructor
    {
    }
    public CPoint(double x, double y, double z)
    {
      _x = x;
      _y = y;
      _z = z;
    }
    //properties
    public double X { get { return _x; } set { _x = value; } }
    public double Y { get { return _y; } set { _y = value; } }
    public double Z { get { return _z; } set { _z = value; } }
    //static methods
    public static bool IsEqualLocation(CColorPoint p1, CColorPoint p2)
    {
      return (p1.X == p2.X && p1.Y == p2.Y && p1.Z == p2.Z);
    }
  }

  //Color point inherits from Point class
  //That means it can access all its methods and fields
  class CColorPoint: CPoint{
    //fields
    private System.Drawing.Color _c;

    //default constructor
    public CColorPoint()
    {
      X = 0;
      Y = 0;
      Z = 0;
      _c = System.Drawing.Color.White;
    }
    //constructor
    public CColorPoint(double x, double y, double z, System.Drawing.Color c)
    {
      X = x;
      Y = y;
      Z = z;
      _c = c;
    }

    //properties
    public System.Drawing.Color C { get { return _c; } set { _c = value; } }

    //methods
    public double Saturation(){return _c.GetSaturation();}

    //static methods
    public static bool isEqualColor(CColorPoint p1, CColorPoint p2)
    {
      return p1.C.Equals(p2.C);
    }
    public static CColorPoint Average (CColorPoint a, CColorPoint b)
    {
      CColorPoint avPt = new CColorPoint();
      avPt.X = (a.X + b.X) / 2;
      avPt.Y = (a.Y + b.Y) / 2;
      avPt.Z = (a.Z + b.Z) / 2;
      avPt.C = Color.FromArgb((a.C.A + b.C.A) / 2, (a.C.R + b.C.R) / 2, (a.C.G + b.C.G) / 2, (a.C.B + b.C.B) / 2);
      return avPt;
    }
  }

  void ChangeLocationByValue(CColorPoint cp)
  {
    cp.X += 10;
    cp.Y += 10;
    cp.Z += 10;
    Print(" Inside change location= (" + cp.X + "," + cp.Y + "," + cp.Z + ")");
  }

  void ChangeLocationByReference(ref CColorPoint cp)
  {
    cp.X += 10;
    cp.Y += 10;
    cp.Z += 10;
    Print(" Inside change location= (" + cp.X + "," + cp.Y + "," + cp.Z + ")");
  }
# ---------- end c_script_116 ----------

# ---- group: preview 2nd point
pt_35 = ConstructPoint(XCoordinate=panel_245, YCoordinate=panel_246, ZCoordinate=panel_244)  # disabled
preview_7 = CustomPreview(Geometry=pt_35, Material=swatch_6)  # disabled

# ---- group: Interface
c_script_117 = CSharpScript(x=panel_255, y=panel_256, z=panel_254, c=swatch_9, x1=panel_252, y1=panel_253, z1=panel_251, c1=swatch_8)  # -> out, Equal; inputs x: Double, y: Double, z: Double, c: Color, x1: Double, y1: Double, z1: Double, c1: Color; disabled
# ---------- c_script_117: C# ----------
    ColorPoint cp0 = new ColorPoint();
    //set fields
    cp0.X = x;
    cp0.Y = y;
    cp0.Z = z;
    cp0.C = c;
    Print("ColorPoint 0: X=" + cp0.X + ", Y=" + cp0.Y + ", Z=" + cp0.Z + ", Color=" + cp0.C.Name);

    ColorPoint cp1 = new ColorPoint();
    //set fields
    cp1.X = x1;
    cp1.Y = y1;
    cp1.Z = z1;
    cp1.C = c1;
    Print("ColorPoint 1: X=" + cp1.X + ", Y=" + cp1.Y + ", Z=" + cp1.Z + ", Color=" + cp1.C.Name);

    //Equality test
    Equal = cp0.Equals(cp1);
# ---------- c_script_117: C# additional code ----------
  struct ColorPoint: IEquatable<ColorPoint>
  {
    //fields
    private double _x;
    private double _y;
    private double _z;
    private System.Drawing.Color _c;
    //properties
    public double X { get { return _x; } set { _x = value; } }
    public double Y { get { return _y; } set { _y = value; } }
    public double Z { get { return _z; } set { _z = value; } }
    public System.Drawing.Color C { get { return _c; } set { _c = value; } }
    //implement Equals method inside IEquatable interface - if omitted, you’ll get error
    public bool Equals(ColorPoint pt)
    {
      return (this._x == pt._x && this._y == pt._y && this._z == pt._z && this._c == pt._c);
    }
  }
# ---------- end c_script_117 ----------

# ---- group: Create Brep box
c_script_118 = CSharpScript(corners=pt_31)  # -> out, BrepBox; inputs corners: list of Point3d; disabled
# ---------- c_script_118: C# ----------
    //Build the brep from corners
    Brep twistedBox = Brep.CreateFromBox(corners);

    BrepBox = twistedBox;
# ---------- end c_script_118 ----------

# ---- group: Create edge Brep
c_script_119 = CSharpScript(crvs=crv_20)  # -> out, EdgeBrep; inputs crvs: list of Curve; disabled
# ---------- c_script_119: C# ----------
    //Build the brep from edges
    Brep brep = Brep.CreateEdgeSurface(crvs);

    //Assign output
    EdgeBrep = brep;
# ---------- end c_script_119 ----------

# ---- group: Create solid Brep
c_script_120 = CSharpScript(breps=brep_10, tol=panel_266)  # -> out, SolidBrep; inputs breps: list of Brep, tol: Double; disabled
# ---------- c_script_120: C# ----------
    //Build the brep from corners
    Brep[] solids = Brep.CreateSolid(breps, tol);

    //Assign output
    SolidBrep = solids;
# ---------- end c_script_120 ----------

# ---- group: Find if breps is solid (process 1 brep at a time)
c_script_121 = CSharpScript(brep=brep_9)  # -> out, A; inputs brep: Brep; disabled
# ---------- c_script_121: C# ----------
    //Assign output
    if(brep.IsValid)
      A = brep.IsSolid;
# ---------- end c_script_121 ----------

# ---- group: Process the list of breps
c_script_122 = CSharpScript(breps=brep_9)  # -> out, A; inputs breps: list of Brep; disabled
# ---------- c_script_122: C# ----------
    List<bool> isSolid = new List<bool>();
    foreach( Brep brep in breps)
      if( brep.IsValid )
        isSolid.Add(brep.IsSolid);

    A = isSolid;
# ---------- end c_script_122 ----------

# ---- group: Find a brep bounding box and its center
c_script_123 = CSharpScript(brep=brep_5)  # -> out, BBox, BBoxCenter; inputs brep: Brep; disabled
# ---------- c_script_123: C# ----------
    //Declare variables
    BoundingBox bbox = new BoundingBox();
    Point3d center = default(Point3d);

    //Find the boundingbox
    bbox = brep.GetBoundingBox(true);

    //Find the center of the bounding box
    center = bbox.Center;

    //Assign output
    BBox = bbox;
    BBoxCenter = center;
# ---------- end c_script_123 ----------

# ---- group: Calculate the brep area, volume and centroid
c_script_124 = CSharpScript(brep=brep_6)  # -> out, Area, Vol, Centroid; inputs brep: Brep; disabled
# ---------- c_script_124: C# ----------
    //Declare variable
    double volume = 0;
    double area = 0;
    Point3d vc = default(Point3d);

    //Create a new instance of the mass properties classes
    VolumeMassProperties volume_mass = VolumeMassProperties.Compute(brep);
    AreaMassProperties area_mass = AreaMassProperties.Compute(brep);

    //Calculate area, volume and centroid
    area = brep.GetArea();
    //or: area = area_mass.Area
    volume = brep.GetVolume();
    //or: volume = volume_mass.Volume
    vc = volume_mass.Centroid;


    //Print
    Print(string.Format("Area = {0:F2}", area));
    Print(string.Format("Volume = {0:F2}", volume));
    Print(string.Format("Volume centroid = ({0:F2},{1:F2},{2:F2})", vc.X, vc.Y, vc.Z));

    //Assign output
    Area = area;
    Vol = volume;
    Centroid = vc;
# ---------- end c_script_124 ----------

# ---- group: Merge coplanar faces
c_script_125 = CSharpScript(brep=brep_8, tol=panel_264)  # -> out, MergedBrep; inputs brep: Brep, tol: Double; disabled
# ---------- c_script_125: C# ----------
    //merge all coplanar faces
    if( brep.MergeCoplanarFaces(tol) )
      MergedBrep = brep;
# ---------- end c_script_125 ----------

# ---- group: BooleanUnion 2 breps
c_script_126 = CSharpScript(breps=brep_7, tol=panel_265)  # -> out, BooleanedBreps; inputs breps: list of Brep, tol: Double; disabled
# ---------- c_script_126: C# ----------
    //Boolean union the input breps
    Brep[] unionBrep = Brep.CreateBooleanUnion(breps, tol);

    BooleanedBreps = unionBrep;
# ---------- end c_script_126 ----------

# ---- group: Extract outline of a brep and ignor the holes
c_script_127 = CSharpScript(brep=brep_11)  # -> out, Outline; inputs brep: Brep; disabled
# ---------- c_script_127: C# ----------
    //declare outline list of curves
    List<Curve> outlineCrvs = new List<Curve>();

    //check all the loops

    foreach (BrepLoop e_loop in brep.Loops) {
      //Make sure the loop type is outer

      if (e_loop.LoopType == BrepLoopType.Outer) {
        //Navigate through the trims of the loop

        foreach (BrepTrim trim in e_loop.Trims) {
          //Get the edge of each trim
          BrepEdge edge = trim.Edge;

          //Check if the edge has only one trim

          if (edge.TrimCount == 1) {
            //Add a copy of the edge curve to the list
            outlineCrvs.Add(edge.DuplicateCurve());
          }
        }
      }
    }

    //Assign output
    Outline = outlineCrvs;
# ---------- end c_script_127 ----------

# ---- group: Move the faces away from the brep center
c_script_128 = CSharpScript(brep=brep_12)  # -> out, A; inputs brep: Brep; disabled
# ---------- c_script_128: C# ----------
    //Declare a new ist of faces
    List<Brep> faces = new List<Brep>();

    //Find the center
    Point3d center = brep.GetBoundingBox(true).Center;

    //Check all the faces
    for (int i = 0; i <= brep.Faces.Count - 1; i++) {
      //extract the faces
      int[] i_list = { i };
      Brep face = brep.DuplicateSubBrep(i_list);

      //Find face center
      Point3d face_center = face.GetBoundingBox(true).Center;

      //Find moving direction
      Vector3d dir = new Vector3d();
      dir = face_center - center;

      //move the face
      face.Translate(dir);

      //Add to the list
      faces.Add(face);
    }

    //Assign output
    A = faces;
# ---------- end c_script_128 ----------

# ----
panel_267 = Panel("""18,0,1
18,0,-1""")  # disabled
panel_268 = Panel(c_script_111.out)  # disabled
Y = UnitY(Factor=28)  # disabled
Y_2 = UnitY(Factor=28)  # disabled
Y_3 = UnitY(Factor=60)  # disabled
swatch_12 = ColourSwatch(SwatchColor=RGBA(161, 16, 16, 170))  # disabled
swatch_13 = ColourSwatch(SwatchColor=RGB(16, 125, 161))  # disabled
swatch_14 = ColourSwatch(SwatchColor=RGB(212, 120, 21))  # disabled
swatch_15 = ColourSwatch(SwatchColor=RGB(79, 161, 16))  # disabled
swatch_16 = ColourSwatch(SwatchColor=RGB(0, 0, 0))  # disabled
panel_269 = Panel(c_script_113)  # disabled
panel_270 = Panel(c_script_121.A)  # disabled
panel_271 = Panel(c_script_122.A)  # disabled
panel_272 = Panel(c_script_117.out)  # disabled
panel_273 = Panel(c_script_117.Equal)  # disabled
panel_274 = Panel(c_script_114.MatchLoc)  # disabled
panel_275 = Panel(c_script_114.out)  # disabled
panel_276 = Panel(c_script_114.MatchColor)  # disabled
move_5 = Move(Geometry=c_script_111.Vertices, Motion=Y)  # -> Geometry, Transform; disabled
move_6 = Move(Geometry=c_script_111.Curves, Motion=Y_2)  # -> Geometry, Transform; disabled
move_7 = Move(Geometry=c_script_111.Surfaces, Motion=Y_3)  # -> Geometry, Transform; disabled
panel_277 = Panel(c_script_114.Saturation)  # disabled
move_8 = Move(Geometry=c_script_120.SolidBrep, Motion=panel_267)  # -> Geometry, Transform; disabled

swatch_17 = ColourSwatch(SwatchColor=RGB(0, 0, 255))  # disabled
move_9 = Move(Geometry=c_script_127.Outline, Motion=Vector(0, 0, 10))  # -> Geometry, Transform; disabled
preview_8 = CustomPreview(Geometry=move_9.Geometry, Material=swatch_17)  # disabled

swatch_18 = ColourSwatch(SwatchColor=RGBA(183, 0, 0, 116))  # disabled
preview_9 = CustomPreview(Geometry=c_script_128.A, Material=swatch_18)  # disabled

panel_278 = Panel(c_script_124.Area)  # disabled
panel_279 = Panel(c_script_124.Centroid)  # disabled
panel_280 = Panel(c_script_124.out)  # disabled
panel_281 = Panel(c_script_124.Vol)  # disabled

swatch_19 = ColourSwatch(SwatchColor=RGBA(183, 0, 0, 116))  # disabled
preview_10 = CustomPreview(Geometry=c_script_126.BooleanedBreps, Material=swatch_19)  # disabled

# ---- group: Preview average point
preview_11 = CustomPreview(Geometry=c_script_115.AveragePoint, Material=c_script_115.AverageColor)  # disabled

# ----
panel_282 = Panel(c_script_115.out)  # disabled
panel_283 = Panel(c_script_115.MatchLoc)  # disabled
panel_284 = Panel(c_script_115.AverageColor)  # disabled
panel_285 = Panel(c_script_115.MatchColor)  # disabled
preview_12 = CustomPreview(Geometry=c_script_112.FaceSurfaces, Material=swatch_12)  # disabled
preview_13 = CustomPreview(Geometry=c_script_112.Edges, Material=swatch_13)  # disabled
preview_14 = CustomPreview(Geometry=c_script_112.Loops2DCurves, Material=swatch_14)  # disabled
preview_15 = CustomPreview(Geometry=c_script_112.Trims2DCurves, Material=swatch_15)  # disabled
preview_16 = CustomPreview(Geometry=c_script_112.Vertices, Material=swatch_16)  # disabled

# ---- group: Preview average point
preview_17 = CustomPreview(Geometry=c_script_116.AveragePoint, Material=c_script_116.AverageColor)  # disabled

# ----
panel_286 = Panel(c_script_116.out)  # disabled
panel_287 = Panel(c_script_116.MatchLoc)  # disabled
panel_288 = Panel(c_script_116.MatchColor)  # disabled
panel_289 = Panel(c_script_116.AverageColor)  # disabled
swatch_20 = ColourSwatch(SwatchColor=RGB(0, 0, 0))  # disabled
swatch_21 = ColourSwatch(SwatchColor=RGB(0, 0, 255))  # disabled
swatch_22 = ColourSwatch(SwatchColor=RGBA(183, 0, 0, 116))  # disabled
preview_18 = CustomPreview(Geometry=move_5.Geometry, Material=swatch_20)  # disabled
preview_19 = CustomPreview(Geometry=move_6.Geometry, Material=swatch_21)  # disabled
preview_20 = CustomPreview(Geometry=move_7.Geometry, Material=swatch_22)  # disabled
xz = XZPlane(Origin=Point(0, 0, 0))  # disabled
box = Box([{Plane=PlaneXY(-1.235968029, -1.041866152, 0), X=Domain(0, 3.093942717), Y=Domain(0, 2.777773389), Z=Domain(0, 1.857000012)}, {Plane=PlaneXY(-4.126659035, -1.538703668, 0), X=Domain(0, 4.516704697), Y=Domain(0, 2.303519395), Z=Domain(0, 1.058538675)}])  # disabled
panel_290 = Panel("Make2D")  # disabled
toggle_3 = BooleanToggle(True)  # disabled

# ---- group: Extract 2D drawing (Make2D)
c_script_129 = CSharpScript(geomList=box, cplaneList=xz)  # -> out, VCurves, HCurves, VCut, HCut; inputs geomList: list of GeometryBase, cplaneList: list of Plane; disabled
# ---------- c_script_129: C# ----------
    //Use the active view in the Rhino document
    var _view = doc.Views.ActiveView;
    //Set Make2D Parameters
    var _hldParams = new HiddenLineDrawingParameters
      {
        AbsoluteTolerance = doc.ModelAbsoluteTolerance,
        IncludeTangentEdges = false,
        IncludeHiddenCurves = true
        };
    _hldParams.SetViewport(_view.ActiveViewport);

    //add objects to hld_param
    foreach (var geom in geomList){
      _hldParams.AddGeometry(geom, Transform.Identity, null);
    }

    //Add clipping planes
    foreach (var cplane in cplaneList ){
      _hldParams.AddClippingPlane(cplane);
    }

    //perform HLD calculation
    var  visibleList = new List<Curve>();
    var  hiddenList = new List<Curve>();
    var  secVisibleList = new List<Curve>();
    var  secHiddenList = new List<Curve>();
    var _hld = HiddenLineDrawing.Compute(_hldParams, true);
    if (_hld != null)
    {
      //transform
      var flatten = Transform.PlanarProjection(Plane.WorldXY);
      BoundingBox pageBox = _hld.BoundingBox(true);
      var delta2D = new Vector2d(0, 0);
      delta2D = delta2D - new Vector2d(pageBox.Min.X, pageBox.Min.Y);
      var delta3D = Transform.Translation(new Vector3d(delta2D.X, delta2D.Y, 0.0));
      flatten = delta3D * flatten;
      //add curves to lists
      foreach (HiddenLineDrawingSegment hldCurve in _hld.Segments)
      {
        if (hldCurve == null ||
          hldCurve.ParentCurve == null ||
          hldCurve.ParentCurve.SilhouetteType == SilhouetteType.None)
          continue;
        var crv = hldCurve.CurveGeometry.DuplicateCurve();
        if (crv != null)
        {
          crv.Transform(flatten);
          if (hldCurve.SegmentVisibility == HiddenLineDrawingSegment.Visibility.Visible)
          {
            if (hldCurve.ParentCurve.SilhouetteType == SilhouetteType.SectionCut)
              secVisibleList.Add(crv);
            else
              visibleList.Add(crv);
          }
          else if (hldCurve.SegmentVisibility == HiddenLineDrawingSegment.Visibility.Hidden)
          {
            if (hldCurve.ParentCurve.SilhouetteType == SilhouetteType.SectionCut)
              secHiddenList.Add(crv);
            else
              hiddenList.Add(crv);
          }
        }
      }
    }

    VCurves = visibleList;
    HCurves = hiddenList;
    VCut = secVisibleList;
    HCut = secHiddenList;
# ---------- end c_script_129 ----------

# ---- group: Set to your points file
# read points from a text file
path = FilePath("C:\Users\Rajaa Issa\Desktop\points.txt")  # disabled

# ----
c_script_130 = CSharpScript(path=path, read=toggle_3)  # -> out, Points; inputs path: String, read: Boolean; disabled
# ---------- c_script_130: C# ----------
    if ((!File.Exists(path)) || !read) {
      //Show message box
      System.Windows.Forms.MessageBox.Show("File does not exist or could not be read");
      //Give feedbacj in the component out parameter
      Print("Exit without reading");
      return;
    }

    //Read the file
    string[] lines = File.ReadAllLines(path);

    //Check that file is not empty
    if ((lines == null)) {
      Print("File has no content");
      return;
    }

    //Declare list of points
    List<Point3d> pts = new List<Point3d>();

    //Charachters to remove
    var charsToRemove = new string[] { " ", ")", "(", "[", "]", "{", "}" };

    //Loop through lines
    foreach (string line in lines)
    {
      //Trim
      var t_line = line;
      foreach (var c in charsToRemove)
      {
        t_line = t_line.Replace(c, string.Empty);
      }

      //Check if line is empty
      if (String.IsNullOrEmpty(line)) continue;

      //Tokenize line into array of strings separated by ","
      string[] parts = t_line.Split(",".ToCharArray());

      //Make sure that each line has exactly 3 values
      if (parts.Length != 3)
        continue;

      //Convert each coordinate from string to double
      double x = Convert.ToDouble(parts[0]);
      double y = Convert.ToDouble(parts[1]);
      double z = Convert.ToDouble(parts[2]);

      //create the point and add to the list
      pts.Add(new Point3d(x, y, z));
    }

    Points = pts;
# ---------- end c_script_130 ----------
swatch_23 = ColourSwatch(SwatchColor=RGB(255, 171, 171))  # disabled
swatch_24 = ColourSwatch(SwatchColor=RGB(222, 222, 222))  # disabled
swatch_25 = ColourSwatch(SwatchColor=RGB(255, 0, 0))  # disabled
swatch_26 = ColourSwatch(SwatchColor=RGB(0, 0, 0))  # disabled
crv_21 = NurbsCurve(Vertices=c_script_130.Points, Degree=3, Periodic=False)  # -> Curve, Length, Domain; disabled
panel_291 = Panel(c_script_130.Points)  # disabled
preview_21 = CustomPreview(Geometry=c_script_129.VCut, Material=swatch_25)  # disabled
preview_22 = CustomPreview(Geometry=c_script_129.VCut, Material=swatch_23)  # disabled
preview_23 = CustomPreview(Geometry=c_script_129.VCurves, Material=swatch_26)  # disabled
preview_24 = CustomPreview(Geometry=c_script_129.HCurves, Material=swatch_24)  # disabled
panel_292 = Panel("Transformation")  # disabled
panel_293 = Panel("Pi/4")  # disabled
geo_2 = Geometry([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])  # disabled
panel_294 = Panel("0.5")  # disabled
panel_295 = Panel("6,0,0")  # disabled

# ---- group: input
brep_13 = Brep(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)  # disabled

# ---- group: Input geometry
geo_3 = Geometry([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])  # disabled

# ----
a = Slider(8, range=0..90)  # disabled
a_2 = Slider(8, range=0..90)  # disabled

# ---- group: Scale, rotate and translate (move) objects
c_script_131 = CSharpScript(objs=geo_2, factor=panel_294, angle=panel_293, dir=panel_295)  # -> out, XformGeom; inputs objs: list of GeometryBase, factor: Double, angle: Double, dir: Vector3d; disabled
# ---------- c_script_131: C# ----------
    //Create a new list of geometry objects
    List<GeometryBase> newGeom = new List<GeometryBase>();


    foreach (GeometryBase obj in objs) {
      //scale, rotate And move
      obj.Scale(factor);
      obj.Rotate(angle, Vector3d.YAxis, Point3d.Origin);
      obj.Translate(dir);

      //add to list
      newGeom.Add(obj);
    }

    //Assign output
    XformGeom = newGeom;
# ---------- end c_script_131 ----------

# ---- group: shear transformation
c_script_132 = CSharpScript(brep=brep_13)  # -> out, outBrep, Xform; inputs brep: Brep; disabled
# ---------- c_script_132: C# ----------
    //create a shear Transform
    Transform xform = Transform.Shear(Plane.WorldXY, new Vector3d(0.5, 0.5, 0), Vector3d.YAxis, Vector3d.ZAxis);

    //shear the brep
    brep.Transform(xform);

    //Assign output
    outBrep = brep;
    Xform = xform;
# ---------- end c_script_132 ----------

# ---- group: Project a list of curve to WorldXY plane
c_script_133 = CSharpScript(geomList=geo_3)  # -> out, ProjectedGeom; inputs geomList: list of GeometryBase; disabled
# ---------- c_script_133: C# ----------
    //Create a new list of geometry objects
    List<GeometryBase> projList = new List<GeometryBase>();

    foreach (GeometryBase geom in geomList) {
      //Create a project transform
      geom.Transform(Transform.PlanarProjection(Plane.WorldXY));

      //add to list
      projList.Add(geom);
    }

    //Assign output
    ProjectedGeom = projList;
# ---------- end c_script_133 ----------

# ----
panel_296 = Panel("Iteration")  # disabled
rad = Radians(Degrees=a_2)  # disabled
rad_2 = Radians(Degrees=a)  # disabled
# Recursion:
# Take part of a line, create new line and rotate
# Stop when length is < min_length
ln = Line(StartPoint=Point(-16, 2, 0), EndPoint=Point(-3, 2, 0))  # disabled
ln_2 = Line(StartPoint=Point(-16, 2, 0), EndPoint=Point(-3, 2, 0))  # disabled
num_5 = Number(1)  # disabled
num_6 = Number(1)  # disabled
panel_297 = Panel(c_script_132.outBrep)  # disabled
matrix = TransformMatrix(c_script_132.Xform, Digits=3)  # disabled

# ---- group: output
geo_4 = Geometry(c_script_131.XformGeom)  # disabled

geo_5 = Geometry(c_script_133.ProjectedGeom)  # disabled

# ----
c_script_134 = CSharpScript(inputLine=ln, angle=rad, minLength=num_6)  # -> out, Lines; inputs inputLine: Line, angle: Double, minLength: Double; disabled
# ---------- c_script_134: C# ----------
    //Declare all lines
    List<Line> allLines = new List<Line>();

    //Append input line as a first line in the list of lines
    allLines.Add(inputLine);

    //Call recursive function
    DivideAndRotate(inputLine, ref allLines, angle, minLength);

    //Assign return value
    Lines = allLines;
# ---------- c_script_134: C# additional code ----------
  public void DivideAndRotate(Line currLine, ref List<Line> allLines, double angle, double minLength)
  {
    //Check the stopping condition
    if (currLine.Length < minLength)
      return;

    //Take a portion of the line
    Line newLine = new Line();
    newLine = currLine;

    Point3d endPt = new Point3d();
    endPt = newLine.PointAt(0.95);

    newLine.To = endPt;

    //Rotate
    Transform xform = default(Transform);
    xform = Transform.Rotation(angle, Vector3d.ZAxis, newLine.From);
    newLine.Transform(xform);

    allLines.Add(newLine);

    //Call self
    DivideAndRotate(newLine, ref allLines, angle, minLength);
  }
# ---------- end c_script_134 ----------
c_script_135 = CSharpScript(inputLine=ln_2, angle=rad_2, minLength=num_5)  # -> out, Lines; inputs inputLine: Line, angle: Double, minLength: Double; disabled
# ---------- c_script_135: C# ----------
    //Declare all lines
    var allLines = new List<Line>();
    //Find current length
    double length = inputLine.Length;
    Line newLine = default(Line);
    newLine = inputLine;
    //Loop until length is less than min length
    while (length > minLength) {
      //Generate the new line
      newLine = DivideAndRotate(newLine, angle);
      //Add to list
      allLines.Add(newLine);
      //Stopping condition
      length = newLine.Length;
    }
    //Assign return value
    Lines = allLines;
# ---------- c_script_135: C# additional code ----------
  public Line DivideAndRotate(Line currLine, double angle)
  {
    //Take a portion of the line
    Line newLine = new Line();
    newLine = currLine;
    Point3d endPt = new Point3d();
    endPt = newLine.PointAt(0.95);
    newLine.To = endPt;
    //Rotate
    newLine.Transform(Transform.Rotation(angle, Vector3d.ZAxis, newLine.From));
    //Function return
    return newLine;
  }
# ---------- end c_script_135 ----------
