# Grasshopper definition brise_parametrico.gh (Grasshopper 1.0.7)

number_slider = Slider(25, range=1..100)
curve = Curve(<curve referenced from the Rhino model>)

# ---- group: Criação dos eixos dos montantes
divide_curve = DivideCurve(Curve=curve, Count=number_slider, Kinks=False)  # -> Points, Tangents, Parameters
unit_z = UnitZ(Factor=Slider(8.711, range=0..100))
point = Point(divide_curve.Points)
move = Move(Geometry=point, Motion=unit_z)  # -> Geometry, Transform
line = Line(StartPoint=point, EndPoint=move.Geometry)

# ----
panel = Panel(curve)
panel_2 = Panel(divide_curve.Points)
number_slider_2 = Slider(10, range=0..100)

# ---- group: Manipulação da lista de eixos de pilares
cull_index = CullIndex(List=line, Indices=number_slider, Wrap=True)
cull_index_2 = CullIndex(List=line, Indices="0", Wrap=True)

# ---- group: Eixos das aletas do brise
divide_curve_2 = DivideCurve(Curve=cull_index, Count=number_slider_2, Kinks=False)  # -> Points, Tangents, Parameters
divide_curve_3 = DivideCurve(Curve=cull_index_2, Count=number_slider_2, Kinks=False)  # -> Points, Tangents, Parameters
line_2 = Line(StartPoint=divide_curve_2.Points, EndPoint=divide_curve_3.Points)

# ---- group: Criação das aletas
construct_plane = ConstructPlane(Origin=divide_curve_2.Points, XAxis=line_2, YAxis=divide_curve_2.Tangents)
deconstruct_plane = DeconstructPlane(Plane=construct_plane)  # -> Origin, XAxis, YAxis, ZAxis
construct_plane_2 = ConstructPlane(Origin=deconstruct_plane.Origin, XAxis=deconstruct_plane.ZAxis, YAxis=deconstruct_plane.YAxis)
cluster_retangulo_eixo = ClusterRetanguloEixo(plane=construct_plane_2, angle=Slider(-30, range=-360..360), dim_x=Slider(0.39, range=0..1), dim=Slider(0.2, range=0..1))
extrude_along = ExtrudeAlong(Base=cluster_retangulo_eixo, Curve=line_2)
cap_holes = CapHoles(Brep=extrude_along)

# ==== cluster ClusterRetanguloEixo
dim_x = ClusterInput()
plane = ClusterInput()
angle = ClusterInput()
dim = ClusterInput()
rotate_plane = RotatePlane(Plane=plane, Angle=degrees(angle))
dim_x_2 = Number(dim_x)
dim_2 = Number(dim)
division = Division(A=dim_2, B="2")
division_2 = Division(A=dim_x_2, B="2")
negative = Negative(Value=division_2)
negative_2 = Negative(Value=division)
construct_domain = ConstructDomain(DomainStart=negative_2, DomainEnd=division)
construct_domain_2 = ConstructDomain(DomainStart=negative, DomainEnd=division_2)
rectangle = Rectangle(Plane=rotate_plane, XSize=construct_domain_2, YSize=construct_domain, Radius=0)  # -> Rectangle, Length
rectangle_2 = ClusterOutput(rectangle.Rectangle)
