# Grasshopper definition list_handling.gh (Grasshopper 1.0.7)

curve = Curve()
panel = Panel("""a
b
c
d
e
f""")
divide_curve = DivideCurve(Curve=curve, Count=10, Kinks=False)  # -> Points, Tangents, Parameters
series = Series(Start=Slider(0, range=-10..10), Step=Slider(0.69, range=-10..10), Count=Slider(7, range=1..20))
construct_point = ConstructPoint(XCoordinate=0, YCoordinate=0, ZCoordinate=0)
split_list = SplitList()  # -> ListA, ListB
list_item = ListItem(Index=0, Wrap=True)
replace_items = ReplaceItems(Wrap=False)
partition_list = PartitionList(Size=[3, 2])
pick_n_choose = PickNChoose(Pattern=[0, 1])
cull_index = CullIndex(Wrap=True)
longest_list = LongestList(PaddingMode=2)  # -> ListListA, ListListB
shortest_list = ShortestList(TrimMode=2)  # -> ListListA, ListListB
cross_reference = CrossReference(CrossMode=1)  # -> ListListA, ListListB
concatenate = Concatenate()
line = Line()
