# Grasshopper definition morph_example.gh (Grasshopper 1.0.7)

number_slider = Slider(1, range=0..2)
number_slider_2 = Slider(0.66, range=0..1)

# ---- group: Objeto base
rectangle = Rectangle(Plane=PlaneXY(0, 0, 0), XSize=number_slider, YSize=number_slider, Radius=0)  # -> Rectangle, Length
box_rectangle = BoxRectangle(Rectangle=rectangle.Rectangle, Height=number_slider)
deconstruct_brep = DeconstructBrep(Brep=box_rectangle)  # -> Faces, Edges, Vertices
panel = Panel("""0
6""")
list_item = ListItem(List=deconstruct_brep.Faces, Index=Slider(0, range=0..5), Wrap=True)
list_item_2 = ListItem(List=deconstruct_brep.Vertices, Index=Slider(6, range=0..7), Wrap=True)
list_item_3 = ListItem(List=deconstruct_brep.Edges, Index=Slider(3, range=0..11), Wrap=True)
list_item_4 = ListItem(List=deconstruct_brep.Vertices, Index=panel, Wrap=True)
polyline = PolyLine(Vertices=list_item_4, Closed=False)
extend_curve = ExtendCurve(Curve=polyline, Type=0, Start=number_slider_2, End=number_slider_2)
pipe = Pipe(Curve=extend_curve, Radius=Slider(0.48, range=0..1), Caps=1)
solid_difference = SolidDifference(BrepsA=box_rectangle, BrepsB=pipe)

# ----
curve = Curve(<curve referenced from the Rhino model>)

# ---- group: Superficie base
unit_z = UnitZ(Factor=Slider(13.9, range=0..20))
extrude = Extrude(Base=curve, Direction=unit_z)

# ---- group: EEntradas do Morph
number_slider_3 = Slider(0.63, range=0.1..1)
number_slider_4 = Slider(10, range=1..100)
number_slider_5 = Slider(10, range=1..100)
brep = Brep(solid_difference)
surface = Surface(extrude)

# ---- group: Morph
divide_domain² = DivideDomain²(Domain=surface, UCount=number_slider_5, VCount=number_slider_4)
bounding_box = BoundingBox(Content=brep, Plane=PlaneXY(0, 0, 0))  # -> Box, Box_2
surface_box = SurfaceBox(Surface=surface, Domain=divide_domain², Height=number_slider_3)
multiplication = Multiplication(A=number_slider_5, B=number_slider_4)
panel_2 = Panel(multiplication)
box_morph = BoxMorph(Geometry=brep, Reference=bounding_box.Box, Target=surface_box)  # disabled
