# Grasshopper definition multipav_base_op_02.gh (Grasshopper 1.0.7)

# ---- group: sequência: número de andares e distência piso à Piso
series = Series(Start=Slider(0, range=0..10), Step=Slider(3, range=0..10), Count=Slider(12, range=0..50))

# ---- group: Planos: um plano para cada nível
xy_plane = XYPlane(Origin=Point(0, 0, 0))
deconstruct_plane = DeconstructPlane(Plane=xy_plane)  # -> Origin, XAxis, YAxis, ZAxis
deconstruct = Deconstruct(Point=deconstruct_plane.Origin)  # -> XComponent, YComponent, ZComponent
construct_point = ConstructPoint(XCoordinate=deconstruct.XComponent, YCoordinate=deconstruct.YComponent, ZCoordinate=series)
construct_plane = ConstructPlane(Origin=construct_point, XAxis=deconstruct_plane.XAxis, YAxis=deconstruct_plane.YAxis)

# ---- group: Criando Superfície
curve = Curve([<curve referenced from the Rhino model> x2])
boundary_surfaces = BoundarySurfaces(Edges=curve)

# ---- group: Solução 02: Mover para cada plano
move_to_plane = MoveToPlane(Geometry=boundary_surfaces, Plane=construct_plane, Above=True, Below=True)  # -> Geometry, Transform

# ---- group: espessura da laje
negative = Negative(Value=Slider(0.56, range=0.01..0.7))
unit_z = UnitZ(Factor=negative)
extrude = Extrude(Base=move_to_plane.Geometry, Direction=unit_z)

# ----
panel = Panel(move_to_plane.Geometry)
