# Grasshopper definition multipav_base_op_03.gh (Grasshopper 1.0.7)

# ---- group: sequência: número de andares e distência piso à Piso
number_slider = Slider(12, range=0..50)
series = Series(Start=Slider(0, range=0..10), Step=Slider(3, range=0..10), Count=number_slider)

# ---- group: Planos: um plano para cada nível
xy_plane = XYPlane(Origin=Point(0, 0, 0))
point = Point(Point(16.53990039, 33.96723067, 0))
point_2 = Point(Point(2.464905557, 5.531355585, 0))
plane_origin = PlaneOrigin(Base=xy_plane, Origin=point_2)
deconstruct_plane = DeconstructPlane(Plane=plane_origin)  # -> Origin, XAxis, YAxis, ZAxis
deconstruct = Deconstruct(Point=point)  # -> XComponent, YComponent, ZComponent
construct_point = ConstructPoint(XCoordinate=deconstruct.XComponent, YCoordinate=deconstruct.YComponent, ZCoordinate=series)
construct_plane = ConstructPlane(Origin=construct_point, XAxis=deconstruct_plane.XAxis, YAxis=deconstruct_plane.YAxis)

# ---- group: Criando Superfície
curve = Curve([<curve referenced from the Rhino model> x2])
boundary_surfaces = BoundarySurfaces(Edges=curve)

# ---- group: Solução 03: Orientar para cada plano
construct_domain = ConstructDomain(DomainStart=0, DomainEnd=Slider(30, range=0..30))
subtraction = Subtraction(A=number_slider, B="1")
range = Range(Domain=construct_domain, Steps=subtraction)
rotate_plane = RotatePlane(Plane=construct_plane, Angle=degrees(range))
orient = Orient(Geometry=boundary_surfaces, Source=plane_origin, Target=rotate_plane)  # -> Geometry, Transform

# ---- group: espessura da laje
negative = Negative(Value=Slider(0.56, range=0.01..0.7))
unit_z = UnitZ(Factor=negative)
extrude = Extrude(Base=orient.Geometry, Direction=unit_z)

# ----
panel = Panel(orient.Geometry)
