# Grasshopper definition Exemplo_Mies_rhino7.gh (Grasshopper 1.0.7)

inicio_dos_montantes = Slider(6, range=0..10)
sub_modulos = Slider(7, range=2..10)
de_modulos = Slider(11, range=0..100)
r_montantes = Slider(0.04, range=0..1)
h = Slider(6.695, range=0..10)
crv = Curve([<curve referenced from the Rhino model> x2])
raio_dos_pilates = Slider(0.19, range=0..1)
multiplication = Multiplication(A=de_modulos, B=sub_modulos)
Z = UnitZ(Factor=h)

# ---- group: Lajes
h_piso = Slider(2.8, range=0..3)
h_lajes = Slider(0.2, range=-1..3)
balanço = Slider(10, range=0..10)
crv_2 = Curve(crv)
ext = Extend(Curve=crv_2, Type=0, Start=balanço, End=balanço)
Z_2 = UnitZ(Factor=h_lajes)
loft = Loft(Curves=ext, Options={Adjust=False, Closed=False, LoftEnds=0, LoftSimp=0, LoftType=0, Rebuild=10, Refit=0.01})
Z_3 = UnitZ(Factor=h_piso)
move = Move(Geometry=loft, Motion=Z_3)  # -> Geometry, Transform
move_2 = Move(Geometry=loft, Motion=Z)  # -> Geometry, Transform
extr = Extrude(Base=[move.Geometry, move_2.Geometry], Direction=Z_2)

# ---- group: Rampa
largura = Slider(2.5, range=0..5)
posição = Curve(<curve referenced from the Rhino model>)
comprimento = Curve(<curve referenced from the Rhino model>)
curvepoint = PointOnCurve(posição, parameter=0)
end = EndPoints(Curve=comprimento)  # -> Start, End
vec2pt = Vector2Pt(PointA=end.Start, PointB=end.End, Unitize=False)  # -> Vector, Length
move_3 = Move(Geometry=curvepoint, Motion=vec2pt.Vector)  # -> Geometry, Transform
move_4 = Move(Geometry=curvepoint, Motion=Z_3)  # -> Geometry, Transform
ln = Line(StartPoint=move_4.Geometry, EndPoint=move_3.Geometry)
offset = Offset(Curve=ln, Distance=largura, Plane=PlaneXY(0, 0, 0), Corners=1)
merge = Merge(Data1=ln, Data2=offset)  # -> flatten(Result)
loft_2 = Loft(Curves=merge, Options={Adjust=False, Closed=False, LoftEnds=0, LoftSimp=0, LoftType=0, Rebuild=10, Refit=0.01})

# ----
divide = DivideCurve(Curve=crv, Count=multiplication, Kinks=False)  # -> Points, Tangents, Parameters
dup = DuplicateData(Data=Toggle(False), Number=sub_modulos, Order=True)
addition = Addition(A=Z, B=Z_2)
replace = ListReplace(List=dup, Item=Toggle(True), Indices=0, Wrap=False)
dispatch = Dispatch(List=divide.Points, DispatchPattern=replace)  # -> ListA, ListB
split = SplitList(List=dispatch.ListB, Index=inicio_dos_montantes)  # -> ListA, ListB
cir = Circle(Plane=dispatch.ListA, Radius=raio_dos_pilates)
move_5 = Move(Geometry=split.ListB, Motion=addition)  # -> Geometry, Transform
move_6 = Move(Geometry=split.ListB, Motion=Z_3)  # -> Geometry, Transform
ln_2 = Line(StartPoint=move_6.Geometry, EndPoint=move_5.Geometry)
extr_2 = Extrude(Base=cir, Direction=Z)
cap = CapHoles(Brep=extr_2)
pipe = Pipe(Curve=ln_2, Radius=r_montantes, Caps=1)
