# Grasshopper definition seq_pilares_final.gh (Grasshopper 1.0.7)

# Slider INT
number_slider = Slider(10, range=0..100)
# Selecione Curva(s)
curve = Curve(<curve referenced from the Rhino model>)
# Slider FLOAT
number_slider_2 = Slider(10, range=0..100)
# DIVIDE CURVAS
divide_curve = DivideCurve(Curve=curve, Count=number_slider, Kinks=False)  # -> Points, Tangents, Parameters
# Versor Z
unit_z = UnitZ(Factor=number_slider_2)
point = Point(divide_curve.Points)
panel = Panel(divide_curve.Points)
# MOVE OBJETOS
move = Move(Geometry=point, Motion=unit_z)  # -> Geometry, Transform
# Slider FLOAT
number_slider_3 = Slider(10, range=0..100)
panel_2 = Panel(move.Geometry)
# LINHA ENTRE DOIS PONTOS
line = Line(StartPoint=point, EndPoint=move.Geometry)
# TUBO
pipe = Pipe(Curve=line, Radius=number_slider_3, Caps="1")
