# Grasshopper definition profile.gh (Grasshopper 1.0.7)

number_slider = Slider(1, range=0..10)
number_slider_2 = Slider(1.32, range=1..10)
number_slider_3 = Slider(0.5, range=0..1)
multiplication = Multiplication(A=".2", B=number_slider)
multiplication_2 = Multiplication(A=".175", B=number_slider)
multiplication_3 = Multiplication(A=".282", B=number_slider)
multiplication_4 = Multiplication(A=".5", B=number_slider)
negative = Negative(Value=multiplication_4)
series = Series(Start=Slider(0, range=0..100), Step=Slider(0.25, range=0..1), Count=Slider(13, range=0..100))
square = Square(Value=multiplication_2)
negative_2 = Negative(Value=multiplication_3)
negative_3 = Negative(Value=multiplication_2)
division = Division(A=square, B=negative)
data = Data(series)
unit_x = UnitX(Factor=1)
evaluate = Evaluate(Expression="(k*(x/h)^n) *h", h=number_slider, k=number_slider_2, n=number_slider_3, x=data)
negative_4 = Negative(Value=unit_x)
negative_5 = Negative(Value=data)
ghpython_script = GhPythonScript(x=series, k=number_slider_2, n=number_slider_3, h=number_slider)  # -> out, points; inputs x: list
# ---------- ghpython_script: Python ----------
__version__ = "2022.02.11"

import rhinoscriptsyntax as rs
import math
points=[]

print(x)
for x_elem in x:
    y = (k*(x_elem/h)**n) *h
    pt_aux = rs.CreatePoint(y, -x_elem, 0)
    points.append(pt_aux)
# ---------- end ghpython_script ----------
construct_point = ConstructPoint(XCoordinate=evaluate, YCoordinate=negative_5, ZCoordinate=0)
panel = Panel(ghpython_script.points)
evaluate_2 = Evaluate(Expression="(((h*.5)^2 - (0.175*h)^2)^0.5)", h=number_slider)
subtraction = Subtraction(A=multiplication_4, B=evaluate_2)
negative_6 = Negative(Value=subtraction)
construct_point_2 = ConstructPoint(XCoordinate=negative_3, YCoordinate=negative_6, ZCoordinate=0)
arc_sed = ArcSED(Start="0,0,0", End=construct_point_2, Direction=negative_4)  # -> Arc, Plane, Radius
evaluate_curve = EvaluateCurve(Curve=reparameterize(arc_sed.Arc), Parameter="1")  # -> Point, Tangent, Angle
interpolate_t = InterpolateT(Vertices=construct_point, TangentStart=unit_x, TangentEnd=Vector(0, 0, 0), KnotStyle=1)  # -> Curve, Length, Domain
evaluate_3 = Evaluate(Expression="(0.3/0.5)*0.175", d=evaluate_2)
panel_2 = Panel(evaluate_2)
evaluate_4 = Evaluate(Expression="(0.3/0.5)*d", d=evaluate_2)
subtraction_2 = Subtraction(A=multiplication_4, B=evaluate_4)
evaluate_5 = Evaluate(Expression="(((h*.2)^2 - (0.282*h - a)^2)^0.5)", h=number_slider, a=evaluate_3)
negative_7 = Negative(Value=subtraction_2)
addition = Addition(A=evaluate_5, B=negative_7)
panel_3 = Panel(evaluate_5)
panel_4 = Panel(negative_7)
construct_point_3 = ConstructPoint(XCoordinate=negative_2, YCoordinate=addition, ZCoordinate=0)
arc_sed_2 = ArcSED(Start=evaluate_curve.Point, End=construct_point_3, Direction=evaluate_curve.Tangent)  # -> Arc, Plane, Radius
image_sampler = ImageSampler(
    FilePath="D:\storage\Ondrive_personal\OneDrive\Desktop\Standard-crest-profile-of-an-overflow-spillway-USBR-1987.png",
    Filter="Colour",
    Interpolate=False,
    Umax=1,
    Umin=0,
    Vmax=1,
    Vmin=0,
    Wrap=1)
