# Grasshopper definition profile_03.gh (Grasshopper 1.0.7)

image_sampler = ImageSampler(
    FilePath="D:\storage\Ondrive_personal\OneDrive\Desktop\Standard-crest-profile-of-an-overflow-spillway-USBR-1987.png",
    Filter="Colour",
    Interpolate=False,
    Umax=1,
    Umin=0,
    Vmax=1,
    Vmin=0,
    Wrap=1)

# ---- group: h0 coeficients
number_slider = Slider(2, range=0..10)
panel = Panel(".175")
panel_2 = Panel(".282")
panel_3 = Panel(".2")
panel_4 = Panel(".5")
multiplication = Multiplication(A=panel_3, B=number_slider)
multiplication_2 = Multiplication(A=panel_2, B=number_slider)
multiplication_3 = Multiplication(A=panel, B=number_slider)
multiplication_4 = Multiplication(A=panel_4, B=number_slider)

# ---- group: x series
series = Series(XSeries=Slider(0, range=0..100), Step=Slider(0.25, range=0..1), Count=Slider(13, range=0..100))

# ---- group: spline
data = Data(series)
evaluate = Evaluate(Expression="(k*(x/h)^n) *h", h=number_slider, k=Slider(1.32, range=1..10), n=Slider(0.5, range=0..1), x=data)
negative = Negative(Value=data)
construct_point = ConstructPoint(XCoordinate=evaluate, YCoordinate=negative, ZCoordinate=0)
interpolate_t = InterpolateT(Vertices=construct_point, TangentStart=Vector(0, 0, 0), TangentEnd=Vector(0, 0, 0), KnotStyle=1)  # -> Curve, Length, Domain

# ----
ghpython_script = GhPythonScript(h=number_slider, c1=panel_4, c2=panel_3, c3=panel, c4=panel_2)  # -> out, arch1, arch2
# ---------- ghpython_script: Python ----------
from __future__ import print_function
import math
import rhinoscriptsyntax as rs
from Rhino.Geometry import Point3d, Curve, Arc


# Arch 01
# coordinate x of end point
a1x2 = - c3 * h
# coordinate y of end point
aux_01 = (((h*c1)**2 - (c3*h)**2)**0.5)
a1y2 =  aux_01 - (c1*h)
# end point of arch 1
p2a1 = rs.CreatePoint(a1x2, a1y2, 0)
# arch one
arch1 = rs.AddArcPtTanPt([0,0,0], # star point list o coordinates
                        [-1,0,0], # direction list fos 
                        p2a1)

vec1 = rs.CurveTangent(arch1, rs.CurveLength(arch1))

a2x2 = -h*c4


aux_02 = c1*h - (aux_01 * ((c1-c2)/c1))
aux_03 = (((h*c2)**2 - (c4*h - (((c1-c2)/c1)*c3*h))**2)**0.5)
print(aux_01, aux_02, aux_03)
a2y2 =   aux_03  - aux_02

p2a2 = rs.CreatePoint(a2x2, a2y2, 0)

arch2 = rs.AddArcPtTanPt(p2a1, # star point 
                        vec1, # direction list fos 
                        p2a2)


"""



(((h*c2)^2 - (c4*h - (((c1-c2)/c1)*c3*h))^2)^0.5) - (c1*h) - (((h*c1)^2 - (c3*h)^2)^0.5)* ((c1-c2)/c1) 


"""
# ---------- end ghpython_script ----------
panel_5 = Panel(ghpython_script.out)
end_points = EndPoints(Curve=ghpython_script.arch2)  # -> Start, End

# ---- group: botton lines
list_length = ListLength(List=construct_point)
subtraction = Subtraction(A=list_length, B="1")
unit_y = UnitY(Factor=Slider(0.34, range=0..10))
negative_2 = Negative(Value=unit_y)
list_item = ListItem(List=construct_point, Index=subtraction, Wrap=True)
move = Move(Geometry=list_item, Motion=negative_2)  # -> Geometry, Transform
deconstruct = Deconstruct(Point=move.Geometry)  # -> XComponent, YComponent, ZComponent
deconstruct_2 = Deconstruct(Point=end_points.End)  # -> XComponent, YComponent, ZComponent
construct_point_2 = ConstructPoint(XCoordinate=deconstruct_2.XComponent, YCoordinate=deconstruct.YComponent, ZCoordinate=0)
merge = Merge(Data1=end_points.End, Data2=construct_point_2, Data3=move.Geometry, Data4=list_item)  # -> flatten(Result)
polyline = PolyLine(Vertices=merge, Closed=False)
