# Grasshopper definition brise_parametrico_2021b.gh (Grasshopper 1.0.7)
# Copyright: MIT

curve = Curve(<curve referenced from the Rhino model>)

# ---- group: Eixos dos montantes
unit_z = UnitZ(Factor=Slider(12.53, range=1..20))
divide_curve = DivideCurve(Curve=curve, Count=Slider(18, range=1..20), Kinks=False)  # -> Points, Tangents, Parameters
move = Move(Geometry=divide_curve.Points, Motion=unit_z)  # -> Geometry, Transform
line = Line(StartPoint=divide_curve.Points, EndPoint=move.Geometry)

# ---- group: montantes
construct_plane = ConstructPlane(Origin=divide_curve.Points, XAxis=divide_curve.Tangents, YAxis=Vector(0, 1, 0))
retângulo_centralizado_no_plano = RetânguloCentralizadoNoPlano(plane=construct_plane, angle="0", dimensão_x=Slider(0.13, range=0..10), dimensão_y=Slider(0.9, range=0..10))
extrude_along = ExtrudeAlong(Base=retângulo_centralizado_no_plano, Curve=line)

# ----
number_slider = Slider(21, range=0..100)

# ---- group: eixos aletas
closed = Closed(Curve=curve)  # -> Closed, Periodic
shift_list = ShiftList(List=line, Shift=1, Wrap=closed.Closed)
shortest_list = ShortestList(ListA=line, ListB=shift_list, TrimMode=2)  # -> ListA, ListB
divide_curve_2 = DivideCurve(Curve=shortest_list.ListA, Count=number_slider, Kinks=False)  # -> Points, Tangents, Parameters
divide_curve_3 = DivideCurve(Curve=shortest_list.ListB, Count=number_slider, Kinks=False)  # -> Points, Tangents, Parameters
line_2 = Line(StartPoint=divide_curve_2.Points, EndPoint=divide_curve_3.Points)

# ----
panel = Panel(closed.Closed)
panel_2 = Panel(line_2)

# ---- group: Aletas
construct_plane_2 = ConstructPlane(Origin=divide_curve_2.Points, XAxis=line_2, YAxis=unit_z)
deconstruct_plane = DeconstructPlane(Plane=construct_plane_2)  # -> Origin, XAxis, YAxis, ZAxis
construct_plane_3 = ConstructPlane(Origin=deconstruct_plane.Origin, XAxis=deconstruct_plane.ZAxis, YAxis=deconstruct_plane.YAxis)
rec_plane = RetânguloCentralizadoNoPlano(
    plane=construct_plane_3,
    angle=Slider(50.81, range=0..360),
    dimensão_x=Slider(0.4, range=0..1),
    dimensão_y=Slider(0.06, range=0..1))

# ----
extrude_along_2 = ExtrudeAlong(Base=rec_plane, Curve=line_2)

# ==== cluster RetânguloCentralizadoNoPlano
plane = ClusterInput()
angle = ClusterInput()
dimensão_y = ClusterInput()  # compimento do retângulo no eixo y
dimensão_x = ClusterInput()  # compimento do retângulo no eixo x
rotate_plane = RotatePlane(Plane=plane, Angle=degrees(angle))
division = Division(A=dimensão_x, B="2")
division_2 = Division(A=dimensão_y, B="2")
negative = Negative(Value=division)
negative_2 = Negative(Value=division_2)
construct_domain = ConstructDomain(DomainStart=negative_2, DomainEnd=division_2)
construct_domain_2 = ConstructDomain(DomainStart=negative, DomainEnd=division)
rectangle = Rectangle(Plane=rotate_plane, XSize=construct_domain_2, YSize=construct_domain, Radius=0)  # -> Rectangle, Length
boundary_surfaces = BoundarySurfaces(Edges=rectangle.Rectangle)
surfaces = ClusterOutput(boundary_surfaces)
