# Grasshopper definition points_grid.gh (Grasshopper 1.0.7)

# ---- group: x
number_slider = Slider(7, range=0..10)
number_slider_2 = Slider(8.4, range=0..50)
series = Series(Start=0, Step=number_slider_2, Count=number_slider)
construct_point = ConstructPoint(XCoordinate=series, YCoordinate=0, ZCoordinate=0)

# ---- group: y
number_slider_3 = Slider(5, range=0..10)
series_2 = Series(Start=0, Step=Slider(8.4, range=0..50), Count=number_slider_3)  # -> graft(Series)
unit_y = UnitY(Factor=series_2)
move = Move(Geometry=construct_point, Motion=unit_y)  # -> Geometry, Transform

# ---- group: z
number_slider_4 = Slider(8.4, range=0..50)
series_3 = Series(Start=0, Step=number_slider_4, Count=Slider(6, range=0..10))  # -> graft(Series)
unit_z = UnitZ(Factor=series_3)
move_2 = Move(Geometry=flatten(move.Geometry), Motion=unit_z)  # -> Geometry, Transform

# ----
panel = Panel(number_slider_2)
panel_2 = Panel(number_slider_4)
panel_3 = Panel(series)
panel_4 = Panel(construct_point)
panel_5 = Panel(series_3)
panel_6 = Panel(move.Geometry)
data = Data(move_2.Geometry)

# ---- group: x axis
partition_list = PartitionList(List=flatten(data), Size=number_slider)
polyline = PolyLine(Vertices=partition_list, Closed=False)

# ---- group: y axis
flip_matrix = FlipMatrix(Data=partition_list)
partition_list_2 = PartitionList(List=flatten(flip_matrix), Size=number_slider_3)
polyline_2 = PolyLine(Vertices=partition_list_2, Closed=False)

# ----
param_viewer = ParamViewer(data)

# ---- group: z axis
flip_matrix_2 = FlipMatrix(Data=data)
polyline_3 = PolyLine(Vertices=flip_matrix_2, Closed=False)

# ----
param_viewer_2 = ParamViewer(partition_list)
param_viewer_3 = ParamViewer(flip_matrix)
param_viewer_4 = ParamViewer(flip_matrix_2)
param_viewer_5 = ParamViewer(partition_list_2)
param_viewer_6 = ParamViewer(polyline_3)
param_viewer_7 = ParamViewer(polyline_2)
