# Grasshopper definition morph_base.gh (Grasshopper 1.0.7)

# ---- group: EEntradas do Morph
number_slider = Slider(0.63, range=0.1..1)
number_slider_2 = Slider(10, range=1..100)
number_slider_3 = Slider(10, range=1..100)
brep = Brep(<brep referenced from the Rhino model>)
surface = Surface(<surface referenced from the Rhino model>)

# ---- group: Morph
divide_domain² = DivideDomain²(Domain=surface, UCount=number_slider_3, VCount=number_slider_2)
bounding_box = BoundingBox(Content=brep, Plane=PlaneXY(0, 0, 0))  # -> Box, Box_2
surface_box = SurfaceBox(Surface=surface, Domain=divide_domain², Height=number_slider)
multiplication = Multiplication(A=number_slider_3, B=number_slider_2)
panel = Panel(multiplication)
box_morph = BoxMorph(Geometry=brep, Reference=bounding_box.Box, Target=surface_box)
