# Grasshopper definition multipav_base_op_01.gh (Grasshopper 1.0.7)

# ---- group: sequência: número de andares e distência piso à Piso
series = Series(Start=Slider(0, range=0..10), Step=Slider(3, range=0..10), Count=Slider(12, range=0..50))

# ---- group: Criando Superfície
curve = Curve([<curve referenced from the Rhino model> x2])
boundary_surfaces = BoundarySurfaces(Edges=curve)

# ---- group: Solução 01: mover com um vetor
unit_z = UnitZ(Factor=series)
move = Move(Geometry=boundary_surfaces, Motion=unit_z)  # -> Geometry, Transform

# ---- group: espessura da laje
negative = Negative(Value=Slider(0.56, range=0.01..0.7))
unit_z_2 = UnitZ(Factor=negative)
extrude = Extrude(Base=move.Geometry, Direction=unit_z_2)

# ----
panel = Panel(move.Geometry)
