# Grasshopper definition vect_plane_basics.gh (Grasshopper 1.0.7)

construct_point = ConstructPoint(XCoordinate=Slider(1.829, range=0..10), YCoordinate=Slider(3.213, range=0..10), ZCoordinate=Slider(0, range=0..10))
construct_point_2 = ConstructPoint(XCoordinate=Slider(0, range=0..10), YCoordinate=Slider(0, range=0..10), ZCoordinate=Slider(0, range=0..10))
divide_curve = DivideCurve(Count=10, Kinks=False)  # -> Points, Tangents, Parameters
vector_xyz = VectorXYZ(XComponent=0, YComponent=0, ZComponent=0)  # -> Vector, Length
vector_2pt = Vector2Pt(Unitize=False)  # -> Vector, Length
vector_display = VectorDisplay()
deconstruct_plane = DeconstructPlane(Plane=PlaneXY(0, 0, 0))  # -> Origin, XAxis, YAxis, ZAxis
plane_normal = PlaneNormal(Origin=Point(0, 0, 0), ZAxis=Vector(0, 0, 1))
construct_plane = ConstructPlane(Origin=Point(0, 0, 0), XAxis=Vector(1, 0, 0), YAxis=Vector(0, 1, 0))
xz_plane = XZPlane(Origin=Point(0, 0, 0))
yz_plane = YZPlane(Origin=Point(0, 0, 0))
xy_plane = XYPlane(Origin=Point(0, 0, 0))
rectangle = Rectangle(Plane=PlaneXY(0, 0, 0), XSize=Domain(-1, 1), YSize=Domain(-2, 2), Radius=0)  # -> Rectangle, Length
circle = Circle(Plane=PlaneXY(0, 0, 0), Radius=1)
unit_vector = UnitVector()
cross_product = CrossProduct(Unitize=False)  # -> Vector, Length
addition = Addition()
subtraction = Subtraction()
move = Move(Motion=Vector(0, 0, 10))  # -> Geometry, Transform
vector_display_2 = VectorDisplay()
