# Grasshopper definition profile_01.gh (Grasshopper 1.0.7)

number_slider = Slider(1, range=0..10)

# ---- group: serie input of x
series = Series(Start=Slider(0, range=0..100), Step=Slider(0.25, range=0..1), Count=Slider(13, range=0..100))

# ----
number_slider_2 = Slider(1.32, range=1..10)
number_slider_3 = Slider(0.5, range=0..1)

# ---- group: h0 coeficients
multiplication = Multiplication(A=".2", B=number_slider)
multiplication_2 = Multiplication(A=".175", B=number_slider)
multiplication_3 = Multiplication(A=".282", B=number_slider)
multiplication_4 = Multiplication(A=".5", B=number_slider)

# ----
image_sampler = ImageSampler(
    FilePath="D:\storage\Ondrive_personal\OneDrive\Desktop\Standard-crest-profile-of-an-overflow-spillway-USBR-1987.png",
    Filter="Colour",
    Interpolate=False,
    Umax=1,
    Umin=0,
    Vmax=1,
    Vmin=0,
    Wrap=1)
negative = Negative(Value=multiplication_3)

# ---- group: Arc 01
negative_2 = Negative(Value=multiplication_4)
square = Square(Value=multiplication_2)
negative_3 = Negative(Value=multiplication_2)
division = Division(A=square, B=negative_2)
unit_x = UnitX(Factor=1)
construct_point = ConstructPoint(XCoordinate=negative_3, YCoordinate=division, ZCoordinate=0)
negative_4 = Negative(Value=unit_x)
arc_sed = ArcSED(Start="0,0,0", End=construct_point, Direction=negative_4)  # -> Arc, Plane, Radius

# ---- group: spline expression
data = Data(series)
evaluate = Evaluate(Expression="(k*(x/h)^n) *h", h=number_slider, k=number_slider_2, n=number_slider_3, x=data)
negative_5 = Negative(Value=data)
construct_point_2 = ConstructPoint(XCoordinate=evaluate, YCoordinate=negative_5, ZCoordinate=0)

# ---- group: python version
ghpython_script = GhPythonScript(x=series, k=number_slider_2, n=number_slider_3, h=number_slider)  # -> out, points; inputs x: list
# ---------- ghpython_script: Python ----------
__version__ = "2022.02.11"

import rhinoscriptsyntax as rs
import math
points=[]

print(x)
for x_elem in x:
    y = (k*(x_elem/h)**n) *h
    pt_aux = rs.CreatePoint(y, -x_elem, 0)
    points.append(pt_aux)
# ---------- end ghpython_script ----------
panel = Panel(ghpython_script.points)

# ----
interpolate_t = InterpolateT(Vertices=construct_point_2, TangentStart=unit_x, TangentEnd=Vector(0, 0, 0), KnotStyle=1)  # -> Curve, Length, Domain
