# Grasshopper definition profile_03.gh (Grasshopper 1.0.7)

# ---- group: x series
series = Series(XSeries=Slider(0, range=0..100), Step=Slider(0.33, range=0..1), Count=Slider(13, range=0..100))

# ---- group: h0 coeficients
number_slider = Slider(2, range=0..10)
panel = Panel(".2")
panel_2 = Panel(".282")
panel_3 = Panel(".5")
panel_4 = Panel(".175")

# ----
image_sampler = ImageSampler(Filter="Colour", Interpolate=False, Umax=1, Umin=0, Vmax=1, Vmin=0, Wrap=1)
ghpython_script = GhPythonScript(
    h=number_slider,
    c1=panel_3,
    c2=panel,
    c3=panel_4,
    c4=panel_2,
    k=Slider(1.32, range=1..10),
    n=Slider(0.63, range=0..1),
    x_coords=series,
    botton_dist=Slider(0.73, range=0..10))  # -> out, arc1, arc2, spline_curve, b_curve, profile; inputs x_coords: list
# ---------- ghpython_script: Python ----------
from __future__ import print_function
import math
import rhinoscriptsyntax as rs
from Rhino.Geometry import Point3d, Curve, Arc


# Arc 01
# coordinate x of end point
a1x2 = - c3 * h
# coordinate y of end point
aux_01 = (((h*c1)**2 - (c3*h)**2)**0.5)
a1y2 =  aux_01 - (c1*h)
# end point of arc 1
p2a1 = rs.CreatePoint(a1x2, a1y2, 0)
# arc one
arc1 = rs.AddArcPtTanPt([0,0,0], # star point list o coordinates
                        [-1,0,0], # direction list fos 
                        p2a1)
#Arc 02
# Tangent vectr at the end of arc 1
vec1 = rs.CurveTangent(arc1, rs.CurveLength(arc1))
# x coordiate of end point of arc 02
a2x2 = -h*c4


aux_02 = c1*h - (aux_01 * ((c1-c2)/c1))
aux_03 = (((h*c2)**2 - (c4*h - (((c1-c2)/c1)*c3*h))**2)**0.5)
# y coordiate of end point of arc 02
a2y2 =   aux_03  - aux_02
# end point of arc 2
p2a2 = rs.CreatePoint(a2x2, a2y2, 0)
#Arc 02
arc2 = rs.AddArcPtTanPt(p2a1, # star point 
                        vec1, # direction list fos 
                        p2a2)

# Spline curve
points_list = []

for i in x_coords:
    y = (k*(i/h)**n) *h
    p_aux = Point3d(y, -i , 0)
    points_list.append(p_aux)
# Create spline
spline_curve = rs.AddInterpCurve( points_list , degree=3, knotstyle=0, start_tangent=[1,0,0])

# botton curve
x, y, z = p_aux
p_aux_2 = Point3d(x, y - botton_dist, z)
x2, y2, z2 = p2a2
p_aux_3 = Point3d(x2, y - botton_dist, z2)
b_curve = rs.AddPolyline([p_aux, p_aux_2, p_aux_3, p2a2])
#close profile
rs.ReverseCurve(arc1)
rs.ReverseCurve(arc2)
profile = rs.JoinCurves([arc2, arc1, spline_curve, b_curve])
# ---------- end ghpython_script ----------
closed = Closed(Curve=ghpython_script.profile)  # -> Closed, Periodic
panel_5 = Panel(closed.Closed)
