# Grasshopper definition psychometric.gh (Grasshopper 1.0.7)

psychrometricchart = LBPsychrometricChart(temperature=Slider(24.32, range=0..100), rel_humidity=Slider(49.23, range=0..100), plot_wet_bulb=Toggle(True))  # -> out, title, temp_lines, rh_lines, hr_lines, enth_wb_lines, mesh, legend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; plug-in component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
pmv_polygon = LBPMVPolygon(psych_chart=psychrometricchart.psych_chart)  # -> out, total_comfort, total_comf_data, polygon_names, polygon_comfort, polygon_data, comfort_poly, strategy_poly; plug-in component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
custom_preview = CustomPreview(
    Geometry=[psychrometricchart.rh_lines, psychrometricchart.hr_lines, psychrometricchart.enth_wb_lines, psychrometricchart.temp_lines],
    Material=ColourSwatch(SwatchColor=RGB(0, 0, 0)))
custom_preview_2 = CustomPreview(Geometry=pmv_polygon.comfort_poly, Material=ColourSwatch(SwatchColor=RGB(28, 154, 232)))
