# Grasshopper definition SKYDOME_separate.gh (Grasshopper 1.0.7)
# plug-ins: LadybugGrasshopper

# ---- group: Norte
curve = Curve(<curve referenced from the Rhino model>)
end_points = EndPoints(Curve=curve)  # -> Start, End
xy_plane = XYPlane(Origin=Point(0, 0, 0))
vector_2pt = Vector2Pt(PointA=end_points.Start, PointB=end_points.End, Unitize=False)  # -> Vector, Length
unit_y = UnitY(Factor=1)
angle = Angle(VectorA=unit_y, VectorB=vector_2pt.Vector, Plane=xy_plane)  # -> Angle, Reflex
degrees = Degrees(Radians=angle.Angle)
compass = LBCompass(north=degrees, center=end_points.Start)  # -> compass; plug-in component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

# ----
lb_falsestarttoggle = LBFalseStartToggle(False)
panel = Panel("http://climate.onebuilding.org/WMO_Region_3_South_America/BRA_Brazil/BA_Bahia/BRA_BA_Salvador-Magalhaes.Intl.AP.832480_TMYx.zip")
downloadepw = LBDownloadWeather(weather_URL=panel)  # -> epw_file, stat_file, ddy_file; plug-in component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
epwmap = LBEPWmap(epw_map=lb_falsestarttoggle)  # -> Output; plug-in component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
importepw = LBImportEPW(epw_file=downloadepw.epw_file)  # -> location, dry_bulb_temperature, dew_point_temperature, relative_humidity, wind_speed, wind_direction, direct_normal_rad, diffuse_horizontal_rad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; plug-in component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

# ---- group: zero diffuse radiation
xdata = LBDeconstructData(data=importepw.diffuse_horizontal_rad)  # -> header, values; plug-in component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
list_length = ListLength(List=xdata.values)
repeat_data = RepeatData(Data="0", Length=list_length)
data = LBConstructData(header=xdata.header, values=repeat_data)  # -> data; plug-in component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
panel_2 = Panel(data)

# ----
panel_3 = Panel(degrees)

# ---- group: AJUSTES DO SKYDOME
legendpar = LBLegendParameters(min="0", max=Slider(60, range=0..100))  # -> leg_par; plug-in component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
value_list = ValueList({"ORTHOGRAPHIC", "STEREOGRAPHIC", "3D": NULL}, selected="STEREOGRAPHIC")
boolean_toggle = BooleanToggle(False)

# ---- group: skydome total | direto e difuso
value_list_2 = ValueList({"ORTHOGRAPHIC", "STEREOGRAPHIC", "3D": NULL}, selected="3D")
skymatrix = LBCumulativeSkyMatrix(
    north=degrees,
    location=importepw.location,
    direct_rad=importepw.direct_normal_rad,
    diffuse_rad=importepw.diffuse_horizontal_rad,
    high_density=boolean_toggle)  # -> out, sky_mtx; plug-in component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
skydome = LBSkyDome(sky_mtx=skymatrix.sky_mtx, projection=value_list_2, show_comp=Toggle(True), legend_par=legendpar)  # -> out, mesh, compass, legend, title, patch_vecs, patch_values, mesh_values; plug-in component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

# ---- group: skydome total | direct radiation
value_list_3 = ValueList({"ORTHOGRAPHIC", "STEREOGRAPHIC", "3D": NULL}, selected="3D")
skymatrix_2 = LBCumulativeSkyMatrix(
    north=degrees,
    location=importepw.location,
    direct_rad=importepw.direct_normal_rad,
    diffuse_rad=data,
    high_density=boolean_toggle)  # -> out, sky_mtx; plug-in component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
point = Point(Point(302.7730911, 317.9064218, 0))
skydome_2 = LBSkyDome(sky_mtx=skymatrix_2.sky_mtx, center_pt=point, projection=value_list_3, show_comp=Toggle(False), legend_par=legendpar)  # -> out, mesh, compass, legend, title, patch_vecs, patch_values, mesh_values; plug-in component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

# ----
param_viewer = ParamViewer(skydome.patch_values)
panel_4 = Panel(skydome.patch_values)

# ---- group: branches skydome
param_viewer_2 = ParamViewer(skydome.patch_values)
tree_branch = TreeBranch(Tree=simplify(skydome.patch_values), Path=Slider(2, range=0..2), MaintainPaths=True)
tree_branch_2 = TreeBranch(Tree=simplify(skydome.patch_values), Path=Slider(0, range=0..2), MaintainPaths=True)
bounds = Bounds(Numbers=tree_branch_2)
panel_5 = Panel(tree_branch)
panel_6 = Panel(bounds)
panel_7 = Panel(tree_branch_2)

# ----
tree_branch_3 = TreeBranch(Tree=simplify(skydome.mesh_values), Path=Slider(0, range=0..2), MaintainPaths=True)

# ---- group: RECRIANDO SKYMATRIX DIFFUSE
unit_x = UnitX(Factor=Slider(300, range=0..1000))
subtraction = Subtraction(A=tree_branch_3, B=skydome_2.mesh_values)
move = Move(Geometry=skydome_2.mesh, Motion=unit_x)  # -> Geometry, Transform
move_2 = Move(Geometry=skydome_2.compass, Motion=unit_x)  # -> Geometry, Transform
panel_8 = Panel(move.Geometry)
panel_9 = Panel(subtraction)
heatmap = LBSpatialHeatmap(values=subtraction, mesh=move.Geometry, legend_par=legendpar, legend_title="kW/m2")  # -> mesh, legend, title, colors, legend_par; plug-in component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

# ----
bounds_2 = Bounds(Numbers=tree_branch_3)
panel_10 = Panel(bounds_2)
