# Grasshopper definition rad_surfaces_multiple.gh (Grasshopper 1.0.7)
# plug-ins: LadybugGrasshopper

# ---- group: Norte
curve = Curve(<curve referenced from the Rhino model>)
end_points = EndPoints(Curve=curve)  # -> Start, End
xy_plane = XYPlane(Origin=Point(0, 0, 0))
vector_2pt = Vector2Pt(PointA=end_points.Start, PointB=end_points.End, Unitize=False)  # -> Vector, Length
unit_y = UnitY(Factor=1)
angle = Angle(VectorA=unit_y, VectorB=vector_2pt.Vector, Plane=xy_plane)  # -> Angle, Reflex
degrees = Degrees(Radians=angle.Angle)
compass = LBCompass(north=degrees, center=end_points.Start)  # -> compass; plug-in component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

# ---- group: EPW
panel = Panel("http://climate.onebuilding.org/WMO_Region_3_South_America/BRA_Brazil/BA_Bahia/BRA_BA_Salvador-Magalhaes.Intl.AP.832480_TMYx.zip")
lb_falsestarttoggle = LBFalseStartToggle(False)
epwmap = LBEPWmap(epw_map=lb_falsestarttoggle)  # -> Output; plug-in component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
downloadepw = LBDownloadWeather(weather_URL=panel)  # -> epw_file, stat_file, ddy_file; plug-in component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
importepw = LBImportEPW(epw_file=downloadepw.epw_file)  # -> location, dry_bulb_temperature, dew_point_temperature, relative_humidity, wind_speed, wind_direction, direct_normal_rad, diffuse_horizontal_rad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; plug-in component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

# ---- group: Skydome
skymatrix = LBCumulativeSkyMatrix(
    north=degrees,
    location=importepw.location,
    direct_rad=importepw.direct_normal_rad,
    diffuse_rad=importepw.diffuse_horizontal_rad,
    high_density=Toggle(False))  # -> out, sky_mtx; plug-in component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

# ----
panel_2 = Panel(degrees)
brep = Brep(<brep referenced from the Rhino model>)

# ---- group: Rotação do EDF
point = Point(<point referenced from the Rhino model>)
xy_plane_2 = XYPlane(Origin=Point(0, 0, 0))
construct_domain = ConstructDomain(DomainStart="0", DomainEnd="360")
plane_origin = PlaneOrigin(Base=xy_plane_2, Origin=point)
range = Range(Domain=construct_domain, Steps=Slider(36, range=2..360))
rotate = Rotate(Geometry=brep, Angle=degrees(range), Plane=plane_origin)  # -> graft(Geometry), Transform

# ----
panel_3 = Panel(range)
item_index = ItemIndex(List=range, Item=range)
panel_4 = Panel(item_index)
brep_2 = Brep([<brep referenced from the Rhino model> x2])
lb_falsestarttoggle_2 = LBFalseStartToggle(False)
incidentradiation = LBIncidentRadiation(
    sky_mtx=skymatrix.sky_mtx,
    geometry=rotate.Geometry,
    context=flatten(brep_2),
    grid_size=Slider(5, range=0.01..10),
    run=lb_falsestarttoggle_2)  # -> out, points, results, total, mesh, legend, title, int_mtx; plug-in component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
panel_5 = Panel(incidentradiation.total)

# ---- group: domínio dos resultados
bounds = Bounds(Numbers=flatten(incidentradiation.total))
deconstruct_domain = DeconstructDomain(Domain=bounds)  # -> Start, End
panel_6 = Panel(bounds)
subtraction = Subtraction(A=deconstruct_domain.End, B=deconstruct_domain.Start)
panel_7 = Panel(subtraction)

# ---- group: Ordenando resultados
flatten_tree = FlattenTree(Tree=incidentradiation.mesh, Path="{0}")
flatten_tree_2 = FlattenTree(Tree=incidentradiation.total, Path="{0}")
panel_8 = Panel(flatten_tree_2)
sort_list = SortList(Keys=flatten_tree_2, ValuesAngulos=range, ValuesMesh=flatten_tree, ValuesIndex=item_index)  # -> Keys, ValuesAngulos, ValuesMesh, ValuesIndex
number_slider = Slider(0, range=0..5)
list_item = ListItem(List=sort_list.ValuesMesh, Index=number_slider, Wrap=True)
list_item_2 = ListItem(List=sort_list.ValuesIndex, Index=number_slider, Wrap=True)
tree_branch = TreeBranch(Tree=simplify(incidentradiation.results), Path=list_item_2, MaintainPaths=True)

# ----
panel_9 = Panel(sort_list.ValuesAngulos)
panel_10 = Panel(sort_list.Keys)
panel_11 = Panel(tree_branch)
